# Grasshopper definition building_performance_study_infomation_panel.gh (Grasshopper 1.0.8)
# plug-ins: RhinoCodePluginGH, Opossum2_0_Proto_A

coutryard_form = Slider(0, range=0..1)
win_ratio_n = Slider(0.6, range=0.6..0.61)
mat_typ = Slider(3, range=1..3)
mat_qua = Slider(1, range=0.5..1.5)
win_ratio_s = Slider(0.6, range=0.3..0.9)
flr_height = Slider(4.25, range=3.75..4.75)

# ----
# variables
seg_d1 = Slider(0.833, range=0.444..0.917)
seg_t0 = Slider(0, range=-1..1)
sp0 = Slider(6, range=0..7)
seg_d0 = Slider(0.833, range=0.313..0.941)
seg_d2 = Slider(0.833, range=0.313..0.941)
seg_d3 = Slider(0.833, range=0.444..0.917)
seg_t1 = Slider(0, range=-1..1)
seg_t2 = Slider(0, range=-1..1)
seg_t3 = Slider(0, range=-1..1)
seg_dd0 = Slider(25, range=12..25)
seg_dd1 = Slider(12, range=12..25)
seg_dd2 = Slider(25, range=12..25)
seg_dd3 = Slider(12, range=12..25)
sp1 = Slider(0, range=0..7)
sp2 = Slider(6, range=0..7)
sp3 = Slider(0, range=0..7)
courtyard_pattern = Slider(0, range=0..7)
geo_var = Merge(
    Data1=seg_d0,
    Data2=seg_d1,
    Data3=seg_d2,
    Data4=seg_d3,
    Data5=seg_t0,
    Data6=seg_t1,
    Data7=seg_t2,
    Data8=seg_t3,
    Data9=seg_dd0,
    Data10=seg_dd1,
    Data11=seg_dd2,
    Data12=seg_dd3,
    Data13=sp0,
    Data14=sp1,
    Data15=sp2,
    Data16=sp3,
    Data17=courtyard_pattern)
non_geo_var = Merge(Data1=coutryard_form, Data2=win_ratio_s, Data3=win_ratio_n, Data4=mat_typ, Data5=mat_qua, Data6=flr_height)

site_boundary = Curve(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)
# 1: Detect
initial_building_geometry = Brep([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])
area = Area(Geometry=site_boundary)  # -> Area, Centroid
vector = Vector(area.Centroid)
move = Move(Geometry=initial_building_geometry, Motion=expr("x*-1", vector))  # -> Geometry, Transform
move_2 = Move(Geometry=site_boundary, Motion=expr("x*-1", vector))  # -> Geometry, Transform

user_requires = ValueList({"No requires", "freeze_seg0", "freeze_seg1", "freeze_seg2", "freeze_seg3", "align with site0", "align with site1", "align with site2", "align with site3", "coincide_site0": “coincide_site0”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}, selected="No requires")
building_height_limit = Slider(30, range=0..100)
building_area_require = Slider(15000, range=0..100000)
floor_height = Slider(4.25, range=0..10)
detector = Detector(
    building_geo_solid=move.Geometry,
    site_boundary_curve=move_2.Geometry,
    flr_height=floor_height,
    user_requires=user_requires,
    height_limit=building_height_limit,
    area_require=building_area_require)  # -> detection; inputs building_geo_solid: list of Brep, site_boundary_curve: Curve, user_requires: list
# ---------- detector: Python ----------
import os
import sys
appdata = os.getenv('APPDATA')
filePath =os.path.join(appdata, "Grasshopper", "UserObjects")
if filePath not in sys.path:
    sys.path.insert(0,filePath)



import rhinoscriptsyntax as rs
import Rhino.Geometry as rg

from hammy.Hammy_Detector import detector



x_direction = rg.Vector3d(1,0,0)
y_direction = rg.Vector3d(0,1,0)


points_for_max = (curve.PointAtStart for curve in building_geo_solid[0].Edges)
points_for_min = (curve.PointAtStart for curve in building_geo_solid[0].Edges)
points_z_max = max(point.Z for point in points_for_max)
points_z_min = min(point.Z for point in points_for_min)
domain = points_z_max - points_z_min
contour_start = rg.Point3d(0,0,points_z_min)
contour_end = rg.Point3d(0,0,points_z_max)
floor_num = domain//flr_height

contour_start_vec = rg.Vector3d(0,0,points_z_min)
contour_curves_pts = []
for i in range (int(floor_num)):
    plane_origin = rg.Point3d(0,0,0) + rg.Vector3d(0,0,points_z_min+flr_height*i+flr_height/2)
    plane = rg.Plane(plane_origin,x_direction,y_direction)
    
    countour_curves_oneflo_pts = []
    for m in range(len(building_geo_solid)):
        contour_curve = rg.Brep.CreateContourCurves(building_geo_solid[m],plane)
        contour_curve_points = []
        for j in range(len(contour_curve)):
            
            lines = contour_curve[j].ToPolyline().GetSegments()
            curves = contour_curve[j]
            points=[]
            for k in range (len(lines)):
                point = [lines[k].From.X,lines[k].From.Y]
                points.append(point)
            
            
            countour_curves_oneflo_pts.append(points)

    contour_curves_pts.append(countour_curves_oneflo_pts)


site_lines = site_boundary_curve.ToPolyline().GetSegments()
site_points=[]
for l in range(len(site_lines)):
    site_point =  [site_lines[l].From.X,site_lines[l].From.Y]
    site_points.append(site_point)
    
initial_data = [site_points,contour_curves_pts,flr_height,height_limit,area_require,user_requires]

detection = detector.Detection(initial_data)
# ---------- end detector ----------

# ----
# 2: Generate
vars = Merge(Data1=geo_var, Data2=non_geo_var)
generator = Generator(detection=detector, uv_variables=vars)  # -> geometry; inputs uv_variables: list
# ---------- generator: Python ----------
import os
import sys
appdata = os.getenv('APPDATA')
filePath =os.path.join(appdata, "Grasshopper", "UserObjects")
if filePath not in sys.path:
    sys.path.insert(0,filePath)


    
from hammy.Hammy_Generator import Geometry
from hammy.Hammy_Utils import util2
from hammy.Hammy_Detector import Detection

flr_height = detection.flr_height
site_info = detection.site_info
abs_info  = util2.get_remap_samples(uv_variables,site_info)
geometry = Geometry(abs_info)
# ---------- end generator ----------

# ----
# Assumptions
min_size = Slider(12, range=0..50)
min_angle = Slider(75, range=0..80)
material_type = Slider(3, range=0..3)
threshold_ase = Slider(0.4, range=0..1)
daylight_calibr = Slider(0.05, range=0..0.1)
max_ct_area_0 = Slider(300, range=0..300)
max_ct_area_1 = Slider(300, range=0..300)
threshold_sda = Slider(0.75, range=0..1)
penalty_assumptions = Merge(
    Data1=min_size,
    Data2=min_angle,
    Data3=max_ct_area_0,
    Data4=max_ct_area_1,
    Data5=material_type,
    Data6=threshold_sda,
    Data7=threshold_ase,
    Data8=daylight_calibr)

# ----
# 3: Parametrize
parametrizer = Parametrizer(geometry=generator)  # -> mass_data
# ---------- parametrizer: Python ----------
import os
import sys
appdata = os.getenv('APPDATA')
filePath =os.path.join(appdata, "Grasshopper", "UserObjects")
if filePath not in sys.path:
    sys.path.insert(0,filePath)


    
from hammy.Hammy_Parametrizer import Massing, MassData
from hammy import load



MassData.ref_lib = load.ref_lib
MassData.con_lib = load.con_lib

mass = Massing(geometry)
mass_data = MassData(mass)
# ---------- end parametrizer ----------

objective = Objective(mass_data=parametrizer, time_period=0)  # -> objectives
# ---------- objective: Python ----------
import os
import sys
appdata = os.getenv('APPDATA')
filePath =os.path.join(appdata, "Grasshopper", "UserObjects")
if filePath not in sys.path:
    sys.path.insert(0,filePath)

from hammy.Hammy_Optimizer import objective
from hammy.Hammy_LCA import construction
from hammy.Hammy_Utils import util2
from hammy import load
from copy import deepcopy
import joblib


def calc_objs(objs):
    
    design_fs = objs.design_fact_arr
    material_fs =objs.mat_fact_arr

    oarr = design_fs + material_fs

    return oarr

def pred(pred_obj_name, features):  
    pred_setting = load.pred_settings[pred_obj_name]
    scalar_path = pred_setting['scalar_path']
    model_path = pred_setting['model_path']
    feature_ids =  pred_setting['feature_ids']
    feature_names =  pred_setting['feature_names']
    
    pred_model = joblib.load(model_path)  
    scalar_model = joblib.load(scalar_path) 

    used_features = [features[idx] for idx in feature_ids]  
    # x_df = pd.DataFrame([used_features], columns=feature_names)  

    scalared_features = scalar_model.transform([used_features])   

    pred_res = pred_model.predict(scalared_features)  
    return pred_res[0] 

def pred_energy(features,time_period = 0):
    if time_period == 0:
        energy_pred_res = pred('energy_DE',features)
    elif time_period > 0 and time_period <25:
        energy_pred_res = pred('energy_DE',features)
        energy_pred_res_future = pred('energy_GR',features)
        energy_pred_res  = util2.remap(time_period,[0,25],[energy_pred_res,energy_pred_res_future])
    elif time_period == 25:
        energy_pred_res = pred('energy_GR',features)
    elif time_period >25 and time_period< 50:
        energy_pred_res = pred('energy_DE',features)
        energy_pred_res_future = pred('energy_TU',features)
        energy_pred_res = util2.remap(time_period,[0,50],[energy_pred_res,energy_pred_res_future])
    else:
        energy_pred_res = pred('energy_TU',features)

    return energy_pred_res/3.6

def pred_daylight_objs(features):
    sDA_pred_res = pred('sDA',features)
    ASE_pres_res = pred('ASE',features)
    return [sDA_pred_res,ASE_pres_res]


construction.Construction.ref_con_lib = load.con_lib
construction.Construction.mat_lib_v21 = load.mat_lib_v21
construction.Construction.mat_lib_v23 = load.mat_lib_v23
construction.Construction.constr_lib = load.constr_lib




objectives = objective.Objective(mass_data)

geo_abs_info = objectives.mass_data.massing.geo.abs_info
calc_oarr = calc_objs(objectives)

features = geo_abs_info[:-1]+calc_oarr

energy_pred = pred_energy(features,time_period)

sDA_pred, ASE_pred = pred_daylight_objs(features)

pred_vals = [energy_pred,sDA_pred, ASE_pred]
energy_pred_config = [0,0,energy_pred]
daylight_pred_config = [sDA_pred, ASE_pred]




objectives.daylight_dict(daylight_pred_config)
objectives.calc_energy_carbon(energy_pred_config)
# ---------- end objective ----------

# ----
# geometry_blocks
geometry_block = Geometry_block(geometry=generator)  # -> building_blocks, courtyard_blocks
# ---------- geometry_block: Python ----------
import os
import sys
appdata = os.getenv('APPDATA')
filePath =os.path.join(appdata, "Grasshopper", "UserObjects")
if filePath not in sys.path:
    sys.path.insert(0,filePath)



import json
import sys
import rhinoscriptsyntax as rs
import Rhino.Geometry as rg


TOL = 0.1



fp_geo = geometry.get_footprint_for_display()

geo_fps =fp_geo[0]
cty_fp = fp_geo[1]
seg_valid_nums = fp_geo[2]
flr_height = fp_geo[3]
cty_pattern = fp_geo[4]


brep_union =[]
surf_union=[]
cty_surfs=[]
max_loop = max(cty_pattern,len(seg_valid_nums))
for i in range(max_loop):
    geo_fp=[]
    
            
    if i<len(geo_fps):
        geo_fp = geo_fps[i]
    floor_pts=[]
    
    
    cty_lines=[]
    cty_pts=[]
    for m in range(len(cty_fp)):
        x = cty_fp[m][0]
        y = cty_fp[m][1]
        point = rg.Point3d(x,y,flr_height*i)
        cty_pts.append(point)
    cty_pts.append(cty_pts[-1])
    cty_polyline = rg.Polyline(cty_pts)
    for n in range(len(cty_pts)):
        line = rg.LineCurve(cty_pts[n],cty_pts[n-1])
        cty_lines.append(line)
    
    cty_surf = rg.Brep.CreatePlanarBreps(cty_lines)[0]
    cty_surfs.append(cty_surf)
#        cty_brep = rg.Brep.CreateOffsetBrep(cty_surf,flr_height,True,True,True,TOL)[0]
    if i< len(seg_valid_nums):
        seg_valid_num = seg_valid_nums[i]
        for j in range(len(geo_fp)):
            lines=[]
            
            pts=[]
            for k in range(len(geo_fp[j])):
                
                x = geo_fp[j][k][0]
                y = geo_fp[j][k][1]
                point= rg.Point3d(x,y,flr_height*i)
                pts.append(point)
    #            pts.append(pts[-1])
    #            curves = rg.Polyline(pts).ToNurbCurve()
            for l in range(len(pts)):
                line = rg.LineCurve(pts[l],pts[l-1])
                lines.append(line)
            # curves = List[rg.Curve](line for line in lines)
    #            clo_brep = rg.Brep.CreateFromLoft(curves,rg.Point3d(0,0,0),rg.Point3d(0,0,flr_height),0,True)
            flo_surf = rg.Brep.CreatePlanarBreps(lines)[0]
    ##            flo_surf = surf.Split(cty_brep,TOL)[0]
    #            clo_brep = rg.Brep.CreateOffsetBrep(flo_surf,flr_height,True,True,False,TOL)[0]
            
            if seg_valid_num ==4:
                flo_surf = rg.Brep.CreateBooleanDifference(flo_surf,cty_surf,TOL)[0]
    #                clo_brep =  rg.Brep.CreateOffsetBrep(flo_surf,flr_height,True,True,False,TOL)[0]
            
            surf_union.append(flo_surf)
#            brep_union.append(clo_brep[0])
cty_surfs = cty_surfs[:cty_pattern]
print(surf_union[i])
building_blocks =[]
for i in range(len(surf_union)):
    offset_surface = rs.OffsetSurface(surf_union[i], -flr_height,0.1,False,True)
    building_blocks.append(offset_surface)


courtyard_blocks =[]
for i in range(len(cty_surfs)):
    offset_surface = rs.OffsetSurface(cty_surfs[i], -flr_height,0.1,False,True)
    courtyard_blocks.append(offset_surface)


#if len(seg_valid_nums)< cty_pattern:
#    for i in range(cty_pattern-len(seg_valid_nums)):
#        cty_surfs.append(cty_surf)
#
# ---------- end geometry_block ----------

# ----
# building_with_plan
raster_size = Slider(1.5, range=0..10)
column_raster = Slider(4, range=0..10)
corridor_depth = Slider(2, range=0..10)
merge = Merge(Data1=raster_size, Data2=column_raster, Data3=corridor_depth)
planer = Planer(mass_data=parametrizer, plan_require=merge)  # -> zoning; inputs plan_require: list
# ---------- planer: Python ----------
import os
import sys
appdata = os.getenv('APPDATA')
filePath =os.path.join(appdata, "Grasshopper", "UserObjects")
if filePath not in sys.path:
    sys.path.insert(0,filePath)



    

from hammy.Hammy_Generator import Planar
import Rhino.Geometry as rg


raster_size = plan_require[0]
column_raster = plan_require[1]
corridor_depth = plan_require[2]

iRequire = {
        "raster_size" : raster_size,
        "column_raster" : column_raster,
        "facade_type" : 0,
        "zone_type" :0,
        "corridor_depth" :corridor_depth
        }
zoning = Planar(iRequire,mass_data)
# ---------- end planer ----------
panel = Panel("""activity
meeting
office
corridor
open_office
core""")
merge_2 = Merge(
    Data1=ColourSwatch(SwatchColor=RGB(180, 232, 160)),
    Data2=ColourSwatch(SwatchColor=RGB(214, 134, 133)),
    Data3=ColourSwatch(SwatchColor=RGB(240, 202, 131)),
    Data4=ColourSwatch(SwatchColor=RGB(122, 147, 185)),
    Data5=ColourSwatch(SwatchColor=RGB(155, 188, 177)),
    Data6=ColourSwatch(SwatchColor=RGB(0, 0, 0)))
planed_building = Planed_building(zoning=planer, zone_types=panel, zone_colors=merge_2)  # -> zone_meshs, glass_surfaces, roof_surfaces, wall_surfaces; inputs zone_types: list, zone_colors: list
# ---------- planed_building: Python ----------
import os
import sys
appdata = os.getenv('APPDATA')
filePath =os.path.join(appdata, "Grasshopper", "UserObjects")
if filePath not in sys.path:
    sys.path.insert(0,filePath)

    



from hammy.Hammy_Generator import Planar
import Rhino.Geometry as rg
import rhinoscriptsyntax as rs



def visualize(zone_curve,  custom_color): 
    if zone_curve: 
        jaggedAndFaster = rg.MeshingParameters.Coarse 
        poly = zone_curve
        mesh = rg.Mesh.CreateFromPlanarBoundary(poly.ToNurbsCurve(), jaggedAndFaster, 0.001) 
        mesh.VertexColors.CreateMonotoneMesh(custom_color)
        return mesh


def set_visulize(zone_curves, custom_color): 
    mesh_list = [] 
    for curves in zone_curves: 
        mesh = visualize(curves, custom_color) 
        mesh_list.append(mesh) 
    return mesh_list


def pts_to_curves(pts):
    curves =[]
    for surf_pts in pts:
        if len(surf_pts) ==1:
            pts =[]
            lines =[]
            for pt in surf_pts[0]:
                pt = rg.Point3d(pt[0],pt[1],pt[2])
                pts.append(pt)
            pts.append(pts[0])
            curve = rg.Polyline(pts).ToPolylineCurve()
            curves.append(curve)
    # print(curves)
    return curves



flr_height = zoning.flr_height
plan_data = zoning.plan_data


activity_zones =plan_data[0]

meeting_zones =plan_data[1]
office_zones =plan_data[2]
special_tiles =plan_data[3]
corridor_tiles =plan_data[4]
core_zones =plan_data[5]
win_geo_total =plan_data[6]

mass_data = zoning.mass_data
daylight_space = mass_data.daylight_space
all_walls_pts = daylight_space[0]
all_cty_wall_pts =daylight_space[6]
all_cty_win_pts = daylight_space[5]
all_wins_hori_pts = daylight_space[2]

bldg_blocks = mass_data.massing.bldg_blocks
ctyd_blocks = mass_data.massing.ctyd_blocks

all_blocks = []
all_rfs_pts = []
all_cty_flrs_pts = []



for bs_flr in bldg_blocks:
    if bs_flr:
        for b in bs_flr:
            all_blocks.append(b)
for b in all_blocks:
    if b:
        
        roofs = b.erf
        
        for rf in roofs:
            # print("rf.face_name",rf.face_name)
            if rf.is_donut:
                rf_pts = [rf.face_pts, rf.hole_pts[::-1]]
                print(rf_pts)
                all_rfs_pts.append(rf_pts)
            elif rf.is_glas:
                pass
            else:
                
                all_rfs_pts.append([rf.face_pts])
for b in ctyd_blocks:
    if b:
        
        roofs = b.erf
        for rf in roofs:
            if rf.is_donut:
                rf_pts = [rf.face_pts, rf.hole_pts[::-1]]
                all_rfs_pts.append(rf_pts)
            elif rf.is_glas:
                pass
            else:
                all_rfs_pts.append([rf.face_pts])
                
        flrs = b.eflr + b.iflr
        for flr in flrs:
            if flr.is_donut:
                flr_pts = [flr.face_pts, flr.hole_pts[::-1]]
                all_cty_flrs_pts.append(flr_pts)
            else:

                all_cty_flrs_pts.append([flr.face_pts])

roof_surfaces =[]

for roof in all_rfs_pts:
    if len(roof) ==1:
        pts =[]
        lines =[]
        for pt in roof[0]:
            pt = rg.Point3d(pt[0],pt[1],pt[2])
            pts.append(pt)
        for l in range(len(pts)):
            line = rg.LineCurve(pts[l],pts[l-1])
            lines.append(line)
        roof_surf = rg.Brep.CreatePlanarBreps(lines)[0]
        roof_surfaces.append(roof_surf)
    else:
        pts =[]
        lines =[]
        for pt in roof[0]:
            pt = rg.Point3d(pt[0],pt[1],pt[2])
            pts.append(pt)
        for l in range(len(pts)):
            line = rg.LineCurve(pts[l],pts[l-1])
            lines.append(line)
        roof_surf = rg.Brep.CreatePlanarBreps(lines)[0]
    
        
        pts =[]
        lines =[]
        for pt in roof[1]:
            pt = rg.Point3d(pt[0],pt[1],pt[2])
            pts.append(pt)
        for l in range(len(pts)):
            line = rg.LineCurve(pts[l],pts[l-1])
            lines.append(line)
        cty_roof_surf = rg.Brep.CreatePlanarBreps(lines)[0]
        
        rof_surf = rg.Brep.CreateBooleanDifference(roof_surf,cty_roof_surf,0.01)[0]

        roof_surfaces.append(rof_surf)

cty_flor_curves =[]

for floor in all_cty_flrs_pts:
    
    pts =[]
    
    for pt in floor[0]:
        pt = rg.Point3d(pt[0],pt[1],pt[2])
        pts.append(pt)
    pts.append(pts[0])
    tile_curve = rg.Polyline(pts).ToPolylineCurve()

    cty_flor_curves.append(tile_curve)
    



activity_zones_zone =[]
meeting_zones_zone =[]
office_zones_zone =[]
special_tiles_zone =[]
corridor_tiles_zone =[]
open_office_zones_zone =[]
core_zones_zone =[]
win_geo = []

for i,win in enumerate(win_geo_total):
    
    points =[]
    for pt in win:
        point = rg.Point3d(pt[0],pt[1],pt[2])
        points.append(point)
    points.append(points[0])
    tile_curve = rg.Polyline(points).ToPolylineCurve()
    win_geo.append(tile_curve)

for i,flor in enumerate(activity_zones):
    for seg in flor:
        for side in seg:
            for tiless in side:
                for tile in tiless:
                    points =[]
                    for pt in tile:
                        point = rg.Point3d(pt[0],pt[1],flr_height*i)
                        points.append(point)
                    points.append(points[0])
                
                    tile_curve = rg.Polyline(points).ToPolylineCurve()
                    activity_zones_zone.append(tile_curve)


for i,flor in enumerate(meeting_zones):
    for seg in flor:
        for side in seg:
            for tiless in side:
                for tile in tiless:
                    points =[]
                    for pt in tile:
                        point = rg.Point3d(pt[0],pt[1],flr_height*i)
                        points.append(point)
                    points.append(points[0])
                
                    tile_curve = rg.Polyline(points).ToPolylineCurve()
                    meeting_zones_zone.append(tile_curve)


for i,flor in enumerate(office_zones):
    for seg in flor:
        for side in seg:
            for tiless in side:
                for tile in tiless:
                    points =[]
                    for pt in tile:
                        point = rg.Point3d(pt[0],pt[1],flr_height*i)
                        points.append(point)
                    points.append(points[0])
                
                    tile_curve = rg.Polyline(points).ToPolylineCurve()
                    office_zones_zone.append(tile_curve)



for i,flor in enumerate(core_zones):
    for seg in flor:
        for side in seg:
            for tiless in side:
                for tile in tiless:
                    points =[]
                    for pt in tile:
                        point = rg.Point3d(pt[0],pt[1],flr_height*i)
                        points.append(point)
                    points.append(points[0])
                
                    tile_curve = rg.Polyline(points).ToPolylineCurve()
                    core_zones_zone.append(tile_curve)




for i,flor in enumerate(special_tiles):
    for seg in flor:
        for side in seg:
            for tile in side:
                points =[]
                for pt in tile:
                    point = rg.Point3d(pt[0],pt[1],flr_height*i)
                    points.append(point)
                points.append(points[0])
            
                tile_curve = rg.Polyline(points).ToPolylineCurve()
                if i ==0 :
                    meeting_zones_zone.append(tile_curve)
                else:
                    open_office_zones_zone.append(tile_curve)


for i,flor in enumerate(corridor_tiles):
    for seg in flor:
        
        for tile in seg:
            points =[]
            for pt in tile:
                point = rg.Point3d(pt[0],pt[1],flr_height*i)
                points.append(point)
            points.append(points[0])
        
            tile_curve = rg.Polyline(points).ToPolylineCurve()
            corridor_tiles_zone.append(tile_curve)

activity_zones_zone.extend(cty_flor_curves)
# activity_zones_zone = activity_zones_zone+ cty_flor_curves

type_match = {
    # "activity" : cty_flor_curves,
    "activity" : activity_zones_zone,
    "meeting" : meeting_zones_zone,
    "office" : office_zones_zone,
    "corridor" : corridor_tiles_zone,
    "open_office" : open_office_zones_zone,
    "core" : core_zones_zone

}

zone_meshs =[]
for i , key in enumerate(zone_types):

    zone = type_match[key]

    zone_mesh = set_visulize(zone,zone_colors[i])
    zone_meshs.extend(zone_mesh)




# bld_wall_curves = pts_to_curves(all_walls_pts)
cty_wall_curves = pts_to_curves(all_cty_wall_pts)
# wall_curves =  bld_wall_curves + cty_wall_curves

all_cty_win_pts.extend(all_wins_hori_pts)
glas_curves = pts_to_curves(all_cty_win_pts)


bld_wall_curves =[]
for walls in all_walls_pts:
    if len(walls) ==1:
        pts =[]
        lines =[]
        
        pr0 = walls[0][1]
        pt0_geo = rg.Point3d(pr0[0],pr0[1],pr0[2])
        pr1 = walls[0][2]
        pt1_geo = rg.Point3d(pr1[0],pr1[1],pr1[2])
        pt2_geo = rg.Point3d(pr1[0],pr1[1],pr1[2]+flr_height)
        pt3_geo = rg.Point3d(pr0[0],pr0[1],pr0[2]+flr_height)
        points = [pt0_geo,pt1_geo,pt2_geo,pt3_geo,pt0_geo]
        tile_curve = rg.Polyline(points).ToPolylineCurve()
        bld_wall_curves.append(tile_curve)
        
wall_curves =  bld_wall_curves + cty_wall_curves
all_curves = wall_curves+win_geo
wall_surfaces  = rs.AddPlanarSrf(all_curves)
all_wins = win_geo + glas_curves
glass_surfaces = rs.AddPlanarSrf(all_wins)



# glas_curves = pts_to_curves(all_wins_hori_pts)
# ---------- end planed_building ----------

# ----
# building
building_block = Building_block(mass_data=parametrizer)  # -> glass_surfaces, wall_surfaces, floor_surfaces, roof_surfaces
# ---------- building_block: Python ----------
import os
import sys
appdata = os.getenv('APPDATA')
filePath =os.path.join(appdata, "Grasshopper", "UserObjects")
if filePath not in sys.path:
    sys.path.insert(0,filePath)


    

from hammy.Hammy_Parametrizer import MassData
import Rhino.Geometry as rg
import rhinoscriptsyntax as rs

TOL = 0.01

daylight_space = mass_data.daylight_space
flr_height = mass_data.massing.flr_height


def pts_to_curves(pts):
    curves =[]
    for surf_pts in pts:
        if len(surf_pts) ==1:
            pts =[]
            lines =[]
            for pt in surf_pts[0]:
                pt = rg.Point3d(pt[0],pt[1],pt[2])
                pts.append(pt)
            pts.append(pts[0])
            curve = rg.Polyline(pts).ToPolylineCurve()
            curves.append(curve)
    # print(curves)
    return curves



all_walls_pts =daylight_space[0]
all_wins_pts = daylight_space[1]
all_wins_hori_pts = daylight_space[2]
all_flrs_pts = daylight_space[3]
all_rfs_pts = daylight_space[4]
all_cty_win_pts = daylight_space[5]
all_cty_wall_pts = daylight_space[6]


bld_wall_curves = pts_to_curves(all_walls_pts)
cty_wall_curves = pts_to_curves(all_cty_wall_pts)
wall_curves =  bld_wall_curves + cty_wall_curves

wall_surfaces  = rs.AddPlanarSrf(wall_curves)

all_wins_pts.extend(all_wins_hori_pts)
glas_curves = pts_to_curves(all_wins_pts)
glass_surfaces = rs.AddPlanarSrf(glas_curves)

flor_curves = pts_to_curves(all_flrs_pts)
floor_surfaces = rs.AddPlanarSrf(flor_curves)


floor_surfaces =[]

for floor in all_flrs_pts:
    if len(floor) ==1:
        pts =[]
        lines =[]
        for pt in floor[0]:
            pt = rg.Point3d(pt[0],pt[1],pt[2])
            pts.append(pt)
        for l in range(len(pts)):
            line = rg.LineCurve(pts[l],pts[l-1])
            lines.append(line)
        flor_surf = rg.Brep.CreatePlanarBreps(lines)[0]
        floor_surfaces.append(flor_surf)
    else:
        pts =[]
        lines =[]
        for pt in floor[0]:
            print(pt)
            pt = rg.Point3d(pt[0],pt[1],pt[2])
            pts.append(pt)
        for l in range(len(pts)):
            line = rg.LineCurve(pts[l],pts[l-1])
            lines.append(line)
        flor_surf = rg.Brep.CreatePlanarBreps(lines)[0]
        
        pts =[]
        lines =[]
        for pt in floor[1]:
            pt = rg.Point3d(pt[0],pt[1],pt[2])
            pts.append(pt)
        for l in range(len(pts)):
            line = rg.LineCurve(pts[l],pts[l-1])
            lines.append(line)
        cyt_surf = rg.Brep.CreatePlanarBreps(lines)[0]
        flo_surf = rg.Brep.CreateBooleanDifference(flor_surf,cyt_surf,TOL)[0]
        # print(len(flo_surf))
        floor_surfaces.append(flo_surf)

roof_surfaces =[]

for roof in all_rfs_pts:
    if len(roof) ==1:
        pts =[]
        lines =[]
        for pt in roof[0]:
            pt = rg.Point3d(pt[0],pt[1],pt[2])
            pts.append(pt)
        for l in range(len(pts)):
            line = rg.LineCurve(pts[l],pts[l-1])
            lines.append(line)
        roof_surf = rg.Brep.CreatePlanarBreps(lines)[0]
        roof_surfaces.append(roof_surf)
    else:
        pts =[]
        lines =[]
        for pt in roof[0]:
            pt = rg.Point3d(pt[0],pt[1],pt[2])
            pts.append(pt)
        for l in range(len(pts)):
            line = rg.LineCurve(pts[l],pts[l-1])
            lines.append(line)
        roof_surf = rg.Brep.CreatePlanarBreps(lines)[0]
    
        
        pts =[]
        lines =[]
        for pt in roof[1]:
            pt = rg.Point3d(pt[0],pt[1],pt[2])
            pts.append(pt)
        for l in range(len(pts)):
            line = rg.LineCurve(pts[l],pts[l-1])
            lines.append(line)
        cty_roof_surf = rg.Brep.CreatePlanarBreps(lines)[0]
        
        rof_surf = rg.Brep.CreateBooleanDifference(roof_surf,cty_roof_surf,TOL)[0]

        roof_surfaces.append(rof_surf)
# ---------- end building_block ----------
relay = Relay([building_block.wall_surfaces, building_block.floor_surfaces, building_block.roof_surfaces])

filter = Filter(detection=detector)  # -> data_filter, variable_ranges, initial_uv_variables
# ---------- filter: Python ----------
import os
import sys
appdata = os.getenv('APPDATA')
filePath =os.path.join(appdata, "Grasshopper", "UserObjects")
if filePath not in sys.path:
    sys.path.insert(0,filePath)






from hammy.Hammy_Filter import Filter

data_filter   = Filter(detection)
variable_ranges = [data_filter.var_range]
initial_uv_variables =[data_filter.detection.geo_detection.geo_uv_info]
# ---------- end filter ----------

# ----
# reset_initial_variables
reset_range = Button()
reset_value = Button()
# keys_all_samples =
#         [
#         "seg0_dist",        #0
#         "seg1_dist",        #1
#         "seg2_dist",        #2
#         "seg3_dist",        #3
#         "seg0_theta",       #4
#         "seg1_theta",       #5
#         "seg2_theta",       #6
#         "seg3_theta",       #7
#         "seg0_dep",         #8
#         "seg1_dep",         #9
#         "seg2_dep",         #10
#         "seg3_dep",         #11
#         "seg0_pat",         #12
#         "seg1_pat",         #13
#         "seg2_pat",         #14
#         "seg3_pat",         #15
#         "cty_pat",          #16
#         "cty_form",         #17
#         "win_ratio_s",        #18
#         "win_ratio_n",        #19
#         "mat_typ",          #20
#         "mat_qua",          #21
#          ]
panel_2 = Panel("""seg_d0
seg_d1
seg_d2
seg_d3
seg_t0
seg_t1
seg_t2
seg_t3
seg_dd0
seg_dd1
seg_dd2
seg_dd3
sp0
sp1
sp2
sp3
courtyard_pattern
coutryard_form
win_ratio_s
win_ratio_n
mat_typ
mat_qua
flr_height""")
slider_updater = SliderDomainUpdater(
    Sliders=panel_2,
    variable_ranges=filter.variable_ranges,
    initial_uv_variables=filter.initial_uv_variables,
    Update=reset_range)  # inputs Sliders: list
#   port Sliders: Path to an .epw file on this computer as a text string.
# ---------- slider_updater: Python ----------
import rhinoscriptsyntax as rs

"""
Reset a named slider's domain.
    Inputs:
        Sliders: List of slider NickNames.
        Min: Minimum Value(s).
        Max: Maximum value(s).
        Update: Set to 'True' to update the slider's domain.
"""

ghenv.Component.Name = "Slider Domain Updater"
ghenv.Component.NickName = 'Slider Updater'

import Grasshopper as gh
import json

gh_objects = ghenv.Component.OnPingDocument().Objects

if Update:

    var_range = variable_ranges


    for i in range(len(Sliders)):
        for obj in gh_objects:

            if obj.NickName == Sliders[i]:

                if type(obj) is gh.Kernel.Special.GH_NumberSlider:
 
                    
                    if var_range[i][0] == var_range[i][1]:
                        obj.Slider.Type = gh.GUI.Base.GH_SliderAccuracy(0)

                        obj.Slider.Minimum = var_range[i][0]
                        obj.Slider.Maximum = var_range[i][1]
                    else:

                        x = 0
                        if var_range[i][2]%1 !=0 :
                            x =3
          
                        obj.Slider.DecimalPlaces = x
                        
                        obj.Slider.Minimum = var_range[i][0]
                        obj.Slider.Maximum = var_range[i][1]

                       
                        obj.Slider.Value = initial_uv_variables[i]

                    obj.ExpireSolution(True)
# ---------- end slider_updater ----------
slider_updater_2 = SliderDomainUpdater(Sliders=panel_2, initial_uv_variables=filter.initial_uv_variables, Update=reset_value)  # inputs Sliders: list
#   port initial_uv_variables: A honeybee Energy SimulationParameter object that describes all of the setting for the simulation. If None, some default simulation parameters will automatically be used.
# ---------- slider_updater_2: Python ----------
"""
Reset a named slider's domain.
    Inputs:
        Sliders: List of slider NickNames.
        Min: Minimum Value(s).
        Max: Maximum value(s).
        Update: Set to 'True' to update the slider's domain.
"""


ghenv.Component.Name = "Slider Domain Updater"
ghenv.Component.NickName = 'Slider Updater'

import Grasshopper as gh
import json


gh_objects = ghenv.Component.OnPingDocument().Objects

if Update:

    for i,info in enumerate(initial_uv_variables):

        for obj in gh_objects:

            if obj.NickName == Sliders[i]:

                if type(obj) is gh.Kernel.Special.GH_NumberSlider:

                    obj.Slider.Value = info

                    obj.ExpireSolution(True)
# ---------- end slider_updater_2 ----------

# ----
# Visulize building_block
number_slider = Slider(0.8, range=0..1)
material = CreateMaterial(
    Diffuse=ColourSwatch(SwatchColor=RGB(207, 255, 250)),
    Specular=RGB(255, 255, 255),
    Emission=RGB(0, 0, 0),
    Transparency=number_slider,
    Shine=0)
preview = CustomPreview(Geometry=building_block.glass_surfaces, Material=material)
preview_2 = CustomPreview(Geometry=relay, Material=ColourSwatch(SwatchColor=RGB(178, 177, 177)))

# ----
# Visulize planed_building
swatch = ColourSwatch(SwatchColor=RGB(201, 201, 201))
preview_3 = CustomPreview(Geometry=[planed_building.roof_surfaces, planed_building.wall_surfaces], Material=swatch)
mesh = Mesh(planed_building.zone_meshs)
srf = Surface(planed_building.glass_surfaces)

# ----
# Visulize geometry_block
swatch_2 = ColourSwatch(SwatchColor=RGB(20, 192, 255))
preview_4 = CustomPreview(Geometry=geometry_block.building_blocks, Material=ColourSwatch(SwatchColor=RGB(255, 204, 20)))
preview_5 = CustomPreview(Geometry=geometry_block.courtyard_blocks, Material=swatch_2)

resetlog = Button()
maxcound = Slider(200, range=0..1000)
run_name = Panel("0610")
recording = BooleanToggle(True)

opossum = Opossum(
    OpossumData_OptimizationType=0,
    OpossumData_ResultSerializationStatus=0,
    OpossumData_objective=criteria_2,
    OpossumData_variable=[coutryard_form, courtyard_pattern, sp0, sp1, sp2, sp3, seg_d0, seg_t0, seg_dd0, seg_dd1, seg_dd2, seg_dd3, seg_t1, seg_t2, seg_t3, seg_d1, seg_d2, seg_d3, win_ratio_s, win_ratio_n, mat_typ, mat_qua])

# ---- group: Table / Reset Data Recorders
reset = Button()
python = PythonScript(Toggle=reset)
# ---------- python: Python ----------
import Grasshopper as gh

if Toggle:
    
    # Get the Grasshopper document and objects
    ghDoc = ghenv.Component.OnPingDocument()
    ghObjects = ghDoc.Objects
    
    # Iterate the GH objects, check type and reset data recorders
    for obj in ghObjects:
        if type(obj) is gh.Kernel.Special.GH_DataRecorder:
            obj.DestroyRecordedData()
            obj.ExpireSolution(True)
# ---------- end python ----------

# ---- group: Table
panel_3 = Panel("""[VARIABLE]






[PERFORMANCE]



[CONVERGENCE]""")
# Log Results
panel_4 = Panel("EPOCH")
dst = DrawScreenText(Text=panel_4, Color=RGB(255, 255, 255), Height=16, locX=191, locY=1229)
# ---------- dst: Python ----------
from ghpythonlib.componentbase import executingcomponent as component
import Rhino as rc

ghenv.Component.Name = "DrawScreenText"
ghenv.Component.NickName = "DST"

class MyComponent(component):
    
    def RunScript(self,Text,Color,Height,locX,locY,Font):
        self.text = Text
        self.color = Color
        self.height = Height
        
        self.point = rc.Geometry.Point2d(locX,locY)
        self.font = "Cascadia Code ExtraLight Italic"
        
    def DrawViewportWires(self,arg):
        arg.Display.Draw2dText(self.text,self.color,self.point,False,self.height,self.font)
# ---------- end dst ----------
dst_2 = DrawScreenText(
    Text=panel_3,
    step=80,
    Color=[RGB(255, 255, 255), RGB(255, 255, 255), RGB(255, 255, 255), RGB(255, 255, 255), RGB(255, 255, 255), RGB(255, 255, 255), RGB(255, 255, 255), RGB(255, 255, 255), RGB(255, 255, 255), RGB(255, 255, 255), RGB(255, 255, 255), RGB(255, 255, 255)],
    Height=20,
    locX=93,
    locY=84,
    Font="Cascadia Code Light")  # inputs Text: list, Color: list
# ---------- dst_2: Python ----------
from ghpythonlib.componentbase import executingcomponent as component
import Rhino as rc

ghenv.Component.Name = "DrawScreenText"
ghenv.Component.NickName = "DST"

class MyComponent(component):
    
    def RunScript(self,Text,step,Color,Height,locX,locY,Font):
        self.text = Text
        self.color = Color
        self.height = Height
        
        self.locX =locX
        self.locY = locY
        self.font = Font
        self.step = step
    def DrawViewportWires(self,arg):
        for i in range(len(self.color)):
            dist = i*14
#            round(self.text[i],2)
            arg.Display.Draw2dText(self.text[i],self.color[i],rc.Geometry.Point2d(self.locX,self.locY+i*self.step),False,self.height,self.font)
# ---------- end dst_2 ----------
dst_3 = DrawScreenText(pt0X=94, pt0Y=1019, pt1X=94, pt1Y=1216)  # inputs pt0X: list, pt0Y: list, pt1X: list, pt1Y: list
# ---------- dst_3: Python ----------
from ghpythonlib.componentbase import executingcomponent as component
import Rhino as rc

ghenv.Component.Name = "DrawScreenText"
ghenv.Component.NickName = "DST"
import Rhino.Geometry as rg
import System
class MyComponent(component):
    
    def RunScript(self,pt0X,pt0Y,pt1X,pt1Y):
        self.pt0X = pt0X
        self.pt0Y = pt0Y
        self.pt1X = pt1X
        self.pt1Y = pt1Y
#        
    def DrawViewportWires(self,arg):
        color = rc.Display.ColorXYZ(155,155,155)
#        thickness = 10
#        location = System.Drawing.Point(self.locX,self.locY)
#        size = System.Drawing.Size(200, 200)
#        rect = System.Drawing.Rectangle(location, size)  

        for i in range(len(self.pt0X)):

            arg.Display.Draw2dLine(System.Drawing.PointF(self.pt0X[i],self.pt0Y[i]),System.Drawing.PointF(self.pt1X[i],self.pt1Y[i]),color,1)
#            arg.Display.Draw2dLine(System.Drawing.PointF(10,200),System.Drawing.PointF(100,200),color,1)
#        p
#      
#import System
#import Rhino.Geometry as rg
#location = System.Drawing.Point(10,10)
#size = System.Drawing.Size(200, 200)
#rect = System.Drawing.Rectangle(location, size)  
#color = rc.Display.ColorXYZ(155,155,155)
#thickness = 1
##rc.Display.DisplayPipeline.Draw2dRectangle(rect,color,thickness,color)
#rc.Display.DisplayPipeline.Draw2dLine(rg.Point3d(0,0,0),rg.Point3d(10,0,0),color,thickness,thickness)
# ---------- end dst_3 ----------
dst_4 = DrawScreenText(pt0X=352, pt0Y=1216, pt1X=94, pt1Y=1216)  # inputs pt0X: list, pt0Y: list, pt1X: list, pt1Y: list; same code as dst_3
panel_5 = Panel("""SD_0
SD_1
SD_2
SD_3
ST_0
ST_1
ST_2
ST_3
SDD0
SDD1
SDD2
SDD3
SP_0
SP_1
SP_2
SP_3
CTYP
CTYF
WinS
WinN
MTYP
MQUA
FLRH





TOT.ENERGY[kWh/m2]
GWP EMBED  [/m2/a]
GWP TOTAL  [/m2/a]

TOTAL AREA    [m2]
sDA
ASE

CRITERIA
WEIGHT GWP






BEST""")
dst_5 = DrawScreenText(
    Text=panel_5,
    step=Slider(20, range=0..30),
    Color=[RGB(255, 255, 255), RGB(255, 255, 255), RGB(255, 255, 255), RGB(255, 255, 255), RGB(255, 255, 255), RGB(255, 255, 255)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],
    Height=Slider(16, range=0..30),
    locX=Slider(93, range=0..300),
    locY=Slider(117, range=0..2000),
    Font="Cascadia Code ExtraLight Italic")  # inputs Text: list, Color: list; same code as dst_2
dst_6 = DrawScreenText(
    pt0X=[345, 345, 345, 345, 345, 345, 345, 345, 345, 345, 345, 345, 345, 345, 345, 345, 345, 345, 345, 345, 345, 345, 345],
    pt0Y=[119, 139.3, 159.6, 179.9, 200.2, 220.5, 240.8, 261.1, 281.4, 301.7, 322, 342.3, 362.6, 382.9, 403.2, 423.5, 443.8, 464.1, 484.4, 504.7, 525, 545.3, 565.6],
    pt1X=[211, 211, 211, 211, 211, 211, 211, 211, 211, 211, 211, 211, 211, 211, 211, 211, 211, 211, 211, 211, 211, 211, 211],
    pt1Y=[119, 139.3, 159.6, 179.9, 200.2, 220.5, 240.8, 261.1, 281.4, 301.7, 322, 342.3, 362.6, 382.9, 403.2, 423.5, 443.8, 464.1, 484.4, 504.7, 525, 545.3, 565.6],
    color=RGB(64, 64, 64))  # inputs pt0X: list, pt0Y: list, pt1X: list, pt1Y: list
# ---------- dst_6: Python ----------
from ghpythonlib.componentbase import executingcomponent as component
import Rhino as rc

ghenv.Component.Name = "DrawScreenText"
ghenv.Component.NickName = "DST"
import Rhino.Geometry as rg
import System
class MyComponent(component):
    
    def RunScript(self,pt0X,pt0Y,pt1X,pt1Y,color):
        self.pt0X = pt0X
        self.pt0Y = pt0Y
        self.pt1X = pt1X
        self.pt1Y = pt1Y
        self.color = color
        
    def DrawViewportWires(self,arg):
#        color = rc.Display.ColorXYZ(155,155,155)
        color = self.color
#        thickness = 10
#        location = System.Drawing.Point(self.locX,self.locY)
#        size = System.Drawing.Size(200, 200)
#        rect = System.Drawing.Rectangle(location, size)  

        for i in range(len(self.pt0X)):

            arg.Display.Draw2dLine(System.Drawing.PointF(self.pt0X[i],self.pt0Y[i]),System.Drawing.PointF(self.pt1X[i],self.pt1Y[i]),color,1)
#            arg.Display.Draw2dLine(System.Drawing.PointF(10,200),System.Drawing.PointF(100,200),color,1)
#        p
#      
#import System
#import Rhino.Geometry as rg
#location = System.Drawing.Point(10,10)
#size = System.Drawing.Size(200, 200)
#rect = System.Drawing.Rectangle(location, size)  
#color = rc.Display.ColorXYZ(155,155,155)
#thickness = 1
##rc.Display.DisplayPipeline.Draw2dRectangle(rect,color,thickness,color)
#rc.Display.DisplayPipeline.Draw2dLine(rg.Point3d(0,0,0),rg.Point3d(10,0,0),color,thickness,thickness)
# ---------- end dst_6 ----------

# ---- group: Table / Draw 2D Text in Screen Space
dst_7 = DrawScreenText(
    startX=Slider(77, range=0..100),
    startY=Slider(51, range=0..200),
    sizeX=Slider(295, range=0..1000),
    sizeY=Slider(1205, range=0..2000),
    thickness=Slider(1, range=0..1),
    Color=ColourSwatch(SwatchColor=RGB(255, 255, 255)))
# ---------- dst_7: Python ----------
from ghpythonlib.componentbase import executingcomponent as component
import Rhino as rc

ghenv.Component.Name = "DrawScreenText"
ghenv.Component.NickName = "DST"
import Rhino.Geometry as rg
import System
class MyComponent(component):
    
    def RunScript(self,startX,startY,sizeX,sizeY,rectangle,Color,thickness):
#        self.pt_from = pt_from
#        self.pt_from = pt_to
        self.startX = startX
        self.startY = startY
        self.sizeX = sizeX
        self.sizeY = sizeY
        self.rectangle = rectangle
        self.color = Color
        self.thickness = thickness
#        self.height = Height
#        self.point = rc.Geometry.Point2d(Point.X,Point.Y)
#        self.font = Font
#        
    def DrawViewportWires(self,arg):
        color = rc.Display.ColorXYZ(155,155,155)
        color2 = rc.Display.ColorXYZ(0,0,0)
        thickness = 1
        location = System.Drawing.Point(self.startX,self.startY)
        size = System.Drawing.Size(self.sizeX, self.sizeY)
        rect = System.Drawing.Rectangle(location, size)  
        arg.Display.Draw2dRectangle(rect,color,thickness,color2 )
#      
#import System
#import Rhino.Geometry as rg
#location = System.Drawing.Point(10,10)
#size = System.Drawing.Size(200, 200)
#rect = System.Drawing.Rectangle(location, size)  
#color = rc.Display.ColorXYZ(155,155,155)
#thickness = 1
##rc.Display.DisplayPipeline.Draw2dRectangle(rect,color,thickness,color)
#rc.Display.DisplayPipeline.Draw2dLine(rg.Point3d(0,0,0),rg.Point3d(10,0,0),color,thickness,thickness)
# ---------- end dst_7 ----------

# ----
pt1y = Pt1Y([139.3, 159.6, 179.9, 200.2, 220.5, 240.8, 261.1, 281.4, 301.7, 322, 342.3, 362.6, 382.9, 403.2, 423.5, 443.8, 464.1, 484.4, 504.7, 525, 545.3])

# ----
# 4: Building Performance
# Attributes
weight_gwp = Slider(0.616, range=0..1)
objectiveopt = ObjectiveOPT(detection=detector, geometry=generator, objectives=objective)  # -> objectives
# ---------- objectiveopt: Python ----------
import os
import sys
appdata = os.getenv('APPDATA')
filePath =os.path.join(appdata, "Grasshopper", "UserObjects")
if filePath not in sys.path:
    sys.path.insert(0,filePath)

    


from hammy.Hammy_Detector import Detection
from hammy.Hammy_Generator import Geometry

from hammy.Hammy_Parametrizer import Massing, MassData
from hammy.Hammy_LCA import Construction

from hammy import load
from hammy.Hammy_Optimizer import objective
from hammy.Hammy_Penalty import penalty

try:
    mass_data = objectives.mass_data

except:
    ini_abs_info = detection.geo_detection.geo_abs_info
    flr_height = detection.flr_height
    initial_geometry = Geometry(ini_abs_info)

    MassData.ref_lib = load.ref_lib
    MassData.con_lib = load.con_lib

    mass = Massing(initial_geometry)
    mass_data = MassData(mass)
    
    objectives = objective.Objective(mass_data)

    Construction.ref_con_lib = load.con_lib
    Construction.mat_lib_v21 = load.mat_lib_v21
    Construction.mat_lib_v23 = load.mat_lib_v23
    Construction.constr_lib = load.constr_lib



    daylight_objs_arr = [0.4,0.7]
    energy_objs_arr =[0,0,400]

    objectives.daylight_dict(daylight_objs_arr)
    objectives.calc_energy_carbon(energy_objs_arr)


    objectives.mass_data.massing.geo = geometry
    
    objectives.check_valid = False
# ---------- end objectiveopt ----------

penalty = Penalty(detection=detector, objectives=objectiveopt, assumptions=penalty_assumptions)  # -> penalty_object; inputs assumptions: list
# ---------- penalty: Python ----------
import os
import sys
appdata = os.getenv('APPDATA')
filePath =os.path.join(appdata, "Grasshopper", "UserObjects")
if filePath not in sys.path:
    sys.path.insert(0,filePath)


from hammy.Hammy_Utils import util2
from hammy import load
from hammy.Hammy_Penalty import penalty
from hammy.Hammy_Optimizer import objective


penalty_object = penalty.Penalty(detection, objectives, assumptions)
# ---------- end penalty ----------

criteria = Criteria(penalty_object=penalty, objectives=objectiveopt, weight_gwp=weight_gwp, weight_penalty=0.5)  # -> criteria_object, criteria_value, criteria_value_penalized
# ---------- criteria: Python ----------
import os
import sys
appdata = os.getenv('APPDATA')
filePath =os.path.join(appdata, "Grasshopper", "UserObjects")
if filePath not in sys.path:
    sys.path.insert(0,filePath)




from hammy.Hammy_Utils import util2
from hammy import load
from hammy.Hammy_Penalty import penalty
from hammy.Hammy_Optimizer import objective, criteria




attributes = load.penalty_attributes
attributes["weight_gwp"] = weight_gwp
attributes["weight_penalty"] = weight_penalty

criteria_object = criteria.Criteria(objectives, penalty_object, attributes)
criteria_value = criteria_object.criteria
criteria_value_penalized = criteria_object.p_criteria
# ---------- end criteria ----------

criteria_2 = Number(criteria.criteria_value_penalized)
gwp_energy = Panel(criteria_2)

# ----
# p_arr_all_ws =
#         [
#             p_shape,
#             p_min_area,
#             p_max_area,
#             p_site,
#             p_angle,
#             p_seg_size,
#             p_ct_size,
#             p_seg_height,
#             p_big_ctyd,
#             p_high_ctyd,
#             p_no_ctyd,
#             p_block,
#             p_mass_ctyd,
#             p_mat_type
#             p_ase
#             p_sDA
#         ]
# keys_all_objs=
#         [
#         "Max. Flr Nr",                # [0]
#         "Floor Area",                 # [1]
#         "Wall to Flr Ratio",          # [2]
#         "Shape Coef.",                # [3]
#         "Avg. Building Depth",        # [4]
#         "Courtyard Depth",            # [5]
#         "Window Ratio Avg.",          # [6]
#         "Window Ratio S",             # [7]
#         "Window Ratio N",             # [8]
#         "Facade Gls. Ratio",          # [9]
#         "Envelop Gls. Ratio",         # [10]
#         "Gls. to Flr Ratio South",    # [11]
#         "Facade SW Ratio",            # [12]
#         "Courtyard Form Factor",      # [13]
#         "Building Form Factor",       # [14]
#         "Material System",            # [15]
#         "Insu Thickness ExWall",      # [16]
#         "Insu Thickness Roof",        # [17]
#         "U-Value ExWall",             # [18]
#         "U-Value RoofCeiling",         # [19]
#         "Energy Heating",             # [20]
#         "Energy Cooling",             # [21]
#         "Total Energy Demand",        # [22]
#         "GWP A1-A3",                  # [23]
#         "GWP B4",                     # [24]
#         "GWP C3-C4",                  # [25]
#         "GWP D",                      # [26]
#         "GWP Embed.",                 # [27]
#         "GWP Oper.",                  # [28]
#         "GWP Total"                   # [29]
#         ]
# keys_all_penalty=
#         [
#         "p_grp_shape",     [0]
#         "p_grp_area",        [1]
#         "p_grp_site",          [2]
#         "p_grp_angle.",     [3]
#         "p_grp_size",         [4]
#         "p_grp_bldg",        [5]
#         "p_grp_ctyd",         [6]
#         "p_grp_mat.",         [7]
#         "p_visual",               [8]
#         ]
# energy_predict
# sDA_predict
# ASE_predict
# Log
entity = Entity(
    detection=detector,
    variables=vars,
    geometry=generator,
    objectives=objectiveopt,
    zoning=planer,
    criteria=criteria.criteria_object)  # -> entity_info; inputs variables: list
# ---------- entity: Python ----------
import os
import sys
appdata = os.getenv('APPDATA')
filePath =os.path.join(appdata, "Grasshopper", "UserObjects")
if filePath not in sys.path:
    sys.path.insert(0,filePath)



from hammy.Hammy_Utils import log

entity = log.Entity(detection, variables, geometry, objectives, zoning, criteria)
entity_info = entity.entity_info

print(entity_info)
# ---------- end entity ----------
savelog = SaveLog(entity_info=entity, MaxCount=maxcound, RunName=run_name, LogReset=resetlog, Recording=recording)  # -> main_path; inputs entity_info: list
#   port entity_info: Path to an .epw file on this computer as a text string.
# ---------- savelog: Python ----------
import os
import json



desktop_path = os.path.join(os.path.expanduser("~"), "Desktop")
if not main_path:
    main_path = desktop_path

hammy_data_path = os.path.join(main_path, "hammy_data")
hammy_log_path = os.path.join(hammy_data_path, "hammy_log")

if not os.path.exists(hammy_data_path):
    os.makedirs(hammy_data_path)
if not os.path.exists(hammy_log_path):
    os.makedirs(hammy_log_path)

log_path = os.path.join(hammy_log_path, RunName + ".json")


isvalid = entity_info[0]
bldg_id = entity_info[1]
uv_sample = list(entity_info[2])
abs_sample = list(entity_info[3])
objs = list(entity_info[4])
crits= list(entity_info[5])
ps = [list(entity_info[6][0]), entity_info[6][1]]
reqs = [entity_info[7][0], list(entity_info[7][1])]
try:
    plan_settings = dict(entity_info[8][0])
except:
    plan_settings = {
                        "raster_size" : 1.5,
                        "column_raster" : 4,
                        "facade_type" : 0,
                        "zone_type" :0,
                        "corridor_depth" :2
                        }
settings = [plan_settings, list(entity_info[8][1]), dict(entity_info[8][2])]

entity_info = [
    isvalid,
    bldg_id,
    uv_sample,
    abs_sample,
    objs,
    crits,
    ps,
    reqs,
    settings
    ]
entity_info[8][2]["weight_p_hierachy"] = list(entity_info[8][2]["weight_p_hierachy"])
entity_info[8][2]["items_p_func"] = list(entity_info[8][2]["items_p_func"])

if LogReset:
    with open(log_path, "w") as jf:
        json.dump([], jf)
        ghenv.Component.Message = 'Ready'
    
if Recording:
    with open(log_path, "r") as jf:
        data = json.load(jf)
        countBelowMax = len(data) < MaxCount
        id_curr = [d[1] for d in data]
        checked = entity_info[1] in id_curr
        if not checked and countBelowMax:
            data.append(entity_info)
        else:
            print ("already checked")

    if countBelowMax:
        with open(log_path, "w") as jf:
            jf.seek(0)
            json.dump(data, jf, indent=4)
    else:
        ghenv.Component.Message = 'Done'
        doc = ghenv.Component.OnPingDocument()
        ao = doc.ActiveObjects()
        for a in ao:
            if a.NickName == 'Recording':
                a.Value = False
            a.Locked = True
# ---------- end savelog ----------

# ---- group: Table
# Penal Rhino Viewport
py3 = Python3Script(objectives=objectiveopt)  # -> out, total_energy, GWP_embed, GWP_total, Total_area, gap, sDA, ASE
# ---------- py3: Python ----------
import sys

import Rhino.Geometry as rg
import os
import json
# from System.Collections.Generic import *
TOL = 1e-06
# path = os.path.dirname(ghdoc.Path)
filePath =r"C:\GitHub"
if filePath not in sys.path:
    sys.path.insert(0,filePath)

# import main_rhino
# from main_rhino import daylight_geo_prep


from Hammy.hammy.Hammy_Optimizer import objective
import importlib
importlib.reload(objective)


total_energy = objectives.energy_objs_arr[2]
GWP_embed = objectives.energy_carbon_arr[7]
GWP_total = objectives.energy_carbon_arr[8]
Total_area = objectives.design_fact_arr[1]
gap = None
sDA = objectives.daylight_objs_arr[0]
ASE = objectives.daylight_objs_arr[1]
# ---------- end py3 ----------
py3_2 = Python3Script(detection=detector, uv_variables=vars)  # -> a, uv_variables, abs_info, initial_abs_info, area_req; inputs uv_variables: list
# ---------- py3_2: Python ----------
from hammy.Hammy_Generator import Geometry
from hammy.Hammy_Utils import util2
from hammy.Hammy_Detector import Detection

flr_height = detection.flr_height
site_info = detection.site_info
abs_info  = util2.get_remap_samples(uv_variables.copy(),site_info)
initial_abs_info =detection.geo_detection.geo_abs_info
area_req = detection.area_req
# geometry = Geometry(flr_height,abs_info)
# abs_info = abs_info[:-1]
# uv_variables = uv_variables[:-1]
# initial_abs_info = initial_abs_info[:-1]
# ---------- end py3_2 ----------
get_ranges = Python3Script(x=filter.variable_ranges)  # -> min_ranges, max_ranges
# ---------- get_ranges: Python ----------
max_ranges = []
min_ranges =[]
for i in range(len(x)):

    a = x[i][0]
    b = x[i][1]
    max_ranges.append(b)
    min_ranges.append(a)
# ---------- end get_ranges ----------
merge_3 = Merge(
    Data1=flatten(py3.total_energy),
    Data2=flatten(py3.GWP_embed),
    Data3=flatten(py3.GWP_total),
    Data4=flatten(py3.gap),
    Data5=flatten(py3.Total_area),
    Data6=flatten(py3.sDA),
    Data7=flatten(py3.ASE),
    Data8=flatten(py3.gap),
    Data9=flatten(criteria_2),
    Data10=flatten(weight_gwp))  # -> flatten(Result)

item = ListItem(List=merge_3, Index=8, Wrap=True)
rec = DataRecorder(item, DataLimit=-10, RecordData=True)
item_2 = ListItem(List=merge_3, Index=8, Wrap=True)
py3_3 = Python3Script(x=rec, y=item_2, z=py3_2.uv_variables)  # -> out, a; inputs x: list, z: list
# ---------- py3_3: Python ----------
curr_best = min(x)
is_curr_best =False
if y <=curr_best:
    is_curr_best = True
if is_curr_best:
    a =[z]
# ---------- end py3_3 ----------
rec_2 = DataRecorder(py3_3.a, DataLimit=-10, RecordData=True)
null = NullItem(Item=rec_2)  # -> NullFlags, InvalidFlags, Description
dispatch = Dispatch(List=flatten(rec_2), DispatchPattern=flatten(null.NullFlags))  # -> ListA, ListB
item_3 = ListItem(List=dispatch.ListB, Index=0, Wrap=True)  # -> Item1, Item
dom = ConstructDomain(DomainStart=get_ranges.min_ranges, DomainEnd=get_ranges.max_ranges)
py3_4 = Python3Script(x=item_3.Item1)  # -> out, a
# ---------- py3_4: Python ----------
a = x
# ---------- end py3_4 ----------
remap = RemapNumbers(Value=py3_2.uv_variables, Source=dom, Target=Domain(211, 345))  # -> Mapped, Clipped
remap_2 = RemapNumbers(Value=py3_4.a, Source=dom, Target=Domain(211, 345))  # -> Mapped, Clipped
addition = Addition(A=remap.Mapped, B=1)
shift = ShiftList(List=remap_2.Mapped, Shift=1, Wrap=True)
split = SplitList(List=remap_2.Mapped, Index=22)  # -> ListA, ListB
split_2 = SplitList(List=shift, Index=22)  # -> ListA, ListB
dst_8 = DrawScreenText(
    pt0X=split.ListA,
    pt0Y=[119, 139.3, 159.6, 179.9, 200.2, 220.5, 240.8, 261.1, 281.4, 301.7, 322, 342.3, 362.6, 382.9, 403.2, 423.5, 443.8, 464.1, 484.4, 504.7, 525, 545.3],
    pt1X=split_2.ListA,
    pt1Y=[139.3, 159.6, 179.9, 200.2, 220.5, 240.8, 261.1, 281.4, 301.7, 322, 342.3, 362.6, 382.9, 403.2, 423.5, 443.8, 464.1, 484.4, 504.7, 525, 545.3, 565.6],
    color=ColourSwatch(SwatchColor=RGB(109, 133, 123)))  # inputs pt0X: list, pt0Y: list, pt1X: list, pt1Y: list
# ---------- dst_8: Python ----------
from ghpythonlib.componentbase import executingcomponent as component
import Rhino as rc

ghenv.Component.Name = "DrawScreenText"
ghenv.Component.NickName = "DST"
import Rhino.Geometry as rg
import System
class MyComponent(component):
    
    def RunScript(self,pt0X,pt0Y,pt1X,pt1Y,color):
        self.pt0X = pt0X
        self.pt0Y = pt0Y
        self.pt1X = pt1X
        self.pt1Y = pt1Y
        self.color = color
#        
    def DrawViewportWires(self,arg):
#        color = rc.Display.ColorXYZ(5,self.color.R,self.color.G,self.color.B)
        color = self.color
#        color = rc.Display.ColorCMYK(0,50,0,0.1)
#        thickness = 10
#        location = System.Drawing.Point(self.locX,self.locY)
#        size = System.Drawing.Size(200, 200)
#        rect = System.Drawing.Rectangle(location, size)  

        for i in range(len(self.pt0X)):

            arg.Display.Draw2dLine(System.Drawing.PointF(self.pt0X[i],self.pt0Y[i]),System.Drawing.PointF(self.pt1X[i],self.pt1Y[i]),color,1)
#            arg.Display.Draw2dLine(System.Drawing.PointF(10,200),System.Drawing.PointF(100,200),color,1)
#        p
#      
#import System
#import Rhino.Geometry as rg
#location = System.Drawing.Point(10,10)
#size = System.Drawing.Size(200, 200)
#rect = System.Drawing.Rectangle(location, size)  
#color = rc.Display.ColorXYZ(155,155,155)
#thickness = 1
##rc.Display.DisplayPipeline.Draw2dRectangle(rect,color,thickness,color)
#rc.Display.DisplayPipeline.Draw2dLine(rg.Point3d(0,0,0),rg.Point3d(10,0,0),color,thickness,thickness)
# ---------- end dst_8 ----------
dst_9 = DrawScreenText(
    pt0X=remap.Mapped,
    pt0Y=[119, 139.3, 159.6, 179.9, 200.2, 220.5, 240.8, 261.1, 281.4, 301.7, 322, 342.3, 362.6, 382.9, 403.2, 423.5, 443.8, 464.1, 484.4, 504.7, 525, 545.3, 565.6],
    pt1X=addition,
    pt1Y=[119, 139.3, 159.6, 179.9, 200.2, 220.5, 240.8, 261.1, 281.4, 301.7, 322, 342.3, 362.6, 382.9, 403.2, 423.5, 443.8, 464.1, 484.4, 504.7, 525, 545.3, 565.6],
    color=ColourSwatch(SwatchColor=RGB(0, 255, 213)))  # inputs pt0X: list, pt0Y: list, pt1X: list, pt1Y: list
# ---------- dst_9: Python ----------
from ghpythonlib.componentbase import executingcomponent as component
import Rhino as rc

ghenv.Component.Name = "DrawScreenText"
ghenv.Component.NickName = "DST"
import Rhino.Geometry as rg
import System
class MyComponent(component):
    
    def RunScript(self,pt0X,pt0Y,pt1X,pt1Y,color):
        self.pt0X = pt0X
        self.pt0Y = pt0Y
        self.pt1X = pt1X
        self.pt1Y = pt1Y
        self.color = color
#        
    def DrawViewportWires(self,arg):
#        color = rc.Display.ColorXYZ(self.color.R,self.color.G,self.color.B)
        color = self.color
#        thickness = 10
#        location = System.Drawing.Point(self.locX,self.locY)
#        size = System.Drawing.Size(200, 200)
#        rect = System.Drawing.Rectangle(location, size)  

        for i in range(len(self.pt0X)):

            arg.Display.Draw2dLine(System.Drawing.PointF(self.pt0X[i],self.pt0Y[i]),System.Drawing.PointF(self.pt1X[i],self.pt1Y[i]),color,5)
#            arg.Display.Draw2dLine(System.Drawing.PointF(10,200),System.Drawing.PointF(100,200),color,1)
#        p
#      
#import System
#import Rhino.Geometry as rg
#location = System.Drawing.Point(10,10)
#size = System.Drawing.Size(200, 200)
#rect = System.Drawing.Rectangle(location, size)  
#color = rc.Display.ColorXYZ(155,155,155)
#thickness = 1
##rc.Display.DisplayPipeline.Draw2dRectangle(rect,color,thickness,color)
#rc.Display.DisplayPipeline.Draw2dLine(rg.Point3d(0,0,0),rg.Point3d(10,0,0),color,thickness,thickness)
# ---------- end dst_9 ----------

py3_5 = Python3Script(ini_geo_info_real=py3_2.initial_abs_info, geo_info_real=py3_2.abs_info, x=merge_3)  # -> out, a; inputs ini_geo_info_real: list, geo_info_real: list, x: Double
# ---------- py3_5: Python ----------
if_ini = [0]*22
print(if_ini)
b = 0
for i in range(len(ini_geo_info_real)):
    # round(ini_geo_info_real[i],2)
    # round(geo_info_real[i],2)

    # print(ini_geo_info_real[i])
    # print(geo_info_real[i])
    # print(abs(ini_geo_info_real[i] - geo_info_real[i]))
    b +=abs(ini_geo_info_real[i] - geo_info_real[i])
     
# print(if_ini)
if b <= 0.0022:
    if x:
        a = x
else:
    pass
# ---------- end py3_5 ----------
rec_3 = DataRecorder(py3_5.a, DataLimit=-10, RecordData=True)
split_3 = SplitList(List=rec_3, Index=Slider(10, range=0..10))  # -> ListA, ListB
py3_6 = Python3Script(x=split_3.ListA, y=merge_3)  # -> out, a, b; inputs x: Double, y: Double
# ---------- py3_6: Python ----------
"""Grasshopper Script"""
a = round(x,4)
b = round(y,4)
# ---------- end py3_6 ----------
item_4 = ListItem(List=py3_6.a, Index=0, Wrap=True)  # -> Item, Item1, Item2, Item3, Item4, Item5, Item6, Item7, Item8, Item9
merge_4 = Merge(
    Data1=flatten(item_4.Item),
    Data2=flatten(item_4.Item1),
    Data3=flatten(item_4.Item2),
    Data4=flatten(item_4.Item3),
    Data5=flatten(py3_2.area_req),
    Data6=flatten(Slider(0.55, range=0..1)),
    Data7=flatten(Slider(0.35, range=0..1)),
    Data8=flatten(item_4.Item7),
    Data9=flatten(item_4.Item8),
    Data10=flatten(item_4.Item9))  # -> flatten(Result)
py3_7 = Python3Script(
    ini_data=merge_4,
    curr_data=py3_6.b,
    x=ColourSwatch(SwatchColor=RGB(0, 255, 235)),
    y=ColourSwatch(SwatchColor=RGB(255, 110, 110)),
    z=ColourSwatch(SwatchColor=RGB(255, 255, 235)))  # -> out, a; inputs ini_data: list of Double, curr_data: list of Double
# ---------- py3_7: Python ----------
# if curr_data < ini_data:
#     a = x
# elif curr_data == ini_data:
#     a = z
# else:
#     print(abs(curr_data -ini_data))
#     if abs(curr_data -ini_data)< 0.1:
#         a = z
#     else:
#         a = y

a =[]
for i in range(len(ini_data)):
    if i == 0 or i == 1 or i == 2 or i == 6 or i == 8:
        if abs(curr_data[i] -ini_data[i])< 0.01:
            a.append(z)
        elif curr_data[i] < ini_data[i]:
            a.append(x)
            # print(i)
        else:
            a.append(y)
            
    # elif i == 3 or i == 7:
    #     a.append(None)
    elif i == 9:
        a.append(z)

    else:
        if abs(curr_data[i] -ini_data[i])<= 0.01:
            a.append(z)
        elif curr_data[i] > ini_data[i]:
            a.append(x)
            print(i)
        else:
            a.append(y)
# ---------- end py3_7 ----------
py3_8 = Python3Script(x=merge_3)  # -> out, a; inputs x: Double
# ---------- py3_8: Python ----------
if x:
    if x >1000:
        a = round(x)
    else:
        a = round(x,2)
# ---------- end py3_8 ----------
dst_10 = DrawScreenText(Text=py3_8.a, step=20, Color=py3_7.a, Height=16, locX=296, locY=679.7, Font="Cascadia Code ExtraLight Italic")  # inputs Text: list, Color: list; same code as dst_2

# ---- group: Table / Criteria related
rec_4 = DataRecorder(criteria_2, DataLimit=-10, RecordData=True)
py3_9 = Python3Script(x=rec_4)  # -> out, a; inputs x: list
# ---------- py3_9: Python ----------
a =[]


for i in range(len(x)):
    if i == 0:
        continue
    elif i ==1 :
        x[i]  = x[i] * 5
    if x[i] > 10:
        x[i]  = x[i] /10
    a.append(x[i])
# ---------- end py3_9 ----------

# ---- group: Table / Criteria related / Convergence Curve
lng = ListLength(List=py3_9.a)
py3_10 = Python3Script(x=py3_9.a)  # -> out, a; inputs x: list
# ---------- py3_10: Python ----------
a = []
for i in range(len(x)):
    if i == 0:
        a.append(x[i])
    else:
        b = min(x[:i+1])
        a.append(b)
print(a)
# ---------- end py3_10 ----------
series = Series(Start=0, Step=1, Count=lng)
bnd = Bounds(Numbers=py3_9.a)
bnd_2 = Bounds(Numbers=series)
remap_3 = RemapNumbers(Value=py3_10.a, Source=bnd, Target=Domain(1196, 1039))  # -> Mapped, Clipped
remap_4 = RemapNumbers(Value=series, Source=bnd_2, Target=Domain(104, 342))  # -> Mapped, Clipped
subtraction = Subtraction(A=lng, B=Slider(1, range=0..1))
shift_2 = ShiftList(List=remap_3.Mapped, Shift=1, Wrap=True)
shift_3 = ShiftList(List=remap_4.Mapped, Shift=1, Wrap=True)
split_4 = SplitList(List=remap_4.Mapped, Index=subtraction)  # -> ListA, ListB
split_5 = SplitList(List=remap_3.Mapped, Index=subtraction)  # -> ListA, ListB
split_6 = SplitList(List=shift_3, Index=subtraction)  # -> ListA, ListB
split_7 = SplitList(List=shift_2, Index=subtraction)  # -> ListA, ListB
dst_11 = DrawScreenText(pt0X=split_4.ListA, pt0Y=split_5.ListA, pt1X=split_6.ListA, pt1Y=split_7.ListA, color=RGB(0, 255, 255))  # inputs pt0X: list, pt0Y: list, pt1X: list, pt1Y: list
# ---------- dst_11: Python ----------
from ghpythonlib.componentbase import executingcomponent as component
import Rhino as rc

ghenv.Component.Name = "DrawScreenText"
ghenv.Component.NickName = "DST"
import Rhino.Geometry as rg
import System
class MyComponent(component):
    
    def RunScript(self,pt0X,pt0Y,pt1X,pt1Y,color):
        self.pt0X = pt0X
        self.pt0Y = pt0Y
        self.pt1X = pt1X
        self.pt1Y = pt1Y
        self.color = color
#        
    def DrawViewportWires(self,arg):
        color = rc.Display.ColorXYZ(5,self.color.R,self.color.G,self.color.B)
#        color = rc.Display.ColorCMYK(0,50,0,0.1)
#        thickness = 10
#        location = System.Drawing.Point(self.locX,self.locY)
#        size = System.Drawing.Size(200, 200)
#        rect = System.Drawing.Rectangle(location, size)  

        for i in range(len(self.pt0X)):

            arg.Display.Draw2dLine(System.Drawing.PointF(self.pt0X[i],self.pt0Y[i]),System.Drawing.PointF(self.pt1X[i],self.pt1Y[i]),color,1)
#            arg.Display.Draw2dLine(System.Drawing.PointF(10,200),System.Drawing.PointF(100,200),color,1)
#        p
#      
#import System
#import Rhino.Geometry as rg
#location = System.Drawing.Point(10,10)
#size = System.Drawing.Size(200, 200)
#rect = System.Drawing.Rectangle(location, size)  
#color = rc.Display.ColorXYZ(155,155,155)
#thickness = 1
##rc.Display.DisplayPipeline.Draw2dRectangle(rect,color,thickness,color)
#rc.Display.DisplayPipeline.Draw2dLine(rg.Point3d(0,0,0),rg.Point3d(10,0,0),color,thickness,thickness)
# ---------- end dst_11 ----------

# ---- group: Table / Criteria related / Convergence Points
lng_2 = ListLength(List=py3_9.a)
series_2 = Series(Start=0, Step=1, Count=lng_2)
bnd_3 = Bounds(Numbers=py3_9.a)
bnd_4 = Bounds(Numbers=series_2)
remap_5 = RemapNumbers(Value=series_2, Source=bnd_4, Target=Domain(104, 342))  # -> Mapped, Clipped
addition_2 = Addition(A=remap_5.Mapped, B=Slider(3, range=0..10))
remap_6 = RemapNumbers(Value=py3_9.a, Source=bnd_3, Target=Domain(1196, 1039))  # -> Mapped, Clipped
dst_12 = DrawScreenText(pt0X=remap_5.Mapped, pt0Y=remap_6.Mapped, pt1X=addition_2, pt1Y=remap_6.Mapped, color=RGB(255, 255, 255))  # inputs pt0X: list, pt0Y: list, pt1X: list, pt1Y: list; same code as dst_11

# ---- group: Table / Criteria related / Best
get_best_criteria = Python3Script(criterias=flatten(rec_4))  # -> best; inputs criterias: list
# ---------- get_best_criteria: Python ----------
best = min(criterias)
best = round(best,2)
# ---------- end get_best_criteria ----------
dst_13 = DrawScreenText(
    Text=get_best_criteria,
    step=20,
    Color=RGB(255, 255, 235),
    Height=16,
    locX=296,
    locY=995.6,
    Font="Cascadia Code ExtraLight Italic")  # inputs Text: list, Color: list; same code as dst_2
