# Grasshopper definition building_performance_study_simulation.gh (Grasshopper 1.0.8)
# plug-ins: RhinoCodePluginGH, ClimateStudioGH

coutryard_form = Slider(0, range=0..1)
win_ratio_n = Slider(0.6, range=0.6..0.61)
mat_typ = Slider(3, range=1..3)
mat_qua = Slider(1, range=0.5..1.5)
win_ratio_s = Slider(0.6, range=0.3..0.9)
flr_height = Slider(4.25, range=3.75..4.75)

# ----
# variables
seg_d1 = Slider(0.833, range=0.444..0.917)
seg_t0 = Slider(0, range=-1..1)
seg_dd1 = Slider(12, range=12..25)
sp0 = Slider(6, range=0..7)
seg_d0 = Slider(0.833, range=0.313..0.941)
seg_d2 = Slider(0.833, range=0.313..0.941)
seg_d3 = Slider(0.833, range=0.444..0.917)
seg_t1 = Slider(0, range=-1..1)
seg_t2 = Slider(0, range=-1..1)
seg_t3 = Slider(0, range=-1..1)
seg_dd0 = Slider(25, range=12..25)
seg_dd2 = Slider(25, range=12..25)
seg_dd3 = Slider(12, range=12..25)
sp1 = Slider(0, range=0..7)
sp2 = Slider(6, range=0..7)
sp3 = Slider(0, range=0..7)
courtyard_pattern = Slider(0, range=0..7)
geo_var = Merge(
    Data1=seg_d0,
    Data2=seg_d1,
    Data3=seg_d2,
    Data4=seg_d3,
    Data5=seg_t0,
    Data6=seg_t1,
    Data7=seg_t2,
    Data8=seg_t3,
    Data9=seg_dd0,
    Data10=seg_dd1,
    Data11=seg_dd2,
    Data12=seg_dd3,
    Data13=sp0,
    Data14=sp1,
    Data15=sp2,
    Data16=sp3,
    Data17=courtyard_pattern)
non_geo_var = Merge(Data1=coutryard_form, Data2=win_ratio_s, Data3=win_ratio_n, Data4=mat_typ, Data5=mat_qua, Data6=flr_height)

user_requires = ValueList({"No requires", "freeze_seg0", "freeze_seg1", "freeze_seg2", "freeze_seg3", "align with site0", "align with site1", "align with site2", "align with site3", "coincide_site0": “coincide_site0”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}, selected="No requires")

site_boundary = Curve(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)
# 1: Detect
initial_building_geometry = Brep([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])
area = Area(Geometry=site_boundary)  # -> Area, Centroid
vector = Vector(area.Centroid)
move = Move(Geometry=initial_building_geometry, Motion=expr("x*-1", vector))  # -> Geometry, Transform
move_2 = Move(Geometry=site_boundary, Motion=expr("x*-1", vector))  # -> Geometry, Transform

floor_height = Slider(4.25, range=0..10)
building_height_limit = Slider(30, range=0..100)
building_area_require = Slider(15000, range=0..100000)
detector = Detector(
    building_geo_solid=move.Geometry,
    site_boundary_curve=move_2.Geometry,
    flr_height=floor_height,
    user_requires=user_requires,
    height_limit=building_height_limit,
    area_require=building_area_require)  # -> detection; inputs building_geo_solid: list of Brep, site_boundary_curve: Curve, user_requires: list
# ---------- detector: Python ----------
import os
import sys
appdata = os.getenv('APPDATA')
filePath =os.path.join(appdata, "Grasshopper", "UserObjects")
if filePath not in sys.path:
    sys.path.insert(0,filePath)



import rhinoscriptsyntax as rs
import Rhino.Geometry as rg

from hammy.Hammy_Detector import detector



x_direction = rg.Vector3d(1,0,0)
y_direction = rg.Vector3d(0,1,0)


points_for_max = (curve.PointAtStart for curve in building_geo_solid[0].Edges)
points_for_min = (curve.PointAtStart for curve in building_geo_solid[0].Edges)
points_z_max = max(point.Z for point in points_for_max)
points_z_min = min(point.Z for point in points_for_min)
domain = points_z_max - points_z_min
contour_start = rg.Point3d(0,0,points_z_min)
contour_end = rg.Point3d(0,0,points_z_max)
floor_num = domain//flr_height

contour_start_vec = rg.Vector3d(0,0,points_z_min)
contour_curves_pts = []
for i in range (int(floor_num)):
    plane_origin = rg.Point3d(0,0,0) + rg.Vector3d(0,0,points_z_min+flr_height*i+flr_height/2)
    plane = rg.Plane(plane_origin,x_direction,y_direction)
    
    countour_curves_oneflo_pts = []
    for m in range(len(building_geo_solid)):
        contour_curve = rg.Brep.CreateContourCurves(building_geo_solid[m],plane)
        contour_curve_points = []
        for j in range(len(contour_curve)):
            
            lines = contour_curve[j].ToPolyline().GetSegments()
            curves = contour_curve[j]
            points=[]
            for k in range (len(lines)):
                point = [lines[k].From.X,lines[k].From.Y]
                points.append(point)
            
            
            countour_curves_oneflo_pts.append(points)

    contour_curves_pts.append(countour_curves_oneflo_pts)


site_lines = site_boundary_curve.ToPolyline().GetSegments()
site_points=[]
for l in range(len(site_lines)):
    site_point =  [site_lines[l].From.X,site_lines[l].From.Y]
    site_points.append(site_point)
    
initial_data = [site_points,contour_curves_pts,flr_height,height_limit,area_require,user_requires]

detection = detector.Detection(initial_data)
# ---------- end detector ----------

# ----
# 2: Generate
vars = Merge(Data1=geo_var, Data2=non_geo_var)
generator = Generator(detection=detector, uv_variables=vars)  # -> geometry; inputs uv_variables: list
# ---------- generator: Python ----------
import os
import sys
appdata = os.getenv('APPDATA')
filePath =os.path.join(appdata, "Grasshopper", "UserObjects")
if filePath not in sys.path:
    sys.path.insert(0,filePath)


    
from hammy.Hammy_Generator import Geometry
from hammy.Hammy_Utils import util2
from hammy.Hammy_Detector import Detection

flr_height = detection.flr_height
site_info = detection.site_info
abs_info  = util2.get_remap_samples(uv_variables,site_info)
geometry = Geometry(abs_info)
# ---------- end generator ----------

# ----
# Assumptions
min_size = Slider(12, range=0..50)
min_angle = Slider(75, range=0..80)
material_type = Slider(3, range=0..3)
daylight_calibr = Slider(0.05, range=0..0.1)
max_ct_area_0 = Slider(300, range=0..300)
max_ct_area_1 = Slider(300, range=0..300)
threshold_sda = Slider(0.75, range=0..1)
threshold_ase = Slider(0.4, range=0..1)
penalty_assumptions = Merge(
    Data1=min_size,
    Data2=min_angle,
    Data3=max_ct_area_0,
    Data4=max_ct_area_1,
    Data5=material_type,
    Data6=threshold_sda,
    Data7=threshold_ase,
    Data8=daylight_calibr)

# ----
# 4: Building Performance
# Attributes
weight_gwp = Slider(0.616, range=0..1)

# ----
# 3: Parametrize
parametrizer = Parametrizer(geometry=generator)  # -> mass_data
# ---------- parametrizer: Python ----------
import os
import sys
appdata = os.getenv('APPDATA')
filePath =os.path.join(appdata, "Grasshopper", "UserObjects")
if filePath not in sys.path:
    sys.path.insert(0,filePath)


    
from hammy.Hammy_Parametrizer import Massing, MassData
from hammy import load



MassData.ref_lib = load.ref_lib
MassData.con_lib = load.con_lib

mass = Massing(geometry)
mass_data = MassData(mass)
# ---------- end parametrizer ----------

designobjective = DesignObjective(mass_data=parametrizer)  # -> design_objectives
# ---------- designobjective: Python ----------
import os
import sys
appdata = os.getenv('APPDATA')
filePath =os.path.join(appdata, "Grasshopper", "UserObjects")
if filePath not in sys.path:
    sys.path.insert(0,filePath)

from hammy.Hammy_Optimizer import objective


design_objectives = objective.Objective(mass_data)
# ---------- end designobjective ----------

# ----
# energy simulation
energy_model = Energy_model(design_objectives=designobjective)  # -> energy_model
# ---------- energy_model: Python ----------
import os
import sys
appdata = os.getenv('APPDATA')
filePath =os.path.join(appdata, "Grasshopper", "UserObjects")
if filePath not in sys.path:
    sys.path.insert(0,filePath)


import json 



save_folder = os.path.join(filePath,"hammy","data","temp")
try:
    os.makedirs(save_folder)
except:
    pass

energy_model = os.path.join(save_folder,"bldg.hbjson")
hb = design_objectives.bldg_json
with open(energy_model,"w") as f:
    json.dump(hb,f,indent =4)
# ---------- end energy_model ----------
panel = Panel(energy_model)
boolean_toggle = BooleanToggle(False)
modeltoosm = HBModelToOSM(
    epw_file="C:\Users\QiuYu\AppData\Roaming\ladybug_tools\weather\DEU_BW_Stuttgart-Weissenburg.107370_TMYx\DEU_BW_Stuttgart-Weissenburg.107370_TMYx.epw",
    model_path=energy_model,
    sim_json="C:\hammy_temp\simulation_parameter.json",
    write=boolean_toggle,
    run=boolean_toggle)  # -> out, jsons, osw, osm, idf, sql, zsz, rdd, html; plug-in component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
readtable = HBReadTabularData(sql=modeltoosm.sql, table_name="Utility Use Per Total Floor Area")  # -> values, col_names, row_names; plug-in component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
reverse_list = ReverseList(List=readtable.values)
list_item = ListItem(List=reverse_list, Index=1, Wrap=True)  # -> Item, Item1, Item2
addition = Addition(A=list_item.Item1, B=list_item.Item2)
energy_objectives = Energy_objectives(heating_energy=list_item.Item1, cooling_energy=list_item.Item2)  # -> energy_object
# ---------- energy_objectives: Python ----------
class GH_GOO:
    def __init__(self,config):
        self.config = config


energy_sim = [ heating_energy , cooling_energy , heating_energy+ cooling_energy]
energy_object = GH_GOO(energy_sim)
# ---------- end energy_objectives ----------

# ----
# Energy Per Total Building Area [kWh/m2]
panel_2 = Panel(addition)

# ----
# District Cooling Intensity [kWh/m2]
panel_3 = Panel(list_item.Item2)

# ----
# District Heating Intensity [kWh/m2]
panel_4 = Panel(list_item.Item1)

# ----
# geometry_blocks
geometry_block = Geometry_block(geometry=generator)  # -> building_blocks, courtyard_blocks
# ---------- geometry_block: Python ----------
import os
import sys
appdata = os.getenv('APPDATA')
filePath =os.path.join(appdata, "Grasshopper", "UserObjects")
if filePath not in sys.path:
    sys.path.insert(0,filePath)



import json
import sys
import rhinoscriptsyntax as rs
import Rhino.Geometry as rg


TOL = 0.1



fp_geo = geometry.get_footprint_for_display()

geo_fps =fp_geo[0]
cty_fp = fp_geo[1]
seg_valid_nums = fp_geo[2]
flr_height = fp_geo[3]
cty_pattern = fp_geo[4]


brep_union =[]
surf_union=[]
cty_surfs=[]
max_loop = max(cty_pattern,len(seg_valid_nums))
for i in range(max_loop):
    geo_fp=[]
    
            
    if i<len(geo_fps):
        geo_fp = geo_fps[i]
    floor_pts=[]
    
    
    cty_lines=[]
    cty_pts=[]
    for m in range(len(cty_fp)):
        x = cty_fp[m][0]
        y = cty_fp[m][1]
        point = rg.Point3d(x,y,flr_height*i)
        cty_pts.append(point)
    cty_pts.append(cty_pts[-1])
    cty_polyline = rg.Polyline(cty_pts)
    for n in range(len(cty_pts)):
        line = rg.LineCurve(cty_pts[n],cty_pts[n-1])
        cty_lines.append(line)
    
    cty_surf = rg.Brep.CreatePlanarBreps(cty_lines)[0]
    cty_surfs.append(cty_surf)
#        cty_brep = rg.Brep.CreateOffsetBrep(cty_surf,flr_height,True,True,True,TOL)[0]
    if i< len(seg_valid_nums):
        seg_valid_num = seg_valid_nums[i]
        for j in range(len(geo_fp)):
            lines=[]
            
            pts=[]
            for k in range(len(geo_fp[j])):
                
                x = geo_fp[j][k][0]
                y = geo_fp[j][k][1]
                point= rg.Point3d(x,y,flr_height*i)
                pts.append(point)
    #            pts.append(pts[-1])
    #            curves = rg.Polyline(pts).ToNurbCurve()
            for l in range(len(pts)):
                line = rg.LineCurve(pts[l],pts[l-1])
                lines.append(line)
            # curves = List[rg.Curve](line for line in lines)
    #            clo_brep = rg.Brep.CreateFromLoft(curves,rg.Point3d(0,0,0),rg.Point3d(0,0,flr_height),0,True)
            flo_surf = rg.Brep.CreatePlanarBreps(lines)[0]
    ##            flo_surf = surf.Split(cty_brep,TOL)[0]
    #            clo_brep = rg.Brep.CreateOffsetBrep(flo_surf,flr_height,True,True,False,TOL)[0]
            
            if seg_valid_num ==4:
                flo_surf = rg.Brep.CreateBooleanDifference(flo_surf,cty_surf,TOL)[0]
    #                clo_brep =  rg.Brep.CreateOffsetBrep(flo_surf,flr_height,True,True,False,TOL)[0]
            
            surf_union.append(flo_surf)
#            brep_union.append(clo_brep[0])
cty_surfs = cty_surfs[:cty_pattern]
print(surf_union[i])
building_blocks =[]
for i in range(len(surf_union)):
    offset_surface = rs.OffsetSurface(surf_union[i], -flr_height,0.1,False,True)
    building_blocks.append(offset_surface)


courtyard_blocks =[]
for i in range(len(cty_surfs)):
    offset_surface = rs.OffsetSurface(cty_surfs[i], -flr_height,0.1,False,True)
    courtyard_blocks.append(offset_surface)


#if len(seg_valid_nums)< cty_pattern:
#    for i in range(cty_pattern-len(seg_valid_nums)):
#        cty_surfs.append(cty_surf)
#
# ---------- end geometry_block ----------

# ----
# building_with_plan
raster_size = Slider(1.5, range=0..10)
column_raster = Slider(4, range=0..10)
corridor_depth = Slider(2, range=0..10)
merge = Merge(Data1=raster_size, Data2=column_raster, Data3=corridor_depth)
planer = Planer(mass_data=parametrizer, plan_require=merge)  # -> zoning; inputs plan_require: list
# ---------- planer: Python ----------
import os
import sys
appdata = os.getenv('APPDATA')
filePath =os.path.join(appdata, "Grasshopper", "UserObjects")
if filePath not in sys.path:
    sys.path.insert(0,filePath)



    

from hammy.Hammy_Generator import Planar
import Rhino.Geometry as rg


raster_size = plan_require[0]
column_raster = plan_require[1]
corridor_depth = plan_require[2]

iRequire = {
        "raster_size" : raster_size,
        "column_raster" : column_raster,
        "facade_type" : 0,
        "zone_type" :0,
        "corridor_depth" :corridor_depth
        }
zoning = Planar(iRequire,mass_data)
# ---------- end planer ----------
panel_5 = Panel("""activity
meeting
office
corridor
open_office
core""")
merge_2 = Merge(
    Data1=ColourSwatch(SwatchColor=RGB(180, 232, 160)),
    Data2=ColourSwatch(SwatchColor=RGB(214, 134, 133)),
    Data3=ColourSwatch(SwatchColor=RGB(240, 202, 131)),
    Data4=ColourSwatch(SwatchColor=RGB(122, 147, 185)),
    Data5=ColourSwatch(SwatchColor=RGB(155, 188, 177)),
    Data6=ColourSwatch(SwatchColor=RGB(0, 0, 0)))
planed_building = Planed_building(zoning=planer, zone_types=panel_5, zone_colors=merge_2)  # -> zone_meshs, glass_surfaces, roof_surfaces, wall_surfaces; inputs zone_types: list, zone_colors: list
# ---------- planed_building: Python ----------
import os
import sys
appdata = os.getenv('APPDATA')
filePath =os.path.join(appdata, "Grasshopper", "UserObjects")
if filePath not in sys.path:
    sys.path.insert(0,filePath)

    



from hammy.Hammy_Generator import Planar
import Rhino.Geometry as rg
import rhinoscriptsyntax as rs



def visualize(zone_curve,  custom_color): 
    if zone_curve: 
        jaggedAndFaster = rg.MeshingParameters.Coarse 
        poly = zone_curve
        mesh = rg.Mesh.CreateFromPlanarBoundary(poly.ToNurbsCurve(), jaggedAndFaster, 0.001) 
        mesh.VertexColors.CreateMonotoneMesh(custom_color)
        return mesh


def set_visulize(zone_curves, custom_color): 
    mesh_list = [] 
    for curves in zone_curves: 
        mesh = visualize(curves, custom_color) 
        mesh_list.append(mesh) 
    return mesh_list


def pts_to_curves(pts):
    curves =[]
    for surf_pts in pts:
        if len(surf_pts) ==1:
            pts =[]
            lines =[]
            for pt in surf_pts[0]:
                pt = rg.Point3d(pt[0],pt[1],pt[2])
                pts.append(pt)
            pts.append(pts[0])
            curve = rg.Polyline(pts).ToPolylineCurve()
            curves.append(curve)
    # print(curves)
    return curves



flr_height = zoning.flr_height
plan_data = zoning.plan_data


activity_zones =plan_data[0]

meeting_zones =plan_data[1]
office_zones =plan_data[2]
special_tiles =plan_data[3]
corridor_tiles =plan_data[4]
core_zones =plan_data[5]
win_geo_total =plan_data[6]

mass_data = zoning.mass_data
daylight_space = mass_data.daylight_space
all_walls_pts = daylight_space[0]
all_cty_wall_pts =daylight_space[6]
all_cty_win_pts = daylight_space[5]
all_wins_hori_pts = daylight_space[2]

bldg_blocks = mass_data.massing.bldg_blocks
ctyd_blocks = mass_data.massing.ctyd_blocks

all_blocks = []
all_rfs_pts = []
all_cty_flrs_pts = []



for bs_flr in bldg_blocks:
    if bs_flr:
        for b in bs_flr:
            all_blocks.append(b)
for b in all_blocks:
    if b:
        
        roofs = b.erf
        
        for rf in roofs:
            # print("rf.face_name",rf.face_name)
            if rf.is_donut:
                rf_pts = [rf.face_pts, rf.hole_pts[::-1]]
                print(rf_pts)
                all_rfs_pts.append(rf_pts)
            elif rf.is_glas:
                pass
            else:
                
                all_rfs_pts.append([rf.face_pts])
for b in ctyd_blocks:
    if b:
        
        roofs = b.erf
        for rf in roofs:
            if rf.is_donut:
                rf_pts = [rf.face_pts, rf.hole_pts[::-1]]
                all_rfs_pts.append(rf_pts)
            elif rf.is_glas:
                pass
            else:
                all_rfs_pts.append([rf.face_pts])
                
        flrs = b.eflr + b.iflr
        for flr in flrs:
            if flr.is_donut:
                flr_pts = [flr.face_pts, flr.hole_pts[::-1]]
                all_cty_flrs_pts.append(flr_pts)
            else:

                all_cty_flrs_pts.append([flr.face_pts])

roof_surfaces =[]

for roof in all_rfs_pts:
    if len(roof) ==1:
        pts =[]
        lines =[]
        for pt in roof[0]:
            pt = rg.Point3d(pt[0],pt[1],pt[2])
            pts.append(pt)
        for l in range(len(pts)):
            line = rg.LineCurve(pts[l],pts[l-1])
            lines.append(line)
        roof_surf = rg.Brep.CreatePlanarBreps(lines)[0]
        roof_surfaces.append(roof_surf)
    else:
        pts =[]
        lines =[]
        for pt in roof[0]:
            pt = rg.Point3d(pt[0],pt[1],pt[2])
            pts.append(pt)
        for l in range(len(pts)):
            line = rg.LineCurve(pts[l],pts[l-1])
            lines.append(line)
        roof_surf = rg.Brep.CreatePlanarBreps(lines)[0]
    
        
        pts =[]
        lines =[]
        for pt in roof[1]:
            pt = rg.Point3d(pt[0],pt[1],pt[2])
            pts.append(pt)
        for l in range(len(pts)):
            line = rg.LineCurve(pts[l],pts[l-1])
            lines.append(line)
        cty_roof_surf = rg.Brep.CreatePlanarBreps(lines)[0]
        
        rof_surf = rg.Brep.CreateBooleanDifference(roof_surf,cty_roof_surf,0.01)[0]

        roof_surfaces.append(rof_surf)

cty_flor_curves =[]

for floor in all_cty_flrs_pts:
    
    pts =[]
    
    for pt in floor[0]:
        pt = rg.Point3d(pt[0],pt[1],pt[2])
        pts.append(pt)
    pts.append(pts[0])
    tile_curve = rg.Polyline(pts).ToPolylineCurve()

    cty_flor_curves.append(tile_curve)
    



activity_zones_zone =[]
meeting_zones_zone =[]
office_zones_zone =[]
special_tiles_zone =[]
corridor_tiles_zone =[]
open_office_zones_zone =[]
core_zones_zone =[]
win_geo = []

for i,win in enumerate(win_geo_total):
    
    points =[]
    for pt in win:
        point = rg.Point3d(pt[0],pt[1],pt[2])
        points.append(point)
    points.append(points[0])
    tile_curve = rg.Polyline(points).ToPolylineCurve()
    win_geo.append(tile_curve)

for i,flor in enumerate(activity_zones):
    for seg in flor:
        for side in seg:
            for tiless in side:
                for tile in tiless:
                    points =[]
                    for pt in tile:
                        point = rg.Point3d(pt[0],pt[1],flr_height*i)
                        points.append(point)
                    points.append(points[0])
                
                    tile_curve = rg.Polyline(points).ToPolylineCurve()
                    activity_zones_zone.append(tile_curve)


for i,flor in enumerate(meeting_zones):
    for seg in flor:
        for side in seg:
            for tiless in side:
                for tile in tiless:
                    points =[]
                    for pt in tile:
                        point = rg.Point3d(pt[0],pt[1],flr_height*i)
                        points.append(point)
                    points.append(points[0])
                
                    tile_curve = rg.Polyline(points).ToPolylineCurve()
                    meeting_zones_zone.append(tile_curve)


for i,flor in enumerate(office_zones):
    for seg in flor:
        for side in seg:
            for tiless in side:
                for tile in tiless:
                    points =[]
                    for pt in tile:
                        point = rg.Point3d(pt[0],pt[1],flr_height*i)
                        points.append(point)
                    points.append(points[0])
                
                    tile_curve = rg.Polyline(points).ToPolylineCurve()
                    office_zones_zone.append(tile_curve)



for i,flor in enumerate(core_zones):
    for seg in flor:
        for side in seg:
            for tiless in side:
                for tile in tiless:
                    points =[]
                    for pt in tile:
                        point = rg.Point3d(pt[0],pt[1],flr_height*i)
                        points.append(point)
                    points.append(points[0])
                
                    tile_curve = rg.Polyline(points).ToPolylineCurve()
                    core_zones_zone.append(tile_curve)




for i,flor in enumerate(special_tiles):
    for seg in flor:
        for side in seg:
            for tile in side:
                points =[]
                for pt in tile:
                    point = rg.Point3d(pt[0],pt[1],flr_height*i)
                    points.append(point)
                points.append(points[0])
            
                tile_curve = rg.Polyline(points).ToPolylineCurve()
                if i ==0 :
                    meeting_zones_zone.append(tile_curve)
                else:
                    open_office_zones_zone.append(tile_curve)


for i,flor in enumerate(corridor_tiles):
    for seg in flor:
        
        for tile in seg:
            points =[]
            for pt in tile:
                point = rg.Point3d(pt[0],pt[1],flr_height*i)
                points.append(point)
            points.append(points[0])
        
            tile_curve = rg.Polyline(points).ToPolylineCurve()
            corridor_tiles_zone.append(tile_curve)

activity_zones_zone.extend(cty_flor_curves)
# activity_zones_zone = activity_zones_zone+ cty_flor_curves

type_match = {
    # "activity" : cty_flor_curves,
    "activity" : activity_zones_zone,
    "meeting" : meeting_zones_zone,
    "office" : office_zones_zone,
    "corridor" : corridor_tiles_zone,
    "open_office" : open_office_zones_zone,
    "core" : core_zones_zone

}

zone_meshs =[]
for i , key in enumerate(zone_types):

    zone = type_match[key]

    zone_mesh = set_visulize(zone,zone_colors[i])
    zone_meshs.extend(zone_mesh)




# bld_wall_curves = pts_to_curves(all_walls_pts)
cty_wall_curves = pts_to_curves(all_cty_wall_pts)
# wall_curves =  bld_wall_curves + cty_wall_curves

all_cty_win_pts.extend(all_wins_hori_pts)
glas_curves = pts_to_curves(all_cty_win_pts)


bld_wall_curves =[]
for walls in all_walls_pts:
    if len(walls) ==1:
        pts =[]
        lines =[]
        
        pr0 = walls[0][1]
        pt0_geo = rg.Point3d(pr0[0],pr0[1],pr0[2])
        pr1 = walls[0][2]
        pt1_geo = rg.Point3d(pr1[0],pr1[1],pr1[2])
        pt2_geo = rg.Point3d(pr1[0],pr1[1],pr1[2]+flr_height)
        pt3_geo = rg.Point3d(pr0[0],pr0[1],pr0[2]+flr_height)
        points = [pt0_geo,pt1_geo,pt2_geo,pt3_geo,pt0_geo]
        tile_curve = rg.Polyline(points).ToPolylineCurve()
        bld_wall_curves.append(tile_curve)
        
wall_curves =  bld_wall_curves + cty_wall_curves
all_curves = wall_curves+win_geo
wall_surfaces  = rs.AddPlanarSrf(all_curves)
all_wins = win_geo + glas_curves
glass_surfaces = rs.AddPlanarSrf(all_wins)



# glas_curves = pts_to_curves(all_wins_hori_pts)
# ---------- end planed_building ----------

# ----
# building
building_block = Building_block(mass_data=parametrizer)  # -> glass_surfaces, wall_surfaces, floor_surfaces, roof_surfaces
# ---------- building_block: Python ----------
import os
import sys
appdata = os.getenv('APPDATA')
filePath =os.path.join(appdata, "Grasshopper", "UserObjects")
if filePath not in sys.path:
    sys.path.insert(0,filePath)


    

from hammy.Hammy_Parametrizer import MassData
import Rhino.Geometry as rg
import rhinoscriptsyntax as rs

TOL = 0.01

daylight_space = mass_data.daylight_space
flr_height = mass_data.massing.flr_height


def pts_to_curves(pts):
    curves =[]
    for surf_pts in pts:
        if len(surf_pts) ==1:
            pts =[]
            lines =[]
            for pt in surf_pts[0]:
                pt = rg.Point3d(pt[0],pt[1],pt[2])
                pts.append(pt)
            pts.append(pts[0])
            curve = rg.Polyline(pts).ToPolylineCurve()
            curves.append(curve)
    # print(curves)
    return curves



all_walls_pts =daylight_space[0]
all_wins_pts = daylight_space[1]
all_wins_hori_pts = daylight_space[2]
all_flrs_pts = daylight_space[3]
all_rfs_pts = daylight_space[4]
all_cty_win_pts = daylight_space[5]
all_cty_wall_pts = daylight_space[6]


bld_wall_curves = pts_to_curves(all_walls_pts)
cty_wall_curves = pts_to_curves(all_cty_wall_pts)
wall_curves =  bld_wall_curves + cty_wall_curves

wall_surfaces  = rs.AddPlanarSrf(wall_curves)

all_wins_pts.extend(all_wins_hori_pts)
glas_curves = pts_to_curves(all_wins_pts)
glass_surfaces = rs.AddPlanarSrf(glas_curves)

flor_curves = pts_to_curves(all_flrs_pts)
floor_surfaces = rs.AddPlanarSrf(flor_curves)


floor_surfaces =[]

for floor in all_flrs_pts:
    if len(floor) ==1:
        pts =[]
        lines =[]
        for pt in floor[0]:
            pt = rg.Point3d(pt[0],pt[1],pt[2])
            pts.append(pt)
        for l in range(len(pts)):
            line = rg.LineCurve(pts[l],pts[l-1])
            lines.append(line)
        flor_surf = rg.Brep.CreatePlanarBreps(lines)[0]
        floor_surfaces.append(flor_surf)
    else:
        pts =[]
        lines =[]
        for pt in floor[0]:
            print(pt)
            pt = rg.Point3d(pt[0],pt[1],pt[2])
            pts.append(pt)
        for l in range(len(pts)):
            line = rg.LineCurve(pts[l],pts[l-1])
            lines.append(line)
        flor_surf = rg.Brep.CreatePlanarBreps(lines)[0]
        
        pts =[]
        lines =[]
        for pt in floor[1]:
            pt = rg.Point3d(pt[0],pt[1],pt[2])
            pts.append(pt)
        for l in range(len(pts)):
            line = rg.LineCurve(pts[l],pts[l-1])
            lines.append(line)
        cyt_surf = rg.Brep.CreatePlanarBreps(lines)[0]
        flo_surf = rg.Brep.CreateBooleanDifference(flor_surf,cyt_surf,TOL)[0]
        # print(len(flo_surf))
        floor_surfaces.append(flo_surf)

roof_surfaces =[]

for roof in all_rfs_pts:
    if len(roof) ==1:
        pts =[]
        lines =[]
        for pt in roof[0]:
            pt = rg.Point3d(pt[0],pt[1],pt[2])
            pts.append(pt)
        for l in range(len(pts)):
            line = rg.LineCurve(pts[l],pts[l-1])
            lines.append(line)
        roof_surf = rg.Brep.CreatePlanarBreps(lines)[0]
        roof_surfaces.append(roof_surf)
    else:
        pts =[]
        lines =[]
        for pt in roof[0]:
            pt = rg.Point3d(pt[0],pt[1],pt[2])
            pts.append(pt)
        for l in range(len(pts)):
            line = rg.LineCurve(pts[l],pts[l-1])
            lines.append(line)
        roof_surf = rg.Brep.CreatePlanarBreps(lines)[0]
    
        
        pts =[]
        lines =[]
        for pt in roof[1]:
            pt = rg.Point3d(pt[0],pt[1],pt[2])
            pts.append(pt)
        for l in range(len(pts)):
            line = rg.LineCurve(pts[l],pts[l-1])
            lines.append(line)
        cty_roof_surf = rg.Brep.CreatePlanarBreps(lines)[0]
        
        rof_surf = rg.Brep.CreateBooleanDifference(roof_surf,cty_roof_surf,TOL)[0]

        roof_surfaces.append(rof_surf)
# ---------- end building_block ----------
relay = Relay([building_block.wall_surfaces, building_block.floor_surfaces, building_block.roof_surfaces])

# ----
# Surfaces added to the Window component
# should not also be added to SceneLayers.
number_slider = Slider(1, range=0..10)
# Simulate
panel_6 = Panel("ceiling lm83")
get_cs_lightingmaterial = GetCSLightingMaterial(Search=panel_6, UnitSystem=4)
get_cs_lightingmaterial_2 = GetCSLightingMaterial(Search="floor lm83", UnitSystem=4)
unit_z = UnitZ(Factor=number_slider)
get_cs_lightingmaterial_3 = GetCSLightingMaterial(Search="wall lm83", UnitSystem=4)
get_cs_glazingassembly = GetCSGlazingAssembly(UnitSystem=4)
get_cs_wovenshade = GetCSWovenShade(UnitSystem=4)
move_3 = Move(Geometry=building_block.floor_surfaces, Motion=unit_z)  # -> Geometry, Transform
construct_cs_window = ConstructCSWindow(
    Glazing=get_cs_glazingassembly,
    WovenShade=get_cs_wovenshade,
    Surface=building_block.glass_surfaces,
    Input_0_Hidden=False,
    Input_0_Name="Glazing",
    Input_1_Hidden=False,
    Input_1_Name="WovenShade",
    Input_2_Hidden=False,
    Input_2_Name="Position",
    Input_3_Hidden=True,
    Input_3_Name="Rotation",
    Input_4_Hidden=False,
    Input_4_Name="Position Schedule",
    Input_5_Hidden=True,
    Input_5_Name="Rotation Schedule",
    Input_6_Hidden=True,
    Input_6_Name="ECGlass",
    Input_7_Hidden=True,
    Input_7_Name="Tint",
    Input_8_Hidden=True,
    Input_8_Name="Tint Schedule",
    Input_9_Hidden=False,
    Input_9_Name="Surface",
    Mode=0,
    UnitSystem=4)
construct_cs_scenelayer = ConstructCSSceneLayer(
    Name="CEILING",
    Material=get_cs_lightingmaterial,
    Geometry=building_block.roof_surfaces,
    Input_0_Hidden=False,
    Input_0_Name="Name",
    Input_1_Hidden=False,
    Input_1_Name="Material",
    Input_2_Hidden=False,
    Input_2_Name="Geometry",
    Input_3_Hidden=True,
    Input_3_Name="ViewTag",
    UnitSystem=4,
    Input_3_GHParam_Branch0_Path="{0}",
    Input_3_GHParam_Branch0_Item0_null_string=False,
    Input_3_GHParam_Branch0_Item0_string="None")
construct_cs_scenelayer_2 = ConstructCSSceneLayer(
    Name="FLOOR",
    Material=get_cs_lightingmaterial_2,
    Geometry=building_block.floor_surfaces,
    Input_0_Hidden=False,
    Input_0_Name="Name",
    Input_1_Hidden=False,
    Input_1_Name="Material",
    Input_2_Hidden=False,
    Input_2_Name="Geometry",
    Input_3_Hidden=True,
    Input_3_Name="ViewTag",
    UnitSystem=4,
    Input_3_GHParam_Branch0_Path="{0}",
    Input_3_GHParam_Branch0_Item0_null_string=False,
    Input_3_GHParam_Branch0_Item0_string="None")
construct_cs_scenelayer_3 = ConstructCSSceneLayer(
    Name="WALL",
    Material=get_cs_lightingmaterial_3,
    Geometry=building_block.wall_surfaces,
    Input_0_Hidden=False,
    Input_0_Name="Name",
    Input_1_Hidden=False,
    Input_1_Name="Material",
    Input_2_Hidden=False,
    Input_2_Name="Geometry",
    Input_3_Hidden=True,
    Input_3_Name="ViewTag",
    UnitSystem=4,
    Input_3_GHParam_Branch0_Path="{0}",
    Input_3_GHParam_Branch0_Item0_null_string=False,
    Input_3_GHParam_Branch0_Item0_string="None")
construct_cs_sensorgrid = ConstructCSSensorGrid(
    Level="LEVEL 01",
    Geometry=move_3.Geometry,
    Spacing=Slider(5, range=0..10),
    Input_0_Hidden=True,
    Input_0_Name="Building",
    Input_10_Hidden=True,
    Input_10_Name="SupplementalLux",
    Input_11_Hidden=True,
    Input_11_Name="TargetLux",
    Input_12_Hidden=True,
    Input_12_Name="ExcessiveLux",
    Input_13_Hidden=True,
    Input_13_Name="sDA_Time",
    Input_14_Hidden=True,
    Input_14_Name="BREEAMSpaceType",
    Input_15_Hidden=True,
    Input_15_Name="ViewOffset",
    Input_16_Hidden=True,
    Input_16_Name="ViewDirections",
    Input_17_Hidden=True,
    Input_17_Name="ViewRotation",
    Input_18_Hidden=True,
    Input_18_Name="Points Override",
    Input_19_Hidden=True,
    Input_19_Name="Normals Override",
    Input_1_Hidden=False,
    Input_1_Name="Level",
    Input_20_Hidden=True,
    Input_20_Name="Disk Radius",
    Input_21_Hidden=True,
    Input_21_Name="Normal Override",
    Input_2_Hidden=False,
    Input_2_Name="Id"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)
data = Data(flatten([construct_cs_scenelayer, construct_cs_scenelayer_2, construct_cs_scenelayer_3]))
construct_cs_daylightmodel = ConstructCSDaylightModel(
    SceneLayers=data,
    Windows=construct_cs_window,
    SensorGrids=construct_cs_sensorgrid,
    NorthOffset=0,
    Input_0_Hidden=False,
    Input_0_Name="SceneLayers",
    Input_1_Hidden=False,
    Input_1_Name="Windows",
    Input_2_Hidden=False,
    Input_2_Name="Luminaires",
    Input_3_Hidden=True,
    Input_3_Name="Tubular Devices",
    Input_4_Hidden=False,
    Input_4_Name="SensorGrids",
    Input_5_Hidden=False,
    Input_5_Name="Camera",
    Input_6_Hidden=False,
    Input_6_Name="North Offset",
    UnitSystem=4)
run = Button()
run_cs_daylight = RunCSDaylight(
    Name="Simple Office\LEED Daylight",
    Model=construct_cs_daylightmodel,
    WeatherFile="USA_MA_Boston-Logan.Intl.AP.725090_TMYx.2004-2018",
    Samples=4096,
    SaveHourly=False,
    Run=Toggle(False),
    Input_0_Hidden=False,
    Input_0_Name="Name",
    Input_10_Hidden=False,
    Input_10_Name="Run",
    Input_1_Hidden=False,
    Input_1_Name="Model",
    Input_2_Hidden=True,
    Input_2_Name="BldgType",
    Input_3_Hidden=False,
    Input_3_Name="WeatherFile",
    Input_4_Hidden=True,
    Input_4_Name="Ground Albedo",
    Input_5_Hidden=False,
    Input_5_Name="Samples",
    Input_6_Hidden=False,
    Input_6_Name="Save Hourly",
    Input_7_Hidden=True,
    Input_7_Name="Threads",
    Input_8_Hidden=True,
    Input_8_Name="Hide Pop-up",
    Input_9_Hidden=True,
    Input_9_Name="Radiance Params",
    Standard=1,
    UnitSystem=4,
    Input_2_GHParam_Branch0_Path="{0}",
    Input_2_GHParam_Branch0_Item0_null_string=False,
    Input_2_GHParam_Branch0_Item0_string="Office",
    Input_4_GHParam_Branch0_Path="{0}",
    Input_4_GHParam_Branch0_Item0_number=0.2,
    Input_7_GHParam_Branch0_Path="{0}",
    Input_7_GHParam_Branch0_Item0_number=0,
    Input_8_GHParam_Branch0_Path="{0}",
    Input_8_GHParam_Branch0_Item0_boolean=False,
    Input_9_GHParam_Branch0_Path="{0}",
    Input_9_GHParam_Branch0_Item0_null_string=False,
    Input_9_GHParam_Branch0_Item0_string="-ab 6 -lw 0.01")
load_cs_result = LoadCSResult(
    Result=run_cs_daylight,
    Header=False,
    Output_0_Hidden=False,
    Output_0_Name="Name",
    Output_10_Hidden=True,
    Output_10_Name="Weather",
    Output_11_Hidden=True,
    Output_11_Name="North",
    Output_12_Hidden=True,
    Output_12_Name="LayerNames",
    Output_13_Hidden=True,
    Output_13_Name="LayerObjects",
    Output_14_Hidden=True,
    Output_14_Name="LayerMaterials",
    Output_15_Hidden=True,
    Output_15_Name="Sky",
    Output_1_Hidden=False,
    Output_1_Name="Type",
    Output_2_Hidden=True,
    Output_2_Name="Standard",
    Output_3_Hidden=True,
    Output_3_Name="Date",
    Output_4_Hidden=True,
    Output_4_Name="Version",
    Output_5_Hidden=True,
    Output_5_Name="FileSize",
    Output_6_Hidden=True,
    Output_6_Name="RunLog",
    Output_7_Hidden=False,
    Output_7_Name="Metrics",
    Output_8_Hidden=False,
    Output_8_Name="MetricValues",
    Output_9_Hidden=False,
    Output_9_Name="Grids",
    UnitSystem=4)  # -> Name, Type, Metrics, MetricValues, Grids
list_length = ListLength(List=load_cs_result.Metrics)
preview_cs_sensorgrid = PreviewCSSensorGrid(
    Grid=load_cs_result.Grids,
    Input_0_Hidden=False,
    Input_0_Name="Grid",
    Input_1_Hidden=False,
    Input_1_Name="Metric",
    Input_2_Hidden=True,
    Input_2_Name="Falsecolor",
    Input_3_Hidden=True,
    Input_3_Name="Sensor Values",
    Input_4_Hidden=True,
    Input_4_Name="Show Points",
    Input_5_Hidden=True,
    Input_5_Name="Show Edges",
    Input_6_Hidden=True,
    Input_6_Name="Show Labels",
    Input_7_Hidden=True,
    Input_7_Name="Label Format",
    Input_8_Hidden=True,
    Input_8_Name="Transform",
    Output_0_Hidden=True,
    Output_0_Name="Mesh",
    Output_1_Hidden=True,
    Output_1_Name="Texture",
    UnitSystem=4,
    Input_4_GHParam_Branch0_Path="{0}",
    Input_4_GHParam_Branch0_Item0_boolean=True,
    Input_5_GHParam_Branch0_Path="{0}",
    Input_5_GHParam_Branch0_Item0_boolean=True,
    Input_6_GHParam_Branch0_Path="{0}",
    Input_6_GHParam_Branch0_Item0_boolean=False)
duplicate_data = DuplicateData(Data="************************", Number=list_length, Order=True)
weave = Weave(
    Pattern=[0, 1, 2],
    Stream0=duplicate_data,
    Stream1=load_cs_result.Metrics,
    Stream2=load_cs_result.MetricValues,
    NullGaps=False)
list_item_2 = ListItem(List=load_cs_result.MetricValues, Index=0, Wrap=True)  # -> Item, Item1, Item2
metrics = Panel(weave)
daylight_objectives = Daylight_objectives(sDA=list_item_2.Item1, ASE=list_item_2.Item2)  # -> daylight_object
# ---------- daylight_objectives: Python ----------
class GH_GOO:
    def __init__(self,config):
        self.config = config


daylight_sim = [float(sDA),float(ASE)]
daylight_object = GH_GOO(daylight_sim)
# ---------- end daylight_objectives ----------

performanceobjective = PerformanceObjective(design_objectives=designobjective, energy_object=energy_objectives, daylight_object=daylight_objectives)  # -> objectives
# ---------- performanceobjective: Python ----------
import os
import sys
appdata = os.getenv('APPDATA')
filePath =os.path.join(appdata, "Grasshopper", "UserObjects")
if filePath not in sys.path:
    sys.path.insert(0,filePath)


    
from hammy.Hammy_Utils import util2
from hammy import load
from copy import deepcopy
import joblib

from hammy.Hammy_Optimizer import objective

from hammy.Hammy_LCA import Construction
from hammy import load



Construction.ref_con_lib = load.con_lib
Construction.mat_lib_v21 = load.mat_lib_v21
Construction.mat_lib_v23 = load.mat_lib_v23
Construction.constr_lib = load.constr_lib

design_objectives.daylight_dict(daylight_object.config)
design_objectives.calc_energy_carbon(energy_object.config)
# ---------- end performanceobjective ----------
objectiveopt = ObjectiveOPT(detection=detector, geometry=generator, objectives=performanceobjective)  # -> objectives
# ---------- objectiveopt: Python ----------
import os
import sys
appdata = os.getenv('APPDATA')
filePath =os.path.join(appdata, "Grasshopper", "UserObjects")
if filePath not in sys.path:
    sys.path.insert(0,filePath)

    


from hammy.Hammy_Detector import Detection
from hammy.Hammy_Generator import Geometry

from hammy.Hammy_Parametrizer import Massing, MassData
from hammy.Hammy_LCA import Construction

from hammy import load
from hammy.Hammy_Optimizer import objective
from hammy.Hammy_Penalty import penalty

try:
    mass_data = objectives.mass_data

except:
    ini_abs_info = detection.geo_detection.geo_abs_info
    flr_height = detection.flr_height
    initial_geometry = Geometry(ini_abs_info)

    MassData.ref_lib = load.ref_lib
    MassData.con_lib = load.con_lib

    mass = Massing(initial_geometry)
    mass_data = MassData(mass)
    
    objectives = objective.Objective(mass_data)

    Construction.ref_con_lib = load.con_lib
    Construction.mat_lib_v21 = load.mat_lib_v21
    Construction.mat_lib_v23 = load.mat_lib_v23
    Construction.constr_lib = load.constr_lib



    daylight_objs_arr = [0.4,0.7]
    energy_objs_arr =[0,0,400]

    objectives.daylight_dict(daylight_objs_arr)
    objectives.calc_energy_carbon(energy_objs_arr)


    objectives.mass_data.massing.geo = geometry
    
    objectives.check_valid = False
# ---------- end objectiveopt ----------
penalty = Penalty(detection=detector, objectives=objectiveopt, assumptions=penalty_assumptions)  # -> penalty_object; inputs assumptions: list
# ---------- penalty: Python ----------
import os
import sys
appdata = os.getenv('APPDATA')
filePath =os.path.join(appdata, "Grasshopper", "UserObjects")
if filePath not in sys.path:
    sys.path.insert(0,filePath)


from hammy.Hammy_Utils import util2
from hammy import load
from hammy.Hammy_Penalty import penalty
from hammy.Hammy_Optimizer import objective


penalty_object = penalty.Penalty(detection, objectives, assumptions)
# ---------- end penalty ----------
filter = Filter(detection=detector)  # -> data_filter, variable_ranges, initial_uv_variables
# ---------- filter: Python ----------
import os
import sys
appdata = os.getenv('APPDATA')
filePath =os.path.join(appdata, "Grasshopper", "UserObjects")
if filePath not in sys.path:
    sys.path.insert(0,filePath)






from hammy.Hammy_Filter import Filter

data_filter   = Filter(detection)
variable_ranges = [data_filter.var_range]
initial_uv_variables =[data_filter.detection.geo_detection.geo_uv_info]
# ---------- end filter ----------

# ----
# reset_initial_variables
reset_range = Button()
reset_value = Button()
panel_7 = Panel("""seg_d0
seg_d1
seg_d2
seg_d3
seg_t0
seg_t1
seg_t2
seg_t3
seg_dd0
seg_dd1
seg_dd2
seg_dd3
sp0
sp1
sp2
sp3
courtyard_pattern
coutryard_form
win_ratio_s
win_ratio_n
mat_typ
mat_qua
flr_height""")
slider_updater = SliderDomainUpdater(
    Sliders=panel_7,
    variable_ranges=filter.variable_ranges,
    initial_uv_variables=filter.initial_uv_variables,
    Update=reset_range)  # inputs Sliders: list
#   port Sliders: Path to an .epw file on this computer as a text string.
# ---------- slider_updater: Python ----------
import rhinoscriptsyntax as rs

"""
Reset a named slider's domain.
    Inputs:
        Sliders: List of slider NickNames.
        Min: Minimum Value(s).
        Max: Maximum value(s).
        Update: Set to 'True' to update the slider's domain.
"""

ghenv.Component.Name = "Slider Domain Updater"
ghenv.Component.NickName = 'Slider Updater'

import Grasshopper as gh
import json

gh_objects = ghenv.Component.OnPingDocument().Objects

if Update:

    var_range = variable_ranges


    for i in range(len(Sliders)):
        for obj in gh_objects:

            if obj.NickName == Sliders[i]:

                if type(obj) is gh.Kernel.Special.GH_NumberSlider:
 
                    
                    if var_range[i][0] == var_range[i][1]:
                        obj.Slider.Type = gh.GUI.Base.GH_SliderAccuracy(0)

                        obj.Slider.Minimum = var_range[i][0]
                        obj.Slider.Maximum = var_range[i][1]
                    else:

                        x = 0
                        if var_range[i][2]%1 !=0 :
                            x =3
          
                        obj.Slider.DecimalPlaces = x
                        
                        obj.Slider.Minimum = var_range[i][0]
                        obj.Slider.Maximum = var_range[i][1]

                       
                        obj.Slider.Value = initial_uv_variables[i]

                    obj.ExpireSolution(True)
# ---------- end slider_updater ----------
slider_updater_2 = SliderDomainUpdater(Sliders=panel_7, initial_uv_variables=filter.initial_uv_variables, Update=reset_value)  # inputs Sliders: list
#   port initial_uv_variables: A honeybee Energy SimulationParameter object that describes all of the setting for the simulation. If None, some default simulation parameters will automatically be used.
# ---------- slider_updater_2: Python ----------
"""
Reset a named slider's domain.
    Inputs:
        Sliders: List of slider NickNames.
        Min: Minimum Value(s).
        Max: Maximum value(s).
        Update: Set to 'True' to update the slider's domain.
"""


ghenv.Component.Name = "Slider Domain Updater"
ghenv.Component.NickName = 'Slider Updater'

import Grasshopper as gh
import json


gh_objects = ghenv.Component.OnPingDocument().Objects

if Update:

    for i,info in enumerate(initial_uv_variables):

        for obj in gh_objects:

            if obj.NickName == Sliders[i]:

                if type(obj) is gh.Kernel.Special.GH_NumberSlider:

                    obj.Slider.Value = info

                    obj.ExpireSolution(True)
# ---------- end slider_updater_2 ----------

criteria = Criteria(penalty_object=penalty, objectives=objectiveopt, weight_gwp=weight_gwp, weight_penalty=0.5)  # -> criteria_object, criteria_value, criteria_value_penalized
# ---------- criteria: Python ----------
import os
import sys
appdata = os.getenv('APPDATA')
filePath =os.path.join(appdata, "Grasshopper", "UserObjects")
if filePath not in sys.path:
    sys.path.insert(0,filePath)




from hammy.Hammy_Utils import util2
from hammy import load
from hammy.Hammy_Penalty import penalty
from hammy.Hammy_Optimizer import objective, criteria




attributes = load.penalty_attributes
attributes["weight_gwp"] = weight_gwp
attributes["weight_penalty"] = weight_penalty

criteria_object = criteria.Criteria(objectives, penalty_object, attributes)
criteria_value = criteria_object.criteria
criteria_value_penalized = criteria_object.p_criteria
# ---------- end criteria ----------

criteria_2 = Number(criteria.criteria_value_penalized)
gwp_energy = Panel(criteria_2)

# ----
# Visulize building_block
number_slider_2 = Slider(0.8, range=0..1)
material = CreateMaterial(
    Diffuse=ColourSwatch(SwatchColor=RGB(207, 255, 250)),
    Specular=RGB(255, 255, 255),
    Emission=RGB(0, 0, 0),
    Transparency=number_slider_2,
    Shine=0)
preview = CustomPreview(Geometry=building_block.glass_surfaces, Material=material)
preview_2 = CustomPreview(Geometry=relay, Material=ColourSwatch(SwatchColor=RGB(178, 177, 177)))

# ----
# Visulize planed_building
swatch = ColourSwatch(SwatchColor=RGB(201, 201, 201))
preview_3 = CustomPreview(Geometry=[planed_building.roof_surfaces, planed_building.wall_surfaces], Material=swatch)
mesh = Mesh(planed_building.zone_meshs)
srf = Surface(planed_building.glass_surfaces)

# ----
# Visulize geometry_block
swatch_2 = ColourSwatch(SwatchColor=RGB(20, 192, 255))
preview_4 = CustomPreview(Geometry=geometry_block.building_blocks, Material=ColourSwatch(SwatchColor=RGB(255, 204, 20)))
preview_5 = CustomPreview(Geometry=geometry_block.courtyard_blocks, Material=swatch_2)

resetlog = Button()
maxcound = Slider(200, range=0..1000)
run_name = Panel("0610")
recording = BooleanToggle(True)

# ----
# Log
entity = Entity(
    detection=detector,
    variables=vars,
    geometry=generator,
    objectives=objectiveopt,
    zoning=planer,
    criteria=criteria.criteria_object)  # -> entity_info; inputs variables: list
# ---------- entity: Python ----------
import os
import sys
appdata = os.getenv('APPDATA')
filePath =os.path.join(appdata, "Grasshopper", "UserObjects")
if filePath not in sys.path:
    sys.path.insert(0,filePath)



from hammy.Hammy_Utils import log

entity = log.Entity(detection, variables, geometry, objectives, zoning, criteria)
entity_info = entity.entity_info

print(entity_info)
# ---------- end entity ----------
savelog = SaveLog(entity_info=entity, MaxCount=maxcound, RunName=run_name, LogReset=resetlog, Recording=recording)  # -> main_path; inputs entity_info: list
#   port entity_info: Path to an .epw file on this computer as a text string.
# ---------- savelog: Python ----------
import os
import json



desktop_path = os.path.join(os.path.expanduser("~"), "Desktop")
if not main_path:
    main_path = desktop_path

hammy_data_path = os.path.join(main_path, "hammy_data")
hammy_log_path = os.path.join(hammy_data_path, "hammy_log")

if not os.path.exists(hammy_data_path):
    os.makedirs(hammy_data_path)
if not os.path.exists(hammy_log_path):
    os.makedirs(hammy_log_path)

log_path = os.path.join(hammy_log_path, RunName + ".json")


isvalid = entity_info[0]
bldg_id = entity_info[1]
uv_sample = list(entity_info[2])
abs_sample = list(entity_info[3])
objs = list(entity_info[4])
crits= list(entity_info[5])
ps = [list(entity_info[6][0]), entity_info[6][1]]
reqs = [entity_info[7][0], list(entity_info[7][1])]
try:
    plan_settings = dict(entity_info[8][0])
except:
    plan_settings = {
                        "raster_size" : 1.5,
                        "column_raster" : 4,
                        "facade_type" : 0,
                        "zone_type" :0,
                        "corridor_depth" :2
                        }
settings = [plan_settings, list(entity_info[8][1]), dict(entity_info[8][2])]

entity_info = [
    isvalid,
    bldg_id,
    uv_sample,
    abs_sample,
    objs,
    crits,
    ps,
    reqs,
    settings
    ]
entity_info[8][2]["weight_p_hierachy"] = list(entity_info[8][2]["weight_p_hierachy"])
entity_info[8][2]["items_p_func"] = list(entity_info[8][2]["items_p_func"])

if LogReset:
    with open(log_path, "w") as jf:
        json.dump([], jf)
        ghenv.Component.Message = 'Ready'
    
if Recording:
    with open(log_path, "r") as jf:
        data = json.load(jf)
        countBelowMax = len(data) < MaxCount
        id_curr = [d[1] for d in data]
        checked = entity_info[1] in id_curr
        if not checked and countBelowMax:
            data.append(entity_info)
        else:
            print ("already checked")

    if countBelowMax:
        with open(log_path, "w") as jf:
            jf.seek(0)
            json.dump(data, jf, indent=4)
    else:
        ghenv.Component.Message = 'Done'
        doc = ghenv.Component.OnPingDocument()
        ao = doc.ActiveObjects()
        for a in ao:
            if a.NickName == 'Recording':
                a.Value = False
            a.Locked = True
# ---------- end savelog ----------
