# Grasshopper definition tasks.gh (Grasshopper 1.0.8)
# plug-ins: RhinoCodePluginGH, Opossum2_0_Proto_A

# ----
# UV-sliders ->
seg_d3 = Slider(0.833, range=0.444..0.917)  # disabled
seg_t0 = Slider(0, range=-1..1)  # disabled
seg_t1 = Slider(0, range=-1..1)  # disabled
seg_t2 = Slider(0, range=-1..1)  # disabled
seg_t3 = Slider(0, range=-1..1)  # disabled
seg_d0 = Slider(0.833, range=0.313..0.941)  # disabled
seg_d2 = Slider(0.833, range=0.313..0.941)  # disabled
seg_d1 = Slider(0.833, range=0.444..0.917)  # disabled

sp0 = Slider(6, range=0..7)  # disabled
# pattern-sliders->
sp2 = Slider(6, range=0..7)  # disabled
sp3 = Slider(0, range=0..7)  # disabled
courtyard_pattern = Slider(0, range=0..7)  # disabled
sp1 = Slider(0, range=0..7)  # disabled

# ----
# courtyard- /
# window-sliders->
coutryard_form = Slider(0, range=0..1)  # disabled
win_ratio_n = Slider(0.6, range=0.6..0.6)  # disabled
win_ratio_s = Slider(0.6, range=0.3..0.9)  # disabled

# ----
# material-sliders ->
# 3: Parametrize
flr_height = Slider(4.25, range=3.75..4.75)  # disabled

mat_typ = Slider(3, range=1..3)  # disabled
mat_qua = Slider(1, range=0.5..1.5)  # disabled

# ----
# variables
seg_dd1 = Slider(12, range=12..25)  # disabled
seg_dd0 = Slider(25, range=12..25)  # disabled
seg_dd2 = Slider(25, range=12..25)  # disabled
seg_dd3 = Slider(12, range=12..25)  # disabled
non_geo_var = Merge(Data1=coutryard_form, Data2=win_ratio_s, Data3=win_ratio_n, Data4=mat_typ, Data5=mat_qua, Data6=flr_height)  # disabled
geo_var = Merge(
    Data1=seg_d0,
    Data2=seg_d1,
    Data3=seg_d2,
    Data4=seg_d3,
    Data5=seg_t0,
    Data6=seg_t1,
    Data7=seg_t2,
    Data8=seg_t3,
    Data9=seg_dd0,
    Data10=seg_dd1,
    Data11=seg_dd2,
    Data12=seg_dd3,
    Data13=sp0,
    Data14=sp1,
    Data15=sp2,
    Data16=sp3,
    Data17=courtyard_pattern)  # disabled

# ----
# Task 0:
brep = Brep([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])  # disabled
crv = Curve(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)  # disabled

initial_building_geometry = Brep(brep)  # disabled
site_boundary = Curve(crv)  # disabled
area = Area(Geometry=site_boundary)  # -> Area, Centroid; disabled
vector = Vector(area.Centroid)  # disabled
move = Move(Geometry=initial_building_geometry, Motion=expr("x*-1", vector))  # -> Geometry, Transform; disabled
move_2 = Move(Geometry=site_boundary, Motion=expr("x*-1", vector))  # -> Geometry, Transform; disabled

user_requires = ValueList({"No requires", "freeze_seg0", "freeze_seg1", "freeze_seg2", "freeze_seg3", "align with site0", "align with site1", "align with site2", "align with site3", "coincide_site0": “coincide_site0”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}, selected="No requires")  # disabled
floor_height = Slider(4.25, range=0..10)  # disabled
building_height_limit = Slider(30, range=0..100)  # disabled
building_area_require = Slider(15000, range=0..100000)  # disabled
detector = Detector(
    building_geo_solid=move.Geometry,
    site_boundary_curve=move_2.Geometry,
    flr_height=floor_height,
    user_requires=user_requires,
    height_limit=building_height_limit,
    area_require=building_area_require)  # -> detection; inputs building_geo_solid: list of Brep, site_boundary_curve: Curve, user_requires: list; disabled
# ---------- detector: Python ----------
import os
import sys
appdata = os.getenv('APPDATA')
filePath =os.path.join(appdata, "Grasshopper", "UserObjects")
if filePath not in sys.path:
    sys.path.insert(0,filePath)



import rhinoscriptsyntax as rs
import Rhino.Geometry as rg

from hammy.Hammy_Detector import detector



x_direction = rg.Vector3d(1,0,0)
y_direction = rg.Vector3d(0,1,0)


points_for_max = (curve.PointAtStart for curve in building_geo_solid[0].Edges)
points_for_min = (curve.PointAtStart for curve in building_geo_solid[0].Edges)
points_z_max = max(point.Z for point in points_for_max)
points_z_min = min(point.Z for point in points_for_min)
domain = points_z_max - points_z_min
contour_start = rg.Point3d(0,0,points_z_min)
contour_end = rg.Point3d(0,0,points_z_max)
floor_num = domain//flr_height

contour_start_vec = rg.Vector3d(0,0,points_z_min)
contour_curves_pts = []
for i in range (int(floor_num)):
    plane_origin = rg.Point3d(0,0,0) + rg.Vector3d(0,0,points_z_min+flr_height*i+flr_height/2)
    plane = rg.Plane(plane_origin,x_direction,y_direction)
    
    countour_curves_oneflo_pts = []
    for m in range(len(building_geo_solid)):
        contour_curve = rg.Brep.CreateContourCurves(building_geo_solid[m],plane)
        contour_curve_points = []
        for j in range(len(contour_curve)):
            
            lines = contour_curve[j].ToPolyline().GetSegments()
            curves = contour_curve[j]
            points=[]
            for k in range (len(lines)):
                point = [lines[k].From.X,lines[k].From.Y]
                points.append(point)
            
            
            countour_curves_oneflo_pts.append(points)

    contour_curves_pts.append(countour_curves_oneflo_pts)


site_lines = site_boundary_curve.ToPolyline().GetSegments()
site_points=[]
for l in range(len(site_lines)):
    site_point =  [site_lines[l].From.X,site_lines[l].From.Y]
    site_points.append(site_point)
    
initial_data = [site_points,contour_curves_pts,flr_height,height_limit,area_require,user_requires]

detection = detector.Detection(initial_data)
# ---------- end detector ----------

brep_2 = Brep(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)  # disabled
crv_2 = Curve(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)  # disabled

crv_3 = Curve(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)  # disabled
brep_3 = Brep(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)  # disabled

time_period = Slider(0, range=0..50)  # disabled

# ----
# 2: Generate
vars = Merge(Data1=geo_var, Data2=non_geo_var)  # disabled

# ----
# Assumptions
min_size = Slider(12, range=0..50)  # disabled
min_angle = Slider(75, range=0..80)  # disabled
material_type = Slider(3, range=0..3)  # disabled
threshold_ase = Slider(0.4, range=0..1)  # disabled
daylight_calibr = Slider(0.05, range=0..0.1)  # disabled
max_ct_area_0 = Slider(300, range=0..300)  # disabled
max_ct_area_1 = Slider(300, range=0..300)  # disabled
threshold_sda = Slider(0.75, range=0..1)  # disabled
penalty_assumptions = Merge(
    Data1=min_size,
    Data2=min_angle,
    Data3=max_ct_area_0,
    Data4=max_ct_area_1,
    Data5=material_type,
    Data6=threshold_sda,
    Data7=threshold_ase,
    Data8=daylight_calibr)  # disabled

generator = Generator(detection=detector, uv_variables=vars)  # -> geometry; inputs uv_variables: list; disabled
# ---------- generator: Python ----------
import os
import sys
appdata = os.getenv('APPDATA')
filePath =os.path.join(appdata, "Grasshopper", "UserObjects")
if filePath not in sys.path:
    sys.path.insert(0,filePath)


    
from hammy.Hammy_Generator import Geometry
from hammy.Hammy_Utils import util2
from hammy.Hammy_Detector import Detection

flr_height = detection.flr_height
site_info = detection.site_info
abs_info  = util2.get_remap_samples(uv_variables,site_info)
geometry = Geometry(abs_info)
# ---------- end generator ----------
parametrizer = Parametrizer(geometry=generator)  # -> mass_data; disabled
# ---------- parametrizer: Python ----------
import os
import sys
appdata = os.getenv('APPDATA')
filePath =os.path.join(appdata, "Grasshopper", "UserObjects")
if filePath not in sys.path:
    sys.path.insert(0,filePath)


    
from hammy.Hammy_Parametrizer import Massing, MassData
from hammy import load



MassData.ref_lib = load.ref_lib
MassData.con_lib = load.con_lib

mass = Massing(geometry)
mass_data = MassData(mass)
# ---------- end parametrizer ----------

# ----
# geometry_blocks
geometry_block = Geometry_block(geometry=generator)  # -> building_blocks, courtyard_blocks; disabled
# ---------- geometry_block: Python ----------
import os
import sys
appdata = os.getenv('APPDATA')
filePath =os.path.join(appdata, "Grasshopper", "UserObjects")
if filePath not in sys.path:
    sys.path.insert(0,filePath)



import json
import sys
import rhinoscriptsyntax as rs
import Rhino.Geometry as rg


TOL = 0.1



fp_geo = geometry.get_footprint_for_display()

geo_fps =fp_geo[0]
cty_fp = fp_geo[1]
seg_valid_nums = fp_geo[2]
flr_height = fp_geo[3]
cty_pattern = fp_geo[4]


brep_union =[]
surf_union=[]
cty_surfs=[]
max_loop = max(cty_pattern,len(seg_valid_nums))
for i in range(max_loop):
    geo_fp=[]
    
            
    if i<len(geo_fps):
        geo_fp = geo_fps[i]
    floor_pts=[]
    
    
    cty_lines=[]
    cty_pts=[]
    for m in range(len(cty_fp)):
        x = cty_fp[m][0]
        y = cty_fp[m][1]
        point = rg.Point3d(x,y,flr_height*i)
        cty_pts.append(point)
    cty_pts.append(cty_pts[-1])
    cty_polyline = rg.Polyline(cty_pts)
    for n in range(len(cty_pts)):
        line = rg.LineCurve(cty_pts[n],cty_pts[n-1])
        cty_lines.append(line)
    
    cty_surf = rg.Brep.CreatePlanarBreps(cty_lines)[0]
    cty_surfs.append(cty_surf)
#        cty_brep = rg.Brep.CreateOffsetBrep(cty_surf,flr_height,True,True,True,TOL)[0]
    if i< len(seg_valid_nums):
        seg_valid_num = seg_valid_nums[i]
        for j in range(len(geo_fp)):
            lines=[]
            
            pts=[]
            for k in range(len(geo_fp[j])):
                
                x = geo_fp[j][k][0]
                y = geo_fp[j][k][1]
                point= rg.Point3d(x,y,flr_height*i)
                pts.append(point)
    #            pts.append(pts[-1])
    #            curves = rg.Polyline(pts).ToNurbCurve()
            for l in range(len(pts)):
                line = rg.LineCurve(pts[l],pts[l-1])
                lines.append(line)
            # curves = List[rg.Curve](line for line in lines)
    #            clo_brep = rg.Brep.CreateFromLoft(curves,rg.Point3d(0,0,0),rg.Point3d(0,0,flr_height),0,True)
            flo_surf = rg.Brep.CreatePlanarBreps(lines)[0]
    ##            flo_surf = surf.Split(cty_brep,TOL)[0]
    #            clo_brep = rg.Brep.CreateOffsetBrep(flo_surf,flr_height,True,True,False,TOL)[0]
            
            if seg_valid_num ==4:
                flo_surf = rg.Brep.CreateBooleanDifference(flo_surf,cty_surf,TOL)[0]
    #                clo_brep =  rg.Brep.CreateOffsetBrep(flo_surf,flr_height,True,True,False,TOL)[0]
            
            surf_union.append(flo_surf)
#            brep_union.append(clo_brep[0])
cty_surfs = cty_surfs[:cty_pattern]
print(surf_union[i])
building_blocks =[]
for i in range(len(surf_union)):
    offset_surface = rs.OffsetSurface(surf_union[i], -flr_height,0.1,False,True)
    building_blocks.append(offset_surface)


courtyard_blocks =[]
for i in range(len(cty_surfs)):
    offset_surface = rs.OffsetSurface(cty_surfs[i], -flr_height,0.1,False,True)
    courtyard_blocks.append(offset_surface)


#if len(seg_valid_nums)< cty_pattern:
#    for i in range(cty_pattern-len(seg_valid_nums)):
#        cty_surfs.append(cty_surf)
#
# ---------- end geometry_block ----------

# ----
# building_with_plan
raster_size = Slider(1.5, range=0..10)  # disabled
column_raster = Slider(4, range=0..10)  # disabled
corridor_depth = Slider(2, range=0..10)  # disabled
merge = Merge(Data1=raster_size, Data2=column_raster, Data3=corridor_depth)  # disabled
swatch = ColourSwatch(SwatchColor=RGB(180, 232, 160))  # disabled
swatch_2 = ColourSwatch(SwatchColor=RGB(240, 202, 131))  # disabled
swatch_3 = ColourSwatch(SwatchColor=RGB(0, 0, 0))  # disabled
swatch_4 = ColourSwatch(SwatchColor=RGB(214, 134, 133))  # disabled
swatch_5 = ColourSwatch(SwatchColor=RGB(122, 147, 185))  # disabled
swatch_6 = ColourSwatch(SwatchColor=RGB(155, 188, 177))  # disabled
planer = Planer(mass_data=parametrizer, plan_require=merge)  # -> zoning; inputs plan_require: list; disabled
# ---------- planer: Python ----------
import os
import sys
appdata = os.getenv('APPDATA')
filePath =os.path.join(appdata, "Grasshopper", "UserObjects")
if filePath not in sys.path:
    sys.path.insert(0,filePath)



    

from hammy.Hammy_Generator import Planar
import Rhino.Geometry as rg


raster_size = plan_require[0]
column_raster = plan_require[1]
corridor_depth = plan_require[2]

iRequire = {
        "raster_size" : raster_size,
        "column_raster" : column_raster,
        "facade_type" : 0,
        "zone_type" :0,
        "corridor_depth" :corridor_depth
        }
zoning = Planar(iRequire,mass_data)
# ---------- end planer ----------
panel = Panel("""activity
meeting
office
corridor
open_office
core""")  # disabled
merge_2 = Merge(Data1=swatch, Data2=swatch_4, Data3=swatch_2, Data4=swatch_5, Data5=swatch_6, Data6=swatch_3)  # disabled
planed_building = Planed_building(zoning=planer, zone_types=panel, zone_colors=merge_2)  # -> zone_meshs, glass_surfaces, roof_surfaces, wall_surfaces; inputs zone_types: list, zone_colors: list; disabled
# ---------- planed_building: Python ----------
import os
import sys
appdata = os.getenv('APPDATA')
filePath =os.path.join(appdata, "Grasshopper", "UserObjects")
if filePath not in sys.path:
    sys.path.insert(0,filePath)

    



from hammy.Hammy_Generator import Planar
import Rhino.Geometry as rg
import rhinoscriptsyntax as rs



def visualize(zone_curve,  custom_color): 
    if zone_curve: 
        jaggedAndFaster = rg.MeshingParameters.Coarse 
        poly = zone_curve
        mesh = rg.Mesh.CreateFromPlanarBoundary(poly.ToNurbsCurve(), jaggedAndFaster, 0.001) 
        mesh.VertexColors.CreateMonotoneMesh(custom_color)
        return mesh


def set_visulize(zone_curves, custom_color): 
    mesh_list = [] 
    for curves in zone_curves: 
        mesh = visualize(curves, custom_color) 
        mesh_list.append(mesh) 
    return mesh_list


def pts_to_curves(pts):
    curves =[]
    for surf_pts in pts:
        if len(surf_pts) ==1:
            pts =[]
            lines =[]
            for pt in surf_pts[0]:
                pt = rg.Point3d(pt[0],pt[1],pt[2])
                pts.append(pt)
            pts.append(pts[0])
            curve = rg.Polyline(pts).ToPolylineCurve()
            curves.append(curve)
    # print(curves)
    return curves



flr_height = zoning.flr_height
plan_data = zoning.plan_data


activity_zones =plan_data[0]

meeting_zones =plan_data[1]
office_zones =plan_data[2]
special_tiles =plan_data[3]
corridor_tiles =plan_data[4]
core_zones =plan_data[5]
win_geo_total =plan_data[6]

mass_data = zoning.mass_data
daylight_space = mass_data.daylight_space
all_walls_pts = daylight_space[0]
all_cty_wall_pts =daylight_space[6]
all_cty_win_pts = daylight_space[5]
all_wins_hori_pts = daylight_space[2]

bldg_blocks = mass_data.massing.bldg_blocks
ctyd_blocks = mass_data.massing.ctyd_blocks

all_blocks = []
all_rfs_pts = []
all_cty_flrs_pts = []



for bs_flr in bldg_blocks:
    if bs_flr:
        for b in bs_flr:
            all_blocks.append(b)
for b in all_blocks:
    if b:
        
        roofs = b.erf
        
        for rf in roofs:
            # print("rf.face_name",rf.face_name)
            if rf.is_donut:
                rf_pts = [rf.face_pts, rf.hole_pts[::-1]]
                print(rf_pts)
                all_rfs_pts.append(rf_pts)
            elif rf.is_glas:
                pass
            else:
                
                all_rfs_pts.append([rf.face_pts])
for b in ctyd_blocks:
    if b:
        
        roofs = b.erf
        for rf in roofs:
            if rf.is_donut:
                rf_pts = [rf.face_pts, rf.hole_pts[::-1]]
                all_rfs_pts.append(rf_pts)
            elif rf.is_glas:
                pass
            else:
                all_rfs_pts.append([rf.face_pts])
                
        flrs = b.eflr + b.iflr
        for flr in flrs:
            if flr.is_donut:
                flr_pts = [flr.face_pts, flr.hole_pts[::-1]]
                all_cty_flrs_pts.append(flr_pts)
            else:

                all_cty_flrs_pts.append([flr.face_pts])

roof_surfaces =[]

for roof in all_rfs_pts:
    if len(roof) ==1:
        pts =[]
        lines =[]
        for pt in roof[0]:
            pt = rg.Point3d(pt[0],pt[1],pt[2])
            pts.append(pt)
        for l in range(len(pts)):
            line = rg.LineCurve(pts[l],pts[l-1])
            lines.append(line)
        roof_surf = rg.Brep.CreatePlanarBreps(lines)[0]
        roof_surfaces.append(roof_surf)
    else:
        pts =[]
        lines =[]
        for pt in roof[0]:
            pt = rg.Point3d(pt[0],pt[1],pt[2])
            pts.append(pt)
        for l in range(len(pts)):
            line = rg.LineCurve(pts[l],pts[l-1])
            lines.append(line)
        roof_surf = rg.Brep.CreatePlanarBreps(lines)[0]
    
        
        pts =[]
        lines =[]
        for pt in roof[1]:
            pt = rg.Point3d(pt[0],pt[1],pt[2])
            pts.append(pt)
        for l in range(len(pts)):
            line = rg.LineCurve(pts[l],pts[l-1])
            lines.append(line)
        cty_roof_surf = rg.Brep.CreatePlanarBreps(lines)[0]
        
        rof_surf = rg.Brep.CreateBooleanDifference(roof_surf,cty_roof_surf,0.01)[0]

        roof_surfaces.append(rof_surf)

cty_flor_curves =[]

for floor in all_cty_flrs_pts:
    
    pts =[]
    
    for pt in floor[0]:
        pt = rg.Point3d(pt[0],pt[1],pt[2])
        pts.append(pt)
    pts.append(pts[0])
    tile_curve = rg.Polyline(pts).ToPolylineCurve()

    cty_flor_curves.append(tile_curve)
    



activity_zones_zone =[]
meeting_zones_zone =[]
office_zones_zone =[]
special_tiles_zone =[]
corridor_tiles_zone =[]
open_office_zones_zone =[]
core_zones_zone =[]
win_geo = []

for i,win in enumerate(win_geo_total):
    
    points =[]
    for pt in win:
        point = rg.Point3d(pt[0],pt[1],pt[2])
        points.append(point)
    points.append(points[0])
    tile_curve = rg.Polyline(points).ToPolylineCurve()
    win_geo.append(tile_curve)

for i,flor in enumerate(activity_zones):
    for seg in flor:
        for side in seg:
            for tiless in side:
                for tile in tiless:
                    points =[]
                    for pt in tile:
                        point = rg.Point3d(pt[0],pt[1],flr_height*i)
                        points.append(point)
                    points.append(points[0])
                
                    tile_curve = rg.Polyline(points).ToPolylineCurve()
                    activity_zones_zone.append(tile_curve)


for i,flor in enumerate(meeting_zones):
    for seg in flor:
        for side in seg:
            for tiless in side:
                for tile in tiless:
                    points =[]
                    for pt in tile:
                        point = rg.Point3d(pt[0],pt[1],flr_height*i)
                        points.append(point)
                    points.append(points[0])
                
                    tile_curve = rg.Polyline(points).ToPolylineCurve()
                    meeting_zones_zone.append(tile_curve)


for i,flor in enumerate(office_zones):
    for seg in flor:
        for side in seg:
            for tiless in side:
                for tile in tiless:
                    points =[]
                    for pt in tile:
                        point = rg.Point3d(pt[0],pt[1],flr_height*i)
                        points.append(point)
                    points.append(points[0])
                
                    tile_curve = rg.Polyline(points).ToPolylineCurve()
                    office_zones_zone.append(tile_curve)



for i,flor in enumerate(core_zones):
    for seg in flor:
        for side in seg:
            for tiless in side:
                for tile in tiless:
                    points =[]
                    for pt in tile:
                        point = rg.Point3d(pt[0],pt[1],flr_height*i)
                        points.append(point)
                    points.append(points[0])
                
                    tile_curve = rg.Polyline(points).ToPolylineCurve()
                    core_zones_zone.append(tile_curve)




for i,flor in enumerate(special_tiles):
    for seg in flor:
        for side in seg:
            for tile in side:
                points =[]
                for pt in tile:
                    point = rg.Point3d(pt[0],pt[1],flr_height*i)
                    points.append(point)
                points.append(points[0])
            
                tile_curve = rg.Polyline(points).ToPolylineCurve()
                if i ==0 :
                    meeting_zones_zone.append(tile_curve)
                else:
                    open_office_zones_zone.append(tile_curve)


for i,flor in enumerate(corridor_tiles):
    for seg in flor:
        
        for tile in seg:
            points =[]
            for pt in tile:
                point = rg.Point3d(pt[0],pt[1],flr_height*i)
                points.append(point)
            points.append(points[0])
        
            tile_curve = rg.Polyline(points).ToPolylineCurve()
            corridor_tiles_zone.append(tile_curve)

activity_zones_zone.extend(cty_flor_curves)
# activity_zones_zone = activity_zones_zone+ cty_flor_curves

type_match = {
    # "activity" : cty_flor_curves,
    "activity" : activity_zones_zone,
    "meeting" : meeting_zones_zone,
    "office" : office_zones_zone,
    "corridor" : corridor_tiles_zone,
    "open_office" : open_office_zones_zone,
    "core" : core_zones_zone

}

zone_meshs =[]
for i , key in enumerate(zone_types):

    zone = type_match[key]

    zone_mesh = set_visulize(zone,zone_colors[i])
    zone_meshs.extend(zone_mesh)




# bld_wall_curves = pts_to_curves(all_walls_pts)
cty_wall_curves = pts_to_curves(all_cty_wall_pts)
# wall_curves =  bld_wall_curves + cty_wall_curves

all_cty_win_pts.extend(all_wins_hori_pts)
glas_curves = pts_to_curves(all_cty_win_pts)


bld_wall_curves =[]
for walls in all_walls_pts:
    if len(walls) ==1:
        pts =[]
        lines =[]
        
        pr0 = walls[0][1]
        pt0_geo = rg.Point3d(pr0[0],pr0[1],pr0[2])
        pr1 = walls[0][2]
        pt1_geo = rg.Point3d(pr1[0],pr1[1],pr1[2])
        pt2_geo = rg.Point3d(pr1[0],pr1[1],pr1[2]+flr_height)
        pt3_geo = rg.Point3d(pr0[0],pr0[1],pr0[2]+flr_height)
        points = [pt0_geo,pt1_geo,pt2_geo,pt3_geo,pt0_geo]
        tile_curve = rg.Polyline(points).ToPolylineCurve()
        bld_wall_curves.append(tile_curve)
        
wall_curves =  bld_wall_curves + cty_wall_curves
all_curves = wall_curves+win_geo
wall_surfaces  = rs.AddPlanarSrf(all_curves)
all_wins = win_geo + glas_curves
glass_surfaces = rs.AddPlanarSrf(all_wins)



# glas_curves = pts_to_curves(all_wins_hori_pts)
# ---------- end planed_building ----------

# ----
# building
building_block = Building_block(mass_data=parametrizer)  # -> glass_surfaces, wall_surfaces, floor_surfaces, roof_surfaces; disabled
# ---------- building_block: Python ----------
import os
import sys
appdata = os.getenv('APPDATA')
filePath =os.path.join(appdata, "Grasshopper", "UserObjects")
if filePath not in sys.path:
    sys.path.insert(0,filePath)


    

from hammy.Hammy_Parametrizer import MassData
import Rhino.Geometry as rg
import rhinoscriptsyntax as rs

TOL = 0.01

daylight_space = mass_data.daylight_space
flr_height = mass_data.massing.flr_height


def pts_to_curves(pts):
    curves =[]
    for surf_pts in pts:
        if len(surf_pts) ==1:
            pts =[]
            lines =[]
            for pt in surf_pts[0]:
                pt = rg.Point3d(pt[0],pt[1],pt[2])
                pts.append(pt)
            pts.append(pts[0])
            curve = rg.Polyline(pts).ToPolylineCurve()
            curves.append(curve)
    # print(curves)
    return curves



all_walls_pts =daylight_space[0]
all_wins_pts = daylight_space[1]
all_wins_hori_pts = daylight_space[2]
all_flrs_pts = daylight_space[3]
all_rfs_pts = daylight_space[4]
all_cty_win_pts = daylight_space[5]
all_cty_wall_pts = daylight_space[6]


bld_wall_curves = pts_to_curves(all_walls_pts)
cty_wall_curves = pts_to_curves(all_cty_wall_pts)
wall_curves =  bld_wall_curves + cty_wall_curves

wall_surfaces  = rs.AddPlanarSrf(wall_curves)

all_wins_pts.extend(all_wins_hori_pts)
glas_curves = pts_to_curves(all_wins_pts)
glass_surfaces = rs.AddPlanarSrf(glas_curves)

flor_curves = pts_to_curves(all_flrs_pts)
floor_surfaces = rs.AddPlanarSrf(flor_curves)


floor_surfaces =[]

for floor in all_flrs_pts:
    if len(floor) ==1:
        pts =[]
        lines =[]
        for pt in floor[0]:
            pt = rg.Point3d(pt[0],pt[1],pt[2])
            pts.append(pt)
        for l in range(len(pts)):
            line = rg.LineCurve(pts[l],pts[l-1])
            lines.append(line)
        flor_surf = rg.Brep.CreatePlanarBreps(lines)[0]
        floor_surfaces.append(flor_surf)
    else:
        pts =[]
        lines =[]
        for pt in floor[0]:
            print(pt)
            pt = rg.Point3d(pt[0],pt[1],pt[2])
            pts.append(pt)
        for l in range(len(pts)):
            line = rg.LineCurve(pts[l],pts[l-1])
            lines.append(line)
        flor_surf = rg.Brep.CreatePlanarBreps(lines)[0]
        
        pts =[]
        lines =[]
        for pt in floor[1]:
            pt = rg.Point3d(pt[0],pt[1],pt[2])
            pts.append(pt)
        for l in range(len(pts)):
            line = rg.LineCurve(pts[l],pts[l-1])
            lines.append(line)
        cyt_surf = rg.Brep.CreatePlanarBreps(lines)[0]
        flo_surf = rg.Brep.CreateBooleanDifference(flor_surf,cyt_surf,TOL)[0]
        # print(len(flo_surf))
        floor_surfaces.append(flo_surf)

roof_surfaces =[]

for roof in all_rfs_pts:
    if len(roof) ==1:
        pts =[]
        lines =[]
        for pt in roof[0]:
            pt = rg.Point3d(pt[0],pt[1],pt[2])
            pts.append(pt)
        for l in range(len(pts)):
            line = rg.LineCurve(pts[l],pts[l-1])
            lines.append(line)
        roof_surf = rg.Brep.CreatePlanarBreps(lines)[0]
        roof_surfaces.append(roof_surf)
    else:
        pts =[]
        lines =[]
        for pt in roof[0]:
            pt = rg.Point3d(pt[0],pt[1],pt[2])
            pts.append(pt)
        for l in range(len(pts)):
            line = rg.LineCurve(pts[l],pts[l-1])
            lines.append(line)
        roof_surf = rg.Brep.CreatePlanarBreps(lines)[0]
    
        
        pts =[]
        lines =[]
        for pt in roof[1]:
            pt = rg.Point3d(pt[0],pt[1],pt[2])
            pts.append(pt)
        for l in range(len(pts)):
            line = rg.LineCurve(pts[l],pts[l-1])
            lines.append(line)
        cty_roof_surf = rg.Brep.CreatePlanarBreps(lines)[0]
        
        rof_surf = rg.Brep.CreateBooleanDifference(roof_surf,cty_roof_surf,TOL)[0]

        roof_surfaces.append(rof_surf)
# ---------- end building_block ----------
relay = Relay([building_block.wall_surfaces, building_block.floor_surfaces, building_block.roof_surfaces])  # disabled

# ----
# 1: Detect
filter = Filter(detection=detector)  # -> data_filter, variable_ranges, initial_uv_variables; disabled
# ---------- filter: Python ----------
import os
import sys
appdata = os.getenv('APPDATA')
filePath =os.path.join(appdata, "Grasshopper", "UserObjects")
if filePath not in sys.path:
    sys.path.insert(0,filePath)






from hammy.Hammy_Filter import Filter

data_filter   = Filter(detection)
variable_ranges = [data_filter.var_range]
initial_uv_variables =[data_filter.detection.geo_detection.geo_uv_info]
# ---------- end filter ----------

# ----
# reset_initial_variables
reset_range = Button()  # disabled
reset_value = Button()  # disabled
panel_2 = Panel("""seg_d0
seg_d1
seg_d2
seg_d3
seg_t0
seg_t1
seg_t2
seg_t3
seg_dd0
seg_dd1
seg_dd2
seg_dd3
sp0
sp1
sp2
sp3
courtyard_pattern
coutryard_form
win_ratio_s
win_ratio_n
mat_typ
mat_qua
flr_height""")  # disabled
slider_updater = SliderDomainUpdater(
    Sliders=panel_2,
    variable_ranges=filter.variable_ranges,
    initial_uv_variables=filter.initial_uv_variables,
    Update=reset_range)  # inputs Sliders: list; disabled
#   port Sliders: Path to an .epw file on this computer as a text string.
# ---------- slider_updater: Python ----------
import rhinoscriptsyntax as rs

"""
Reset a named slider's domain.
    Inputs:
        Sliders: List of slider NickNames.
        Min: Minimum Value(s).
        Max: Maximum value(s).
        Update: Set to 'True' to update the slider's domain.
"""

ghenv.Component.Name = "Slider Domain Updater"
ghenv.Component.NickName = 'Slider Updater'

import Grasshopper as gh
import json

gh_objects = ghenv.Component.OnPingDocument().Objects

if Update:

    var_range = variable_ranges


    for i in range(len(Sliders)):
        for obj in gh_objects:

            if obj.NickName == Sliders[i]:

                if type(obj) is gh.Kernel.Special.GH_NumberSlider:
 
                    
                    if var_range[i][0] == var_range[i][1]:
                        obj.Slider.Type = gh.GUI.Base.GH_SliderAccuracy(0)

                        obj.Slider.Minimum = var_range[i][0]
                        obj.Slider.Maximum = var_range[i][1]
                    else:

                        x = 0
                        if var_range[i][2]%1 !=0 :
                            x =3
          
                        obj.Slider.DecimalPlaces = x
                        
                        obj.Slider.Minimum = var_range[i][0]
                        obj.Slider.Maximum = var_range[i][1]

                       
                        obj.Slider.Value = initial_uv_variables[i]

                    obj.ExpireSolution(True)
# ---------- end slider_updater ----------
slider_updater_2 = SliderDomainUpdater(Sliders=panel_2, initial_uv_variables=filter.initial_uv_variables, Update=reset_value)  # inputs Sliders: list; disabled
#   port initial_uv_variables: A honeybee Energy SimulationParameter object that describes all of the setting for the simulation. If None, some default simulation parameters will automatically be used.
# ---------- slider_updater_2: Python ----------
"""
Reset a named slider's domain.
    Inputs:
        Sliders: List of slider NickNames.
        Min: Minimum Value(s).
        Max: Maximum value(s).
        Update: Set to 'True' to update the slider's domain.
"""


ghenv.Component.Name = "Slider Domain Updater"
ghenv.Component.NickName = 'Slider Updater'

import Grasshopper as gh
import json


gh_objects = ghenv.Component.OnPingDocument().Objects

if Update:

    for i,info in enumerate(initial_uv_variables):

        for obj in gh_objects:

            if obj.NickName == Sliders[i]:

                if type(obj) is gh.Kernel.Special.GH_NumberSlider:

                    obj.Slider.Value = info

                    obj.ExpireSolution(True)
# ---------- end slider_updater_2 ----------

# ----
# Visulize building_block
number_slider = Slider(0.8, range=0..1)  # disabled
swatch_7 = ColourSwatch(SwatchColor=RGB(207, 255, 250))  # disabled
swatch_8 = ColourSwatch(SwatchColor=RGB(178, 177, 177))  # disabled
material = CreateMaterial(Diffuse=swatch_7, Specular=RGB(255, 255, 255), Emission=RGB(0, 0, 0), Transparency=number_slider, Shine=0)  # disabled
preview = CustomPreview(Geometry=building_block.glass_surfaces, Material=material)  # disabled
preview_2 = CustomPreview(Geometry=relay, Material=swatch_8)  # disabled

# ----
# Visulize geometry_block
swatch_9 = ColourSwatch(SwatchColor=RGB(20, 192, 255))  # disabled
swatch_10 = ColourSwatch(SwatchColor=RGB(255, 204, 20))  # disabled
preview_3 = CustomPreview(Geometry=geometry_block.building_blocks, Material=swatch_10)  # disabled
preview_4 = CustomPreview(Geometry=geometry_block.courtyard_blocks, Material=swatch_9)  # disabled

# ----
# Visulize planed_building
swatch_11 = ColourSwatch(SwatchColor=RGB(201, 201, 201))  # disabled
preview_5 = CustomPreview(Geometry=[planed_building.roof_surfaces, planed_building.wall_surfaces], Material=swatch_11)  # disabled
mesh = Mesh(planed_building.zone_meshs)  # disabled
srf = Surface(planed_building.glass_surfaces)  # disabled

coutryard_form_2 = Slider(0, range=0..1)  # disabled
win_ratio_s_2 = Slider(0.6, range=0.3..0.9)  # disabled
win_ratio_n_2 = Slider(0.6, range=0.6..0.6)  # disabled
# 3: Parametrize
flr_height_2 = Slider(4.25, range=3.75..4.75)  # disabled
mat_typ_2 = Slider(3, range=1..3)  # disabled
mat_qua_2 = Slider(1, range=0.5..1.5)  # disabled

# ----
# variables
seg_t0_2 = Slider(0, range=-1..1)  # disabled
seg_d2_2 = Slider(0.833, range=0.313..0.941)  # disabled
seg_d3_2 = Slider(0.833, range=0.444..0.917)  # disabled
seg_t1_2 = Slider(0, range=-1..1)  # disabled
seg_t2_2 = Slider(0, range=-1..1)  # disabled
seg_t3_2 = Slider(0, range=-1..1)  # disabled
seg_d0_2 = Slider(0.833, range=0.313..0.941)  # disabled
seg_d1_2 = Slider(0.833, range=0.444..0.917)  # disabled
seg_dd0_2 = Slider(25, range=12..25)  # disabled
seg_dd1_2 = Slider(12, range=12..25)  # disabled
seg_dd2_2 = Slider(25, range=12..25)  # disabled
seg_dd3_2 = Slider(12, range=12..25)  # disabled
sp0_2 = Slider(6, range=0..7)  # disabled
sp1_2 = Slider(0, range=0..7)  # disabled
sp2_2 = Slider(6, range=0..7)  # disabled
sp3_2 = Slider(0, range=0..7)  # disabled
courtyard_pattern_2 = Slider(0, range=0..7)  # disabled
non_geo_var_2 = Merge(Data1=coutryard_form_2, Data2=win_ratio_s_2, Data3=win_ratio_n_2, Data4=mat_typ_2, Data5=mat_qua_2, Data6=flr_height_2)  # disabled
geo_var_2 = Merge(
    Data1=seg_d0_2,
    Data2=seg_d1_2,
    Data3=seg_d2_2,
    Data4=seg_d3_2,
    Data5=seg_t0_2,
    Data6=seg_t1_2,
    Data7=seg_t2_2,
    Data8=seg_t3_2,
    Data9=seg_dd0_2,
    Data10=seg_dd1_2,
    Data11=seg_dd2_2,
    Data12=seg_dd3_2,
    Data13=sp0_2,
    Data14=sp1_2,
    Data15=sp2_2,
    Data16=sp3_2,
    Data17=courtyard_pattern_2)  # disabled

crv_4 = Curve(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)  # disabled
# Task 1:
brep_4 = Brep([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])  # disabled

coutryard_form_3 = Slider(0, range=0..1)  # disabled
win_ratio_s_3 = Slider(0.6, range=0.3..0.9)  # disabled
win_ratio_n_3 = Slider(0.6, range=0.6..0.6)  # disabled
# 3: Parametrize
flr_height_3 = Slider(4.25, range=3.75..4.75)  # disabled
mat_typ_3 = Slider(3, range=1..3)  # disabled
mat_qua_3 = Slider(1, range=0.5..1.5)  # disabled

# ----
# variables
seg_d3_3 = Slider(0.833, range=0.444..0.917)  # disabled
seg_t0_3 = Slider(0, range=-1..1)  # disabled
seg_t3_3 = Slider(0, range=-1..1)  # disabled
seg_d0_3 = Slider(0.833, range=0.313..0.941)  # disabled
seg_d2_3 = Slider(0.833, range=0.313..0.941)  # disabled
seg_t1_3 = Slider(0, range=-1..1)  # disabled
seg_t2_3 = Slider(0, range=-1..1)  # disabled
seg_d1_3 = Slider(0.833, range=0.444..0.917)  # disabled
seg_dd0_3 = Slider(25, range=12..25)  # disabled
seg_dd1_3 = Slider(12, range=12..25)  # disabled
seg_dd2_3 = Slider(25, range=12..25)  # disabled
seg_dd3_3 = Slider(12, range=12..25)  # disabled
sp0_3 = Slider(6, range=0..7)  # disabled
sp2_3 = Slider(6, range=0..7)  # disabled
sp3_3 = Slider(0, range=0..7)  # disabled
sp1_3 = Slider(0, range=0..7)  # disabled
courtyard_pattern_3 = Slider(0, range=0..7)  # disabled
non_geo_var_3 = Merge(Data1=coutryard_form_3, Data2=win_ratio_s_3, Data3=win_ratio_n_3, Data4=mat_typ_3, Data5=mat_qua_3, Data6=flr_height_3)  # disabled
geo_var_3 = Merge(
    Data1=seg_d0_3,
    Data2=seg_d1_3,
    Data3=seg_d2_3,
    Data4=seg_d3_3,
    Data5=seg_t0_3,
    Data6=seg_t1_3,
    Data7=seg_t2_3,
    Data8=seg_t3_3,
    Data9=seg_dd0_3,
    Data10=seg_dd1_3,
    Data11=seg_dd2_3,
    Data12=seg_dd3_3,
    Data13=sp0_3,
    Data14=sp1_3,
    Data15=sp2_3,
    Data16=sp3_3,
    Data17=courtyard_pattern_3)  # disabled

user_requires_2 = ValueList({"No requires", "freeze_seg0", "freeze_seg1", "freeze_seg2", "freeze_seg3", "align with site0", "align with site1", "align with site2", "align with site3", "coincide_site0": “coincide_site0”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}, selected="No requires")  # disabled
building_height_limit_2 = Slider(30, range=0..100)  # disabled
building_area_require_2 = Slider(15000, range=0..100000)  # disabled
floor_height_2 = Slider(4.25, range=0..10)  # disabled

initial_building_geometry_2 = Brep(brep_4)  # disabled
site_boundary_2 = Curve(crv_4)  # disabled
area_2 = Area(Geometry=site_boundary_2)  # -> Area, Centroid; disabled
vector_2 = Vector(area_2.Centroid)  # disabled
move_3 = Move(Geometry=initial_building_geometry_2, Motion=expr("x*-1", vector_2))  # -> Geometry, Transform; disabled
move_4 = Move(Geometry=site_boundary_2, Motion=expr("x*-1", vector_2))  # -> Geometry, Transform; disabled

# ----
# Task 2:
brep_5 = Brep([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])  # disabled
crv_5 = Curve(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)  # disabled

crv_6 = Curve(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)  # disabled
brep_6 = Brep(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)  # disabled

initial_building_geometry_3 = Brep(brep_5)  # disabled
site_boundary_3 = Curve(crv_5)  # disabled
area_3 = Area(Geometry=site_boundary_3)  # -> Area, Centroid; disabled
vector_3 = Vector(area_3.Centroid)  # disabled
move_5 = Move(Geometry=initial_building_geometry_3, Motion=expr("x*-1", vector_3))  # -> Geometry, Transform; disabled
move_6 = Move(Geometry=site_boundary_3, Motion=expr("x*-1", vector_3))  # -> Geometry, Transform; disabled

floor_height_3 = Slider(4.25, range=0..10)  # disabled
user_requires_3 = ValueList({"No requires", "freeze_seg0", "freeze_seg1", "freeze_seg2", "freeze_seg3", "align with site0", "align with site1", "align with site2", "align with site3", "coincide_site0": “coincide_site0”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}, selected="No requires")  # disabled
building_area_require_3 = Slider(15000, range=0..100000)  # disabled
building_height_limit_3 = Slider(30, range=0..100)  # disabled
detector_2 = Detector(
    building_geo_solid=move_5.Geometry,
    site_boundary_curve=move_6.Geometry,
    flr_height=floor_height_3,
    user_requires=user_requires_3,
    height_limit=building_height_limit_3,
    area_require=building_area_require_3)  # -> detection; inputs building_geo_solid: list of Brep, site_boundary_curve: Curve, user_requires: list; disabled; same code as detector

brep_7 = Brep(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)  # disabled
crv_7 = Curve(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)  # disabled

brep_8 = Brep(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)  # disabled
crv_8 = Curve(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)  # disabled

# ----
# Assumptions
min_size_2 = Slider(12, range=0..50)  # disabled
min_angle_2 = Slider(75, range=0..80)  # disabled
material_type_2 = Slider(3, range=0..3)  # disabled
threshold_ase_2 = Slider(0.4, range=0..1)  # disabled
daylight_calibr_2 = Slider(0.05, range=0..0.1)  # disabled
max_ct_area_0_2 = Slider(300, range=0..300)  # disabled
max_ct_area_1_2 = Slider(300, range=0..300)  # disabled
threshold_sda_2 = Slider(0.75, range=0..1)  # disabled
penalty_assumptions_2 = Merge(
    Data1=min_size_2,
    Data2=min_angle_2,
    Data3=max_ct_area_0_2,
    Data4=max_ct_area_1_2,
    Data5=material_type_2,
    Data6=threshold_sda_2,
    Data7=threshold_ase_2,
    Data8=daylight_calibr_2)  # disabled

crv_9 = Curve(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)  # disabled
brep_9 = Brep(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)  # disabled

weight_gwp = Slider(0.616, range=0..1)  # disabled
weight_penalty = Slider(0.5, range=0..1)  # disabled

time_period_2 = Slider(0, range=0..50)  # disabled

# ----
# 2: Generate
vars_2 = Merge(Data1=geo_var_2, Data2=non_geo_var_2)  # disabled

# ----
# 2: Generate
vars_3 = Merge(Data1=geo_var_3, Data2=non_geo_var_3)  # disabled

detector_3 = Detector(
    building_geo_solid=move_3.Geometry,
    site_boundary_curve=move_4.Geometry,
    flr_height=floor_height_2,
    user_requires=user_requires_2,
    height_limit=building_height_limit_2,
    area_require=building_area_require_2)  # -> detection; inputs building_geo_solid: list of Brep, site_boundary_curve: Curve, user_requires: list; disabled; same code as detector

# ----
# Assumptions
min_size_3 = Slider(12, range=0..50)  # disabled
min_angle_3 = Slider(75, range=0..80)  # disabled
max_ct_area_0_3 = Slider(300, range=0..300)  # disabled
max_ct_area_1_3 = Slider(300, range=0..300)  # disabled
material_type_3 = Slider(3, range=0..3)  # disabled
threshold_sda_3 = Slider(0.75, range=0..1)  # disabled
threshold_ase_3 = Slider(0.4, range=0..1)  # disabled
daylight_calibr_3 = Slider(0.05, range=0..0.1)  # disabled
penalty_assumptions_3 = Merge(
    Data1=min_size_3,
    Data2=min_angle_3,
    Data3=max_ct_area_0_3,
    Data4=max_ct_area_1_3,
    Data5=material_type_3,
    Data6=threshold_sda_3,
    Data7=threshold_ase_3,
    Data8=daylight_calibr_3)  # disabled

generator_2 = Generator(detection=detector_3, uv_variables=vars_2)  # -> geometry; inputs uv_variables: list; disabled; same code as generator
parametrizer_2 = Parametrizer(geometry=generator_2)  # -> mass_data; disabled; same code as parametrizer
generator_3 = Generator(detection=detector_2, uv_variables=vars_3)  # -> geometry; inputs uv_variables: list; disabled; same code as generator
parametrizer_3 = Parametrizer(geometry=generator_3)  # -> mass_data; disabled; same code as parametrizer

# ----
# New Design Performance
# Attributes
time_period_3 = Slider(0, range=0..50)  # disabled
objective = Objective(mass_data=parametrizer_3, time_period=time_period_3)  # -> objectives; disabled
# ---------- objective: Python ----------
import os
import sys
appdata = os.getenv('APPDATA')
filePath =os.path.join(appdata, "Grasshopper", "UserObjects")
if filePath not in sys.path:
    sys.path.insert(0,filePath)

from hammy.Hammy_Optimizer import objective
from hammy.Hammy_LCA import construction
from hammy.Hammy_Utils import util2
from hammy import load
from copy import deepcopy
import joblib


def calc_objs(objs):
    
    design_fs = objs.design_fact_arr
    material_fs =objs.mat_fact_arr

    oarr = design_fs + material_fs

    return oarr

def pred(pred_obj_name, features):  
    pred_setting = load.pred_settings[pred_obj_name]
    scalar_path = pred_setting['scalar_path']
    model_path = pred_setting['model_path']
    feature_ids =  pred_setting['feature_ids']
    feature_names =  pred_setting['feature_names']
    
    pred_model = joblib.load(model_path)  
    scalar_model = joblib.load(scalar_path) 

    used_features = [features[idx] for idx in feature_ids]  
    # x_df = pd.DataFrame([used_features], columns=feature_names)  

    scalared_features = scalar_model.transform([used_features])   

    pred_res = pred_model.predict(scalared_features)  
    return pred_res[0] 

def pred_energy(features,time_period = 0):
    if time_period == 0:
        energy_pred_res = pred('energy_DE',features)
    elif time_period > 0 and time_period <25:
        energy_pred_res = pred('energy_DE',features)
        energy_pred_res_future = pred('energy_GR',features)
        energy_pred_res  = util2.remap(time_period,[0,25],[energy_pred_res,energy_pred_res_future])
    elif time_period == 25:
        energy_pred_res = pred('energy_GR',features)
    elif time_period >25 and time_period< 50:
        energy_pred_res = pred('energy_DE',features)
        energy_pred_res_future = pred('energy_TU',features)
        energy_pred_res = util2.remap(time_period,[0,50],[energy_pred_res,energy_pred_res_future])
    else:
        energy_pred_res = pred('energy_TU',features)

    return energy_pred_res/3.6

def pred_daylight_objs(features):
    sDA_pred_res = pred('sDA',features)
    ASE_pres_res = pred('ASE',features)
    return [sDA_pred_res,ASE_pres_res]


construction.Construction.ref_con_lib = load.con_lib
construction.Construction.mat_lib_v21 = load.mat_lib_v21
construction.Construction.mat_lib_v23 = load.mat_lib_v23
construction.Construction.constr_lib = load.constr_lib




objectives = objective.Objective(mass_data)

geo_abs_info = objectives.mass_data.massing.geo.abs_info
calc_oarr = calc_objs(objectives)

features = geo_abs_info[:-1]+calc_oarr

energy_pred = pred_energy(features,time_period)

sDA_pred, ASE_pred = pred_daylight_objs(features)

pred_vals = [energy_pred,sDA_pred, ASE_pred]
energy_pred_config = [0,0,energy_pred]
daylight_pred_config = [sDA_pred, ASE_pred]




objectives.daylight_dict(daylight_pred_config)
objectives.calc_energy_carbon(energy_pred_config)
# ---------- end objective ----------
objectiveopt = ObjectiveOPT(detection=detector_2, geometry=generator_3, objectives=objective)  # -> objectives; disabled
# ---------- objectiveopt: Python ----------
import os
import sys
appdata = os.getenv('APPDATA')
filePath =os.path.join(appdata, "Grasshopper", "UserObjects")
if filePath not in sys.path:
    sys.path.insert(0,filePath)

    


from hammy.Hammy_Detector import Detection
from hammy.Hammy_Generator import Geometry

from hammy.Hammy_Parametrizer import Massing, MassData
from hammy.Hammy_LCA import Construction

from hammy import load
from hammy.Hammy_Optimizer import objective
from hammy.Hammy_Penalty import penalty

try:
    mass_data = objectives.mass_data

except:
    ini_abs_info = detection.geo_detection.geo_abs_info
    flr_height = detection.flr_height
    initial_geometry = Geometry(ini_abs_info)

    MassData.ref_lib = load.ref_lib
    MassData.con_lib = load.con_lib

    mass = Massing(initial_geometry)
    mass_data = MassData(mass)
    
    objectives = objective.Objective(mass_data)

    Construction.ref_con_lib = load.con_lib
    Construction.mat_lib_v21 = load.mat_lib_v21
    Construction.mat_lib_v23 = load.mat_lib_v23
    Construction.constr_lib = load.constr_lib



    daylight_objs_arr = [0.4,0.7]
    energy_objs_arr =[0,0,400]

    objectives.daylight_dict(daylight_objs_arr)
    objectives.calc_energy_carbon(energy_objs_arr)


    objectives.mass_data.massing.geo = geometry
    
    objectives.check_valid = False
# ---------- end objectiveopt ----------
penalty = Penalty(detection=detector_2, objectives=objectiveopt, assumptions=penalty_assumptions_2)  # -> penalty_object; inputs assumptions: list; disabled
# ---------- penalty: Python ----------
import os
import sys
appdata = os.getenv('APPDATA')
filePath =os.path.join(appdata, "Grasshopper", "UserObjects")
if filePath not in sys.path:
    sys.path.insert(0,filePath)


from hammy.Hammy_Utils import util2
from hammy import load
from hammy.Hammy_Penalty import penalty
from hammy.Hammy_Optimizer import objective


penalty_object = penalty.Penalty(detection, objectives, assumptions)
# ---------- end penalty ----------
criteria = Criteria(penalty_object=penalty, objectives=objectiveopt, weight_gwp=weight_gwp, weight_penalty=weight_penalty)  # -> criteria_object, criteria_value, criteria_value_penalized; disabled
# ---------- criteria: Python ----------
import os
import sys
appdata = os.getenv('APPDATA')
filePath =os.path.join(appdata, "Grasshopper", "UserObjects")
if filePath not in sys.path:
    sys.path.insert(0,filePath)




from hammy.Hammy_Utils import util2
from hammy import load
from hammy.Hammy_Penalty import penalty
from hammy.Hammy_Optimizer import objective, criteria




attributes = load.penalty_attributes
attributes["weight_gwp"] = weight_gwp
attributes["weight_penalty"] = weight_penalty

criteria_object = criteria.Criteria(objectives, penalty_object, attributes)
criteria_value = criteria_object.criteria
criteria_value_penalized = criteria_object.p_criteria
# ---------- end criteria ----------
construct_result_object = Construct_result_object(geometry=generator_3, objectives=objectiveopt, criteria_object=criteria.criteria_object)  # -> result_object; disabled
# ---------- construct_result_object: Python ----------
import os
import sys
appdata = os.getenv('APPDATA')
filePath =os.path.join(appdata, "Grasshopper", "UserObjects")
if filePath not in sys.path:
    sys.path.insert(0,filePath)

from hammy.Hammy_Generator import Geometry
from hammy.Hammy_Optimizer import objective

class GH_GOO:
    def __init__(self,config):
        self.config = config


building_id = geometry.bldg_id 
real_sample = geometry.abs_info
total_energy = objectives.energy_carbon_arr[2]
gwp_embed = objectives.energy_carbon_arr[7]
gwp_total = objectives.energy_carbon_arr[9]
try:
    weight = criteria_object.attributes['weight_gwp']
    criteria = criteria_object.criteria
except:
    weight = None
    criteria = None
area = objectives.rm_area
sDA = objectives.daylight_objs_arr[0]
ASE = objectives.daylight_objs_arr[1]




value = [building_id,real_sample,total_energy,gwp_embed,gwp_total,weight,criteria,area,sDA,ASE]
result_object = GH_GOO(value)
# ---------- end construct_result_object ----------
deconstruct_result_object = Deconstruct_result_object(result_object=construct_result_object)  # -> variables, metrics, metric_values; disabled
# ---------- deconstruct_result_object: Python ----------
best_value = result_object.config
building_id,variables,total_energy,gwp_embed,gwp_total,weight,crit,area,sDA,ASE = best_value 
metric_values = [total_energy,gwp_embed,gwp_total,area,sDA,ASE,crit,weight]

metrics = ["TOT.ENERGY [kWh/m2]", total_energy,
            "GWP EMBED  [/m2/a]", gwp_embed,
            "GWP TOTAL  [/m2/a]", gwp_total,
            "TOTAL AREA    [m2]",area,
            "sDA",sDA,
            "ASE",ASE,
            "CRITERIA",crit,
            "WEIGHT GWP",weight]
# ---------- end deconstruct_result_object ----------
metrics = Panel(deconstruct_result_object.metrics)  # disabled

# ----
# geometry_blocks
geometry_block_2 = Geometry_block(geometry=generator_2)  # -> building_blocks, courtyard_blocks; disabled; same code as geometry_block

# ----
# building_with_plan
raster_size_2 = Slider(1.5, range=0..10)  # disabled
column_raster_2 = Slider(4, range=0..10)  # disabled
corridor_depth_2 = Slider(2, range=0..10)  # disabled
merge_3 = Merge(Data1=raster_size_2, Data2=column_raster_2, Data3=corridor_depth_2)  # disabled
swatch_12 = ColourSwatch(SwatchColor=RGB(180, 232, 160))  # disabled
swatch_13 = ColourSwatch(SwatchColor=RGB(214, 134, 133))  # disabled
swatch_14 = ColourSwatch(SwatchColor=RGB(240, 202, 131))  # disabled
swatch_15 = ColourSwatch(SwatchColor=RGB(122, 147, 185))  # disabled
swatch_16 = ColourSwatch(SwatchColor=RGB(155, 188, 177))  # disabled
swatch_17 = ColourSwatch(SwatchColor=RGB(0, 0, 0))  # disabled
planer_2 = Planer(mass_data=parametrizer_2, plan_require=merge_3)  # -> zoning; inputs plan_require: list; disabled; same code as planer
panel_3 = Panel("""activity
meeting
office
corridor
open_office
core""")  # disabled
merge_4 = Merge(Data1=swatch_12, Data2=swatch_13, Data3=swatch_14, Data4=swatch_15, Data5=swatch_16, Data6=swatch_17)  # disabled
planed_building_2 = Planed_building(zoning=planer_2, zone_types=panel_3, zone_colors=merge_4)  # -> zone_meshs, glass_surfaces, roof_surfaces, wall_surfaces; inputs zone_types: list, zone_colors: list; disabled; same code as planed_building

# ----
# building
building_block_2 = Building_block(mass_data=parametrizer_2)  # -> glass_surfaces, wall_surfaces, floor_surfaces, roof_surfaces; disabled; same code as building_block
relay_2 = Relay([building_block_2.wall_surfaces, building_block_2.floor_surfaces, building_block_2.roof_surfaces])  # disabled

# ----
# 1: Detect
filter_2 = Filter(detection=detector_3)  # -> data_filter, variable_ranges, initial_uv_variables; disabled; same code as filter

# ----
# geometry_blocks
geometry_block_3 = Geometry_block(geometry=generator_3)  # -> building_blocks, courtyard_blocks; disabled; same code as geometry_block

# ----
# building_with_plan
raster_size_3 = Slider(1.5, range=0..10)  # disabled
column_raster_3 = Slider(4, range=0..10)  # disabled
corridor_depth_3 = Slider(2, range=0..10)  # disabled
merge_5 = Merge(Data1=raster_size_3, Data2=column_raster_3, Data3=corridor_depth_3)  # disabled
swatch_18 = ColourSwatch(SwatchColor=RGB(180, 232, 160))  # disabled
swatch_19 = ColourSwatch(SwatchColor=RGB(214, 134, 133))  # disabled
swatch_20 = ColourSwatch(SwatchColor=RGB(240, 202, 131))  # disabled
swatch_21 = ColourSwatch(SwatchColor=RGB(122, 147, 185))  # disabled
swatch_22 = ColourSwatch(SwatchColor=RGB(155, 188, 177))  # disabled
swatch_23 = ColourSwatch(SwatchColor=RGB(0, 0, 0))  # disabled
planer_3 = Planer(mass_data=parametrizer_3, plan_require=merge_5)  # -> zoning; inputs plan_require: list; disabled; same code as planer
panel_4 = Panel("""activity
meeting
office
corridor
open_office
core""")  # disabled
merge_6 = Merge(Data1=swatch_18, Data2=swatch_19, Data3=swatch_20, Data4=swatch_21, Data5=swatch_22, Data6=swatch_23)  # disabled
planed_building_3 = Planed_building(zoning=planer_3, zone_types=panel_4, zone_colors=merge_6)  # -> zone_meshs, glass_surfaces, roof_surfaces, wall_surfaces; inputs zone_types: list, zone_colors: list; disabled; same code as planed_building

# ----
# building
building_block_3 = Building_block(mass_data=parametrizer_3)  # -> glass_surfaces, wall_surfaces, floor_surfaces, roof_surfaces; disabled; same code as building_block
relay_3 = Relay([building_block_3.wall_surfaces, building_block_3.floor_surfaces, building_block_3.roof_surfaces])  # disabled

python_3_script = Python3Script(x=filter_2.variable_ranges)  # -> out, a; disabled
# ---------- python_3_script: Python ----------
print(x)
# ---------- end python_3_script ----------

# ----
# 1: Detect
filter_3 = Filter(detection=detector_2)  # -> data_filter, variable_ranges, initial_uv_variables; disabled; same code as filter

# ----
# reset_initial_variables
reset_range_2 = Button()  # disabled
reset_value_2 = Button()  # disabled
panel_5 = Panel("""seg_d0
seg_d1
seg_d2
seg_d3
seg_t0
seg_t1
seg_t2
seg_t3
seg_dd0
seg_dd1
seg_dd2
seg_dd3
sp0
sp1
sp2
sp3
courtyard_pattern
coutryard_form
win_ratio_s
win_ratio_n
mat_typ
mat_qua
flr_height""")  # disabled
slider_updater_3 = SliderDomainUpdater(
    Sliders=panel_5,
    variable_ranges=filter_2.variable_ranges,
    initial_uv_variables=filter_2.initial_uv_variables,
    Update=reset_range_2)  # inputs Sliders: list; disabled; same code as slider_updater
slider_updater_4 = SliderDomainUpdater(Sliders=panel_5, initial_uv_variables=filter_2.initial_uv_variables, Update=reset_value_2)  # inputs Sliders: list; disabled; same code as slider_updater_2

# ----
# reset_initial_variables
reset_range_3 = Button()  # disabled
reset_value_3 = Button()  # disabled
panel_6 = Panel("""seg_d0
seg_d1
seg_d2
seg_d3
seg_t0
seg_t1
seg_t2
seg_t3
seg_dd0
seg_dd1
seg_dd2
seg_dd3
sp0
sp1
sp2
sp3
courtyard_pattern
coutryard_form
win_ratio_s
win_ratio_n
mat_typ
mat_qua
flr_height""")  # disabled
slider_updater_5 = SliderDomainUpdater(
    Sliders=panel_6,
    variable_ranges=filter_3.variable_ranges,
    initial_uv_variables=filter_3.initial_uv_variables,
    Update=reset_range_3)  # inputs Sliders: list; disabled; same code as slider_updater
slider_updater_6 = SliderDomainUpdater(Sliders=panel_6, initial_uv_variables=filter_3.initial_uv_variables, Update=reset_value_3)  # inputs Sliders: list; disabled; same code as slider_updater_2

criteria_2 = Number(criteria.criteria_value_penalized)  # disabled
gwp_energy = Panel(criteria_2)  # disabled

# ----
# Visulize building_block
number_slider_2 = Slider(0.8, range=0..1)  # disabled
swatch_24 = ColourSwatch(SwatchColor=RGB(207, 255, 250))  # disabled
swatch_25 = ColourSwatch(SwatchColor=RGB(178, 177, 177))  # disabled
material_2 = CreateMaterial(Diffuse=swatch_24, Specular=RGB(255, 255, 255), Emission=RGB(0, 0, 0), Transparency=number_slider_2, Shine=0)  # disabled
preview_6 = CustomPreview(Geometry=building_block_2.glass_surfaces, Material=material_2)  # disabled
preview_7 = CustomPreview(Geometry=relay_2, Material=swatch_25)  # disabled

# ----
# Visulize building_block
number_slider_3 = Slider(0.8, range=0..1)  # disabled
swatch_26 = ColourSwatch(SwatchColor=RGB(207, 255, 250))  # disabled
swatch_27 = ColourSwatch(SwatchColor=RGB(178, 177, 177))  # disabled
material_3 = CreateMaterial(Diffuse=swatch_26, Specular=RGB(255, 255, 255), Emission=RGB(0, 0, 0), Transparency=number_slider_3, Shine=0)  # disabled
preview_8 = CustomPreview(Geometry=building_block_3.glass_surfaces, Material=material_3)  # disabled
preview_9 = CustomPreview(Geometry=relay_3, Material=swatch_27)  # disabled

# ----
# Visulize geometry_block
swatch_28 = ColourSwatch(SwatchColor=RGB(20, 192, 255))  # disabled
swatch_29 = ColourSwatch(SwatchColor=RGB(255, 204, 20))  # disabled
preview_10 = CustomPreview(Geometry=geometry_block_2.building_blocks, Material=swatch_29)  # disabled
preview_11 = CustomPreview(Geometry=geometry_block_2.courtyard_blocks, Material=swatch_28)  # disabled

# ----
# Visulize planed_building
swatch_30 = ColourSwatch(SwatchColor=RGB(201, 201, 201))  # disabled
preview_12 = CustomPreview(Geometry=[planed_building_2.roof_surfaces, planed_building_2.wall_surfaces], Material=swatch_30)  # disabled
mesh_2 = Mesh(planed_building_2.zone_meshs)  # disabled
srf_2 = Surface(planed_building_2.glass_surfaces)  # disabled

# ----
# Visulize geometry_block
swatch_31 = ColourSwatch(SwatchColor=RGB(20, 192, 255))  # disabled
swatch_32 = ColourSwatch(SwatchColor=RGB(255, 204, 20))  # disabled
preview_13 = CustomPreview(Geometry=geometry_block_3.building_blocks, Material=swatch_32)  # disabled
preview_14 = CustomPreview(Geometry=geometry_block_3.courtyard_blocks, Material=swatch_31)  # disabled

# ----
# Visulize planed_building
swatch_33 = ColourSwatch(SwatchColor=RGB(201, 201, 201))  # disabled
preview_15 = CustomPreview(Geometry=[planed_building_3.roof_surfaces, planed_building_3.wall_surfaces], Material=swatch_33)  # disabled
mesh_3 = Mesh(planed_building_3.zone_meshs)  # disabled
srf_3 = Surface(planed_building_3.glass_surfaces)  # disabled

resetlog = Button()  # disabled
run_name = Panel("0610")  # disabled
maxcound = Slider(200, range=0..1000)  # disabled
recording = BooleanToggle(True)  # disabled

resetlog_2 = Button()  # disabled
run_name_2 = Panel("0610")  # disabled
maxcound_2 = Slider(200, range=0..1000)  # disabled
recording_2 = BooleanToggle(True)  # disabled

opossum = Opossum(
    OpossumData_OptimizationType=2,
    OpossumData_ResultSerializationStatus=0,
    OpossumData_objective=criteria_7,
    OpossumData_variable=[coutryard_form_2, courtyard_pattern_2, sp0_2, sp1_2, sp2_2, sp3_2, seg_d0_2, seg_t0_2, seg_dd0_2, seg_dd1_2, seg_dd2_2, seg_dd3_2, seg_t1_2, seg_t2_2, seg_t3_2, seg_d1_2, seg_d2_2, seg_d3_2, win_ratio_s_2, win_ratio_n_2, mat_typ_2, mat_qua_2])  # disabled

# ----
# Log
entity = Entity(
    detection=detector_2,
    variables=vars_3,
    geometry=generator_3,
    objectives=objectiveopt,
    zoning=planer_3,
    criteria=criteria.criteria_object)  # -> entity_info; inputs variables: list; disabled
# ---------- entity: Python ----------
import os
import sys
appdata = os.getenv('APPDATA')
filePath =os.path.join(appdata, "Grasshopper", "UserObjects")
if filePath not in sys.path:
    sys.path.insert(0,filePath)



from hammy.Hammy_Utils import log

entity = log.Entity(detection, variables, geometry, objectives, zoning, criteria)
entity_info = entity.entity_info

print(entity_info)
# ---------- end entity ----------
savelog = SaveLog(entity_info=entity, MaxCount=maxcound_2, RunName=run_name_2, LogReset=resetlog_2, Recording=recording_2)  # -> main_path; inputs entity_info: list; disabled
#   port entity_info: Path to an .epw file on this computer as a text string.
# ---------- savelog: Python ----------
import os
import json



desktop_path = os.path.join(os.path.expanduser("~"), "Desktop")
if not main_path:
    main_path = desktop_path

hammy_data_path = os.path.join(main_path, "hammy_data")
hammy_log_path = os.path.join(hammy_data_path, "hammy_log")

if not os.path.exists(hammy_data_path):
    os.makedirs(hammy_data_path)
if not os.path.exists(hammy_log_path):
    os.makedirs(hammy_log_path)

log_path = os.path.join(hammy_log_path, RunName + ".json")


isvalid = entity_info[0]
bldg_id = entity_info[1]
uv_sample = list(entity_info[2])
abs_sample = list(entity_info[3])
objs = list(entity_info[4])
crits= list(entity_info[5])
ps = [list(entity_info[6][0]), entity_info[6][1]]
reqs = [entity_info[7][0], list(entity_info[7][1])]
try:
    plan_settings = dict(entity_info[8][0])
except:
    plan_settings = {
                        "raster_size" : 1.5,
                        "column_raster" : 4,
                        "facade_type" : 0,
                        "zone_type" :0,
                        "corridor_depth" :2
                        }
settings = [plan_settings, list(entity_info[8][1]), dict(entity_info[8][2])]

entity_info = [
    isvalid,
    bldg_id,
    uv_sample,
    abs_sample,
    objs,
    crits,
    ps,
    reqs,
    settings
    ]
entity_info[8][2]["weight_p_hierachy"] = list(entity_info[8][2]["weight_p_hierachy"])
entity_info[8][2]["items_p_func"] = list(entity_info[8][2]["items_p_func"])

if LogReset:
    with open(log_path, "w") as jf:
        json.dump([], jf)
        ghenv.Component.Message = 'Ready'
    
if Recording:
    with open(log_path, "r") as jf:
        data = json.load(jf)
        countBelowMax = len(data) < MaxCount
        id_curr = [d[1] for d in data]
        checked = entity_info[1] in id_curr
        if not checked and countBelowMax:
            data.append(entity_info)
        else:
            print ("already checked")

    if countBelowMax:
        with open(log_path, "w") as jf:
            jf.seek(0)
            json.dump(data, jf, indent=4)
    else:
        ghenv.Component.Message = 'Done'
        doc = ghenv.Component.OnPingDocument()
        ao = doc.ActiveObjects()
        for a in ao:
            if a.NickName == 'Recording':
                a.Value = False
            a.Locked = True
# ---------- end savelog ----------

opossum_2 = Opossum(
    OpossumData_OptimizationType=2,
    OpossumData_ResultSerializationStatus=0,
    OpossumData_objective=criteria_2,
    OpossumData_variable=[coutryard_form_3, courtyard_pattern_3, sp0_3, sp1_3, sp2_3, sp3_3, seg_d0_3, seg_t0_3, seg_dd0_3, seg_dd1_3, seg_dd2_3, seg_dd3_3, seg_t1_3, seg_t2_3, seg_t3_3, seg_d1_3, seg_d2_3, seg_d3_3, win_ratio_s_3, win_ratio_n_3, mat_typ_3, mat_qua_3])  # disabled

display = ValueList({"nebula", "bests"}, selected="nebula")  # disabled
scope = ValueList({"Better than Baseline": 0, "First Half": 1, "All Valid": 2}, selected="First Half")  # disabled
rank_with = ValueList({"Performance": True, "Penalized Criteria": False}, selected="Penalized Criteria")  # disabled
cluster_number = ValueList({"2", "3", "4", "5", "6", "7", "8", "9", "10"}, selected="6")  # disabled
variable_type = ValueList({"all_var", "geo_win", "geo", "form", "geo_perform"}, selected="geo_perform")  # disabled
pca_dimension = ValueList({"2", "3"}, selected="2")  # disabled
decomposition = ValueList({"PCA Decomposition": True, "Original Variables": False}, selected="Original Variables")  # disabled
cluster_attr = Merge(
    Data1=display,
    Data2=scope,
    Data3=rank_with,
    Data4=cluster_number,
    Data5=variable_type,
    Data6=pca_dimension,
    Data7=decomposition)  # disabled

display_2 = ValueList({"nebula", "bests"}, selected="bests")  # disabled
scope_2 = ValueList({"Better than Baseline": 0, "First Half": 1, "All Valid": 2}, selected="Better than Baseline")  # disabled
rank_with_2 = ValueList({"Performance": True, "Penalized Criteria": False}, selected="Performance")  # disabled
cluster_number_2 = ValueList({"2", "3", "4", "5", "6", "7", "8", "9", "10"}, selected="5")  # disabled
variable_type_2 = ValueList({"all_var", "geo_win", "geo", "form", "geo_perform"}, selected="geo_perform")  # disabled
pca_dimension_2 = ValueList({"2", "3"}, selected="2")  # disabled
decomposition_2 = ValueList({"PCA Decomposition": True, "Original Variables": False}, selected="Original Variables")  # disabled
cluster_attr_2 = Merge(
    Data1=display_2,
    Data2=scope_2,
    Data3=rank_with_2,
    Data4=cluster_number_2,
    Data5=variable_type_2,
    Data6=pca_dimension_2,
    Data7=decomposition_2)  # disabled

display_3 = ValueList({"nebula", "bests"}, selected="nebula")  # disabled
scope_3 = ValueList({"Better than Baseline": 0, "First Half": 1, "All Valid": 2}, selected="First Half")  # disabled
rank_with_3 = ValueList({"Performance": True, "Penalized Criteria": False}, selected="Penalized Criteria")  # disabled
cluster_number_3 = ValueList({"2", "3", "4", "5", "6", "7", "8", "9", "10"}, selected="6")  # disabled
variable_type_3 = ValueList({"all_var", "geo_win", "geo", "form", "geo_perform"}, selected="geo_perform")  # disabled
pca_dimension_3 = ValueList({"2", "3"}, selected="2")  # disabled
decomposition_3 = ValueList({"PCA Decomposition": True, "Original Variables": False}, selected="Original Variables")  # disabled
cluster_attr_3 = Merge(
    Data1=display_3,
    Data2=scope_3,
    Data3=rank_with_3,
    Data4=cluster_number_3,
    Data5=variable_type_3,
    Data6=pca_dimension_3,
    Data7=decomposition_3)  # disabled

scope_4 = ValueList({"Better than Baseline": 0, "First Half": 1, "All Valid": 2}, selected="Better than Baseline")  # disabled
rank_with_4 = ValueList({"Performance": True, "Penalized Criteria": False}, selected="Performance")  # disabled

display_4 = ValueList({"nebula", "bests"}, selected="bests")  # disabled
cluster_number_4 = ValueList({"2", "3", "4", "5", "6", "7", "8", "9", "10"}, selected="5")  # disabled
variable_type_4 = ValueList({"all_var", "geo_win", "geo", "form", "geo_perform"}, selected="geo_perform")  # disabled
pca_dimension_4 = ValueList({"2", "3"}, selected="2")  # disabled
# decision making
# attributes ->
decomposition_4 = ValueList({"PCA Decomposition": True, "Original Variables": False}, selected="Original Variables")  # disabled
cluster_attr_4 = Merge(
    Data1=display_4,
    Data2=scope_4,
    Data3=rank_with_4,
    Data4=cluster_number_4,
    Data5=variable_type_4,
    Data6=pca_dimension_4,
    Data7=decomposition_4)  # disabled

number_slider_4 = Slider(100, range=0..100)  # disabled
number_slider_5 = Slider(100, range=0..100)  # disabled

# ----
# Visulize
resetcluster = Button()  # disabled
cluster = Cluster(main_path=savelog, visual_attr=cluster_attr_4, reset_cluster=resetcluster)  # -> out, visual_result; inputs visual_attr: list; disabled
# ---------- cluster: Python ----------
import os
import sys
appdata = os.getenv('APPDATA')
filePath =os.path.join(appdata, "Grasshopper", "UserObjects")
if filePath not in sys.path:
    sys.path.insert(0,filePath)


import json
import shutil

from hammy.Hammy_Visualizer import cluster


def empty_folder(folder_path):
    for filename in os.listdir(folder_path):
        file_path = os.path.join(folder_path, filename)
        try:
            if os.path.isfile(file_path) or os.path.islink(file_path):
                os.unlink(file_path)  # Remove the file or link
            elif os.path.isdir(file_path):
                shutil.rmtree(file_path)  # Remove the directory and all its contents
        except Exception as e:
            print(f'Failed to delete {file_path}. Reason: {e}')

def copy_json_files(source_dir, dest_dir):
    # Empty the destination directory
    empty_folder(dest_dir)

    for filename in os.listdir(source_dir):
        if filename.endswith('.json'):
            source_file = os.path.join(source_dir, filename)
            dest_file = os.path.join(dest_dir, filename)
            shutil.copy2(source_file, dest_file)

desktop_path = os.path.join(os.path.expanduser("~"), "Desktop")
if not main_path:
    main_path = desktop_path
hammy_data_path = os.path.join(desktop_path, "hammy_data")
hammy_log_path = os.path.join(hammy_data_path, "hammy_log")
hammy_read_path = os.path.join(hammy_data_path, "hammy_read")
hammy_display_path = os.path.join(hammy_data_path, "hammy_display")
nebula_path = os.path.join(hammy_display_path, "hammy_nebula")   
bests_path = os.path.join(hammy_display_path, "hammy_bests")

visual_paths = [hammy_data_path, hammy_log_path, hammy_read_path, hammy_display_path, nebula_path, bests_path]
if reset_cluster:
    for p in visual_paths:
        if not os.path.exists(p):
            os.makedirs(p)
     
    empty_folder(nebula_path)
    empty_folder(bests_path)
    copy_json_files(hammy_log_path,hammy_read_path)

attributes = {
    "visual_aim": visual_attr[0],
    "scope": visual_attr[1],
    "rank_with_perform": visual_attr[2],
    "n_clusters": visual_attr[3],
    "var_name": visual_attr[4],
    "pca_dim": visual_attr[5],
    "if_pca": visual_attr[6],
}

try:
    visualization = cluster.Visualization(hammy_read_path, hammy_display_path, attributes)
    visual_result = visualization.res_log_path
except:
    raise ValueError("Feed ME DATA for FOod!!!!")
# ---------- end cluster ----------
cluster_2 = Cluster(main_path=savelog, visual_attr=cluster_attr_3, reset_cluster=resetcluster)  # -> out, visual_result; inputs visual_attr: list; disabled; same code as cluster
colour_swatch = ColourSwatch(SwatchColor=RGB(184, 224, 255))  # disabled
colour_swatch_2 = ColourSwatch(SwatchColor=RGB(69, 156, 255))  # disabled
colour_swatch_3 = ColourSwatch(SwatchColor=RGB(255, 69, 199))  # disabled
number_slider_6 = Slider(0, range=0..10)  # disabled
bests = Bests(bests=cluster.visual_result)  # -> best_objects; disabled
# ---------- bests: Python ----------
import json
import Rhino.Geometry as rg
import rhinoscriptsyntax as rs
import System.Drawing as sd


with open(bests,"r") as f:
    display_datas =json.load(f)
class GH_GOO:
    def __init__(self,config):
        self.config = config


best_objects =[]
for file_name, content in display_datas[0].items():
    weight = content["Settings"]["Criteria Attributes"]["weight_gwp"]
    break
for i,display_data in enumerate(display_datas[2]):
    building_id = display_datas[1][i][0]
    # abs_iteration = display_datas[1][i][1]
    cluster_id = display_datas[1][i][2]
    cluster_pt = display_datas[1][i][3]
    total_energy = display_datas[1][i][4][0]
    gwp_embed = display_datas[2][i][4][3]
    rank = display_datas[2][i][5][1]
    crit = display_datas[2][i][5][0]
    real_sample = display_data[3]
    area = display_datas[2][i][4][1]
    sDA = display_datas[2][i][4][5]
    ASE = display_datas[2][i][4][6]
    gwp_total = display_datas[2][i][4][4]

    best_value = [building_id,real_sample,total_energy,gwp_embed,gwp_total,weight,crit,area,sDA,ASE]
    
    best_instance = GH_GOO(best_value)
    best_objects.append(best_instance)
# ---------- end bests ----------
merge_7 = Merge(Data1=colour_swatch, Data2=colour_swatch_2, Data3=colour_swatch_3)  # disabled
nebula = Nebula(total=cluster_2.visual_result, bests=cluster.visual_result, colors=merge_7)  # -> bests_cluster_point, nebula_sphere, result_objects; inputs colors: list; disabled
# ---------- nebula: Python ----------
import json
import Rhino.Geometry as rg
import rhinoscriptsyntax as rs
import System.Drawing as sd

def remap_range_color(value, old_min, old_max, new_min, new_max):
    """
    Remaps a value from one range to another.
    """
    return new_min + (value - old_min) * (new_max - new_min) / (old_max - old_min)

def create_color_gradient(start_color, end_color, steps):
    colors = []
    for i in range(steps):
        factor = remap_range_color(i, 0, steps - 1, 0, 1)
        r = int(remap_range_color(factor, 0, 1, start_color.R, end_color.R))
        g = int(remap_range_color(factor, 0, 1, start_color.G, end_color.G))
        b = int(remap_range_color(factor, 0, 1, start_color.B, end_color.B))
        colors.append(sd.Color.FromArgb(r, g, b))
    return colors

def visualize(mesh,  custom_color): 
    if mesh: 
        jaggedAndFaster = rg.MeshingParameters.Coarse 
        mesh.VertexColors.CreateMonotoneMesh(custom_color)
        return mesh


def remap_range(values,output_range):
    input_min = min(values)
    input_max = max(values)
    output_min, output_max = output_range
    scale = (output_max - output_min) / (input_max - input_min)

    remapped_values = [output_min + (value - input_min) * scale for value in values]
    
    return remapped_values



class GH_GOO:
    def __init__(self,config):
        self.config = config


with open(total,"r") as f:
    display_datas =json.load(f)
with open(bests,"r") as best_file:
    best_data = json.load(best_file)


variabls = []
cluster_pts = []
cluster_ids =[]
total_energys =[]
gwp_embeds =[]
ranks =[]
scores =[]
building_ids =[]
abs_iterations =[]
total_area =[]
sDAs =[]
ASEs =[]
crits =[]
gwp_totals =[]
result_objects =[]

for file_name, content in display_datas[0].items():
    weight = content["Settings"]["Criteria Attributes"]["weight_gwp"]
    break

for i,display_data in enumerate(display_datas[2]):
    building_id = display_datas[1][i][0]
    # abs_iteration = display_datas[1][i][1]
    cluster_id = display_datas[1][i][2]
    cluster_pt = display_datas[1][i][3]
    total_energy = display_datas[1][i][4][0]
    gwp_embed = display_datas[2][i][4][3]
    rank = display_datas[2][i][5][1]
    crit = display_datas[2][i][5][0]
    real_sample = display_data[3]
    area = display_datas[2][i][4][1]
    sDA = display_datas[2][i][4][5]
    ASE = display_datas[2][i][4][6]
    gwp_total = display_datas[2][i][4][4]
    value = [building_id,real_sample,total_energy,gwp_embed,gwp_total,weight,crit,area,sDA,ASE]
    instance = GH_GOO(value)
    result_objects.append(instance)

    gwp_totals.append(gwp_total)
    crits.append(crit)
    sDAs.append(sDA)
    ASEs.append(ASE)
    total_area.append(area)
    variabls.append(real_sample)
    cluster_ids.append(cluster_id)
    cluster_pts.append(cluster_pt)
    total_energys.append(total_energy)
    gwp_embeds.append(gwp_embed)
    ranks.append(rank)

    # abs_iterations.append(abs_iteration)
    building_ids.append(building_id)
    

best_building_ids = []

for i,display_data in enumerate(best_data[2]):
    building_id = best_data[1][i][0]

    best_building_ids.append(building_id)

matched_index = []
for i in range(len(best_building_ids)):
    for j in range(len(building_ids)):
        best_building_id = float(best_building_ids[i])
        building_id = float(building_ids[j])
        if building_id == best_building_id:
            matched_index.append(j)
            # continue




remaped_energy = remap_range(total_energys,[0,99])
remaped_gwp = remap_range(gwp_embeds,[10,30])
remaped_scores = remap_range(crits,[0,2500])

nebula_sphere =[]
colors_gradient0 = create_color_gradient(colors[0],colors[1],20)
colors_gradient1 = create_color_gradient(colors[1],colors[2],80)
colors_gradient = colors_gradient0 + colors_gradient1
cluster_centers = []
for i in range(len(building_ids)):

    cluster_center = rg.Point3d(cluster_pts[i][0]*500,cluster_pts[i][1]*500,remaped_scores[i])
    cluster_centers.append(cluster_center)
    sphere = rg.Sphere(cluster_center,remaped_gwp[i])
    mesh = rg.Mesh.CreateFromSphere(sphere,10,10)
    color = colors_gradient[int(remaped_energy[i])]
    mesh = visualize(mesh,color)
    nebula_sphere.append(mesh)


bests_cluster_point =[]
for ind in matched_index:
    pt = cluster_centers[ind]
    bests_cluster_point.append(pt)
# ---------- end nebula ----------
list_item = ListItem(List=bests, Index=number_slider_6, Wrap=True)  # disabled
list_item_2 = ListItem(List=nebula.result_objects, Index=number_slider_5, Wrap=True)  # disabled
deconstruct_result_object_2 = Deconstruct_result_object(result_object=list_item)  # -> variables, metrics, metric_values; disabled
# ---------- deconstruct_result_object_2: Python ----------
best_value = result_object.config
building_id,variables,total_energy,gwp_embed,gwp_total,weight,crit,area,sDA,ASE = best_value 
metric_values = [total_energy,gwp_embed,gwp_total,area,sDA,ASE,crit,weight]

metrics = ["TOT.ENERGY [MJ/m2]", total_energy,
            "GWP EMBED  [/m2/a]", gwp_embed,
            "GWP TOTAL  [/m2/a]", gwp_total,
            "TOTAL AREA    [m2]",area,
            "sDA",sDA,
            "ASE",ASE,
            "CRITERIA",crit,
            "WEIGHT GWP",weight]
# ---------- end deconstruct_result_object_2 ----------
deconstruct_result_object_3 = Deconstruct_result_object(result_object=list_item_2)  # -> variables, metrics, metric_values; disabled; same code as deconstruct_result_object_2
freegenerator = FreeGenerator(variables=deconstruct_result_object_2.variables)  # -> geometry; inputs variables: list; disabled
# ---------- freegenerator: Python ----------
import os
import sys
appdata = os.getenv('APPDATA')
filePath =os.path.join(appdata, "Grasshopper", "UserObjects")
if filePath not in sys.path:
    sys.path.insert(0,filePath)


from hammy.Hammy_Generator import Geometry

geometry = Geometry(variables)
# ---------- end freegenerator ----------
freegenerator_2 = FreeGenerator(variables=deconstruct_result_object_3.variables)  # -> geometry; inputs variables: list; disabled; same code as freegenerator
metrics_2 = Panel(deconstruct_result_object_2.metrics)  # disabled
metrics_3 = Panel(deconstruct_result_object_3.metrics)  # disabled
geometry_block_4 = Geometry_block(geometry=freegenerator)  # -> building_blocks, courtyard_blocks; disabled; same code as geometry_block
geometry_block_5 = Geometry_block(geometry=freegenerator_2)  # -> building_blocks, courtyard_blocks; disabled; same code as geometry_block
values = Panel(deconstruct_result_object_2.metric_values)  # disabled
values_2 = Panel(deconstruct_result_object_3.metric_values)  # disabled

mesh_4 = Mesh(nebula.nebula_sphere)  # disabled

list_item_3 = ListItem(List=nebula.nebula_sphere, Index=number_slider_5, Wrap=True)  # disabled
point = Point(Point(0, 0, 0))  # disabled
line = Line(StartPoint=nebula.bests_cluster_point, EndPoint=point)  # disabled
area_4 = Area(Geometry=list_item_3)  # -> Area, Centroid; disabled
colour_swatch_4 = ColourSwatch(SwatchColor=RGB(135, 135, 135))  # disabled
sphere = Sphere(Base=area_4.Centroid, Radius=100)  # disabled
custom_preview = CustomPreview(Geometry=sphere, Material=colour_swatch_4)  # disabled

# ----
# 4: Building Performance
# Attributes
weight_gwp_2 = Slider(0.616, range=0..1)  # disabled
weight_penalty_2 = Slider(0.5, range=0..1)  # disabled
objective_2 = Objective(mass_data=parametrizer, time_period=time_period)  # -> objectives; disabled; same code as objective

objectiveopt_2 = ObjectiveOPT(detection=detector, geometry=generator, objectives=objective_2)  # -> objectives; disabled; same code as objectiveopt
penalty_2 = Penalty(detection=detector, objectives=objectiveopt_2, assumptions=penalty_assumptions)  # -> penalty_object; inputs assumptions: list; disabled; same code as penalty

criteria_3 = Criteria(penalty_object=penalty_2, objectives=objectiveopt_2, weight_gwp=weight_gwp_2, weight_penalty=weight_penalty_2)  # -> criteria_object, criteria_value, criteria_value_penalized; disabled; same code as criteria

criteria_4 = Number(criteria_3.criteria_value_penalized)  # disabled
gwp_energy_2 = Panel(criteria_4)  # disabled

construct_result_object_2 = Construct_result_object(geometry=generator, objectives=objectiveopt_2, criteria_object=criteria_3.criteria_object)  # -> result_object; disabled; same code as construct_result_object
deconstruct_result_object_4 = Deconstruct_result_object(result_object=construct_result_object_2)  # -> variables, metrics, metric_values; disabled; same code as deconstruct_result_object
metrics_4 = Panel(deconstruct_result_object_4.metrics)  # disabled

# ----
# 4: Building Performance
# Initial Performance
generator_4 = Generator(detection=detector_2, uv_variables=filter_3.initial_uv_variables)  # -> geometry; disabled; same code as generator
parametrizer_4 = Parametrizer(geometry=generator_4)  # -> mass_data; disabled; same code as parametrizer

objective_3 = Objective(mass_data=parametrizer_4, time_period=0)  # -> objectives; disabled; same code as objective

penalty_3 = Penalty(detection=detector_2, objectives=objective_3, assumptions=penalty_assumptions_2)  # -> penalty_object; inputs assumptions: list; disabled; same code as penalty
criteria_5 = Criteria(penalty_object=penalty_3, objectives=objective_3, weight_gwp=weight_gwp, weight_penalty=weight_penalty)  # -> criteria_object, criteria_value, criteria_value_penalized; disabled; same code as criteria
construct_result_object_3 = Construct_result_object(geometry=generator_4, objectives=objective_3, criteria_object=criteria_5.criteria_object)  # -> result_object; disabled; same code as construct_result_object

deconstruct_result_object_5 = Deconstruct_result_object(result_object=construct_result_object_3)  # -> variables, metrics, metric_values; disabled; same code as deconstruct_result_object

metrics_5 = Panel(deconstruct_result_object_5.metrics)  # disabled

# ----
# 4: Building Performance
# Attributes
objective_4 = Objective(mass_data=parametrizer_2, time_period=time_period_2)  # -> objectives; disabled; same code as objective
weight_gwp_3 = Slider(0.616, range=0..1)  # disabled
weight_penalty_3 = Slider(0.5, range=0..1)  # disabled

objectiveopt_3 = ObjectiveOPT(detection=detector_3, geometry=generator_2, objectives=objective_4)  # -> objectives; disabled; same code as objectiveopt
penalty_4 = Penalty(detection=detector_3, objectives=objectiveopt_3, assumptions=penalty_assumptions_3)  # -> penalty_object; inputs assumptions: list; disabled; same code as penalty

criteria_6 = Criteria(penalty_object=penalty_4, objectives=objectiveopt_3, weight_gwp=weight_gwp_3, weight_penalty=weight_penalty_3)  # -> criteria_object, criteria_value, criteria_value_penalized; disabled; same code as criteria

criteria_7 = Number(criteria_6.criteria_value_penalized)  # disabled
gwp_energy_3 = Panel(criteria_7)  # disabled

construct_result_object_4 = Construct_result_object(geometry=generator_2, objectives=objectiveopt_3, criteria_object=criteria_6.criteria_object)  # -> result_object; disabled; same code as construct_result_object
deconstruct_result_object_6 = Deconstruct_result_object(result_object=construct_result_object_4)  # -> variables, metrics, metric_values; disabled; same code as deconstruct_result_object
metrics_6 = Panel(deconstruct_result_object_6.metrics)  # disabled

# ----
# Log
entity_2 = Entity(
    detection=detector_3,
    variables=vars_2,
    geometry=generator_2,
    objectives=objectiveopt_3,
    zoning=planer_2,
    criteria=criteria_6.criteria_object)  # -> entity_info; inputs variables: list; disabled; same code as entity
savelog_2 = SaveLog(entity_info=entity_2, MaxCount=maxcound, RunName=run_name, LogReset=resetlog, Recording=recording)  # -> main_path; inputs entity_info: list; disabled; same code as savelog

# ----
# Visulize
resetcluster_2 = Button()  # disabled
cluster_3 = Cluster(main_path=savelog_2, visual_attr=cluster_attr_2, reset_cluster=resetcluster_2)  # -> out, visual_result; inputs visual_attr: list; disabled; same code as cluster
cluster_4 = Cluster(main_path=savelog_2, visual_attr=cluster_attr, reset_cluster=resetcluster_2)  # -> out, visual_result; inputs visual_attr: list; disabled; same code as cluster
colour_swatch_5 = ColourSwatch(SwatchColor=RGB(69, 156, 255))  # disabled
colour_swatch_6 = ColourSwatch(SwatchColor=RGB(255, 69, 199))  # disabled
colour_swatch_7 = ColourSwatch(SwatchColor=RGB(184, 224, 255))  # disabled
number_slider_7 = Slider(0, range=0..10)  # disabled
bests_2 = Bests(bests=cluster_3.visual_result)  # -> best_objects; disabled; same code as bests
merge_8 = Merge(Data1=colour_swatch_7, Data2=colour_swatch_5, Data3=colour_swatch_6)  # disabled
nebula_2 = Nebula(total=cluster_4.visual_result, bests=cluster_3.visual_result, colors=merge_8)  # -> bests_cluster_point, nebula_sphere, result_objects; inputs colors: list; disabled; same code as nebula
list_item_4 = ListItem(List=bests_2, Index=number_slider_7, Wrap=True)  # disabled
list_item_5 = ListItem(List=nebula_2.result_objects, Index=number_slider_4, Wrap=True)  # disabled
deconstruct_result_object_7 = Deconstruct_result_object(result_object=list_item_4)  # -> variables, metrics, metric_values; disabled; same code as deconstruct_result_object_2
deconstruct_result_object_8 = Deconstruct_result_object(result_object=list_item_5)  # -> variables, metrics, metric_values; disabled; same code as deconstruct_result_object_2
freegenerator_3 = FreeGenerator(variables=deconstruct_result_object_7.variables)  # -> geometry; inputs variables: list; disabled; same code as freegenerator
freegenerator_4 = FreeGenerator(variables=deconstruct_result_object_8.variables)  # -> geometry; inputs variables: list; disabled; same code as freegenerator
metrics_7 = Panel(deconstruct_result_object_7.metrics)  # disabled
metrics_8 = Panel(deconstruct_result_object_8.metrics)  # disabled
geometry_block_6 = Geometry_block(geometry=freegenerator_3)  # -> building_blocks, courtyard_blocks; disabled; same code as geometry_block
geometry_block_7 = Geometry_block(geometry=freegenerator_4)  # -> building_blocks, courtyard_blocks; disabled; same code as geometry_block
values_3 = Panel(deconstruct_result_object_7.metric_values)  # disabled
values_4 = Panel(deconstruct_result_object_8.metric_values)  # disabled

list_item_6 = ListItem(List=nebula_2.nebula_sphere, Index=number_slider_4, Wrap=True)  # disabled
point_2 = Point(Point(0, 0, 0))  # disabled
line_2 = Line(StartPoint=nebula_2.bests_cluster_point, EndPoint=point_2)  # disabled
area_5 = Area(Geometry=list_item_6)  # -> Area, Centroid; disabled
colour_swatch_8 = ColourSwatch(SwatchColor=RGB(247, 255, 0))  # disabled
sphere_2 = Sphere(Base=area_5.Centroid, Radius=100)  # disabled
custom_preview_2 = CustomPreview(Geometry=sphere_2, Material=colour_swatch_8)  # disabled

mesh_5 = Mesh(nebula_2.nebula_sphere)  # disabled
